# Grasshopper definition Simple Room.gh (Grasshopper 1.0.7)
# Copyright: 2021
# plug-ins: MantaRay, LadybugGrasshopper

panel = Panel(". /etc/profile;. ~/.profile;mkdir -p <LinuxHome>;cd <LinuxHome>")
falsestart = LBFalseStartToggle(True)
connect = ConnectSSHFTP(
    User="lio",
    Ip="mm-c0d0e-028",
    ProjectName="SimpleRoom",
    Password="_prompt",
    _port="2222",
    Connect=falsestart,
    Prefixes=panel)  # -> Status, Prefixes, Run
parserhinofile = ParseRhinoFile(LayerPrefix="Daylight_Inputs::_", Grids="Grids", Run=False)  # -> GlassGeometries, GlassModifiers, port, OpaqueGeometries, OpaqueModifiers, port_2, CustomGeometries, ModifierNames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
panel_2 = Panel(parserhinofile.SkippedLayers)
de_modifier = DeconstructModifier(Modifier=parserhinofile.GlassModifiers)  # -> GeoName, ModifierName
de_modifier_2 = DeconstructModifier(Modifier=parserhinofile.OpaqueModifiers)  # -> GeoName, ModifierName
mesh2obj = MeshToObj(
    Mesh=graft(parserhinofile.GlassGeometries),
    Name=graft(de_modifier.GeoName),
    ModifierName=graft(de_modifier.ModifierName),
    MapFileName="glass",
    TargetFolder="objFiles",
    Run=parserhinofile.Ran,
    MapFile="glass")  # -> ObjFiles, MapFile, Run
mesh2obj_2 = MeshToObj(
    Mesh=graft(parserhinofile.OpaqueGeometries),
    Name=graft(de_modifier_2.GeoName),
    ModifierName=graft(de_modifier_2.ModifierName),
    MapFileName="mapping",
    TargetFolder="objFiles",
    Run=parserhinofile.Ran,
    MapFile="mapping")  # -> ObjFiles, MapFile, Run
obj2rad = ObjToRad(
    ObjFiles=mesh2obj.ObjFiles,
    MapFile=mesh2obj.MapFile,
    TargetFolder="radFiles",
    Run=mesh2obj.Run,
    stdouts="radFiles/Glass_70_geo.rad")  # -> Status, RadFiles, Run
overrides = ApplyOverrides(Input="head <radFile>", RadFile=graft(obj2rad.RadFiles))  # -> Output, DynamicOutput
executessh = ExecuteSSH(
    _SSHCommands_=overrides.DynamicOutput,
    Run=obj2rad.Run,
    addPrefix=True,
    description="head radFiles/Glass_70_geo.rad",
    fireLogs=False,
    lastRunTime=57.1781,
    suppressWarnings=False,
    results="""# obj2rad -m /home/lio/MantaRay/SimpleRoom/radFiles/glass.map -f /home/lio/MantaRay/SimpleRoom/radFiles/Glass_70_geo.obj
# Written with MantaRay plugin/GH_MeshToRad

Glass_70 polygon Glass_70_geo_1.1
0
0
12
              1.198             -3.115              2.131
              3.164             -3.115              2.131
              3.164             -3.115               1.11""",
    commands="head radFiles/Glass_70_geo.rad")  # -> Stdout, Stderr_, Ran
executessh_2 = ExecuteSSH(_SSHCommands_="oconv", Run=False, addPrefix=True, fireLogs=False, lastRunTime=0, suppressWarnings=False)  # -> Stdout, Stderr_, Ran
