# Grasshopper definition 01 Basics.gh (Grasshopper 1.0.7)
# Copyright: 2021
# plug-ins: MantaRay

# ----
# 1) Connect
# To be able to use the plugin you will need access to a linux server through SSH.
# 
# In the component below you can insert your credentials and it's optional whether
#  you will save the password in the GH document. If you don't, you'll be prompted
# once per grasshopper session.
# 
# If SSH is not found on the host and the ip is
# local (127.0.0.1) there's a chance that the
# plugin will establish SSH through a bash prompt.
# 
# Don't worry, it wont ask for the question again
# on reloads etc. If you want to re/disconnect
# then toggle connect to false and back to true.
toggle = BooleanToggle(False)
connect_ssh = ConnectSSH(User="mss", Ip="127.0.0.1", Password="_prompt", _port=22, Connect=toggle)  # -> Status, Run
panel = Panel(connect_ssh.Status)

# ----
# MantaRay
# An Educational Tool to Work Directly with
# Radiance Through Grasshopper and SSH
# https://github.com/Sonderwoods/MantaRay
# Mathias Sønderskov Schaltz
image = ImageSampler(
    FilePath="C:\Users\mm1013\Desktop\mantarayLowres.PNG",
    Filter="Colour",
    Interpolate=True,
    Umax=1,
    Umin=0,
    Vmax=1,
    Vmin=0,
    Wrap=1)  # disabled

# ----
# If the connection is working properly
# you should see Hello World here!
toggle_2 = BooleanToggle(False)
# 2) Execute Component
panel_2 = Panel("echo \"Hello World\"")
execute_ssh_async = ExecuteSSHAsync(
    _SSHCommands_=panel_2,
    Run=toggle_2,
    addPrefix=True,
    addSuffix=True,
    description="echo \"Hello World\"",
    fireLogs=False,
    stdouts="Hello World",
    suppressWarnings=False)  # -> Stdout, Stderr_, Log, Pid, Ran
panel_3 = Panel(execute_ssh_async.Ran)
panel_4 = Panel(execute_ssh_async.Stdout)

# ----
# Here we have an stderr
# instead of the stdout
# Here we a typo. (ehho)
panel_5 = Panel("ehho \"Hello World\"")
execute_ssh_async_2 = ExecuteSSHAsync(
    _SSHCommands_=panel_5,
    Run=Toggle(True),
    addPrefix=True,
    addSuffix=True,
    description="ehho \"Hello World\"",
    fireLogs=False,
    suppressWarnings=False)  # -> Stdout, Stderr_, Log, Pid, Ran
panel_6 = Panel(execute_ssh_async_2.Stdout)
panel_7 = Panel(execute_ssh_async_2.Ran)
panel_8 = Panel(execute_ssh_async_2.Stderr_)

# ----
# Color codes
# Running
component_color = TestComponentColor(Color=RGB(140, 13, 140), SelColor=RGB(140, 13, 140))

# ----
# Here, run is set to false
# But we're still seeing the
# stdout.
# 
# That's because it previously has
# been run in this file before it was saved.
# 
# Also this descending connected components will
# only be expired when run is set to true.
# This avoids that the rest of your script runs twice
# after setting Run to true and then false.
# The component saves the last successful stdout.
# So now it has a green color.
# 
# The component saves the stdout even when you reload
# the grasshopper document. This way, the component
# will just output the path for the result file.
# 
# This is ideal for cases where you generate static
# content such as a reusable MF6 sky etc that takes time.
# 
# If you want to clear the cache for this component (or for all components),
# simply right click on it and hit clear.
panel_9 = Panel("echo \"Hello World\"")
execute_ssh_async_3 = ExecuteSSHAsync(
    _SSHCommands_=panel_9,
    Run=Toggle(False),
    addPrefix=True,
    addSuffix=True,
    description="echo \"Hello World\"",
    fireLogs=False,
    stdouts="Hello World",
    suppressWarnings=False)  # -> Stdout, Stderr_, Log, Pid, Ran
panel_10 = Panel(execute_ssh_async_3.Stdout)

# ----
# This thing is purple while it is running
panel_11 = Panel("sleep 9")
trigger = Trigger(Interval=10000, TimerInterval=10000, Target=execute_ssh_async_4)
execute_ssh_async_4 = ExecuteSSHAsync(
    _SSHCommands_=panel_11,
    Run=Toggle(True),
    addPrefix=True,
    addSuffix=True,
    description="sleep 9",
    fireLogs=False,
    suppressWarnings=False)  # -> Stdout, Stderr_, Log, Pid, Ran
panel_12 = Panel(execute_ssh_async_4.Stdout)
panel_13 = Panel(execute_ssh_async_4.Ran)

# ----
# Ran fine
component_color_2 = TestComponentColor(Color=RGB(217, 217, 217), SelColor=RGB(217, 217, 217))

# ----
# stderr
component_color_3 = TestComponentColor(Color=RGB(255, 155, 33), SelColor=RGB(255, 155, 33))

# ----
# reusing results
component_color_4 = TestComponentColor(Color=RGB(97, 117, 115), SelColor=RGB(97, 117, 115))

# ----
# errors such as no connection
component_color_5 = TestComponentColor(Color=RGB(217, 17, 17), SelColor=RGB(217, 17, 17))

# ----
# Here you setup globals for your document.
# It could be paths to result files, ambient parameters,
# project name etc etc
panel_14 = Panel("""TestProject
-ab 3 -ad 4096""")
panel_15 = Panel("""projectName
amb""")
global_overrides = GlobalOverrides(Keys=panel_15, Values=panel_14)  # disabled
panel_16 = Panel(global_overrides)

# ----
# You can also use the zoomable UI,
# simply rename the inputs to value names.
panel_17 = Panel("TestProject")
global_overrides_2 = GlobalOverrides(ProjectName=panel_17, Amb="-ab 3 -ad 4096")  # disabled
panel_18 = Panel(global_overrides_2)

# ----
# <cpus> is set to your local cpu count minus 1.
# If running remotely, this can be overwriten like below.
# changing items in this component will NOT update other execute components in your script.
# You'll have to manually trigger/recompute those.
# 
# It's technically possible,
# but I'm afraid it will cause unwanted effects such as loosing long simulation results etc.
panel_19 = Panel("6")
global_overrides_3 = GlobalOverrides(Cpus=panel_19)  # disabled
panel_20 = Panel(global_overrides_3)

# ----
# 3) Global Variables
# This component outputs globals created already in the connect component above
global_overrides_4 = GlobalOverrides()
panel_21 = Panel(global_overrides_4)

# ----
# There can only be one of these components active on your canvas at a time.
# So to activate this one, you will have to deactivate the first one above!
global_overrides_5 = GlobalOverrides()  # disabled
panel_22 = Panel(global_overrides_5)

# ----
# you can omit file names by using <input-.>
# This will remove everything after the dot.
# Convenient for file names.
# 
# Alternatively you can use <myinput-N> to remove the last N characters
panel_23 = Panel("""echo "<message-.>"
echo "<message-6>"
""")
overrides = ApplyOverrides(Input_=panel_23, Message=graft("MyRadFile.rad"))  # -> Output, Pairs
panel_24 = Panel(overrides.Output)

# ----
# You can right click on the component and choose "Fill missing parameters"
# Right click here in the middle
panel_25 = Panel("echo \"<message>\"")
overrides_2 = ApplyOverrides(Input_=panel_25)  # -> Output, Pairs

# ----
# Now the component automatically
# added the missing parameters
# Try connecting the hello world to message
panel_26 = Panel("echo \"<message>\"")
panel_27 = Panel("Hello World")
overrides_3 = ApplyOverrides(Input_=panel_26)  # -> Output, Pairs
panel_28 = Panel(overrides_3.Output)

# ----
# Now it looks good
panel_29 = Panel("echo \"<message>\"")
overrides_4 = ApplyOverrides(Input_=panel_29, Message=graft("Hello World"))  # -> Output, Pairs
panel_30 = Panel(overrides_4.Output)

# ----
# You can also use the globals set up (left column of here)
panel_31 = Panel("echo \"You will use <cpus> cpus\"")
panel_32 = Panel("echo \"Your project <projectName> is working in <LinuxHome>\"")
overrides_5 = ApplyOverrides(Input_=[panel_31, panel_32])  # -> Output, Pairs
panel_33 = Panel(overrides_5.Output)

# ----
# 4) Using the variables
# Start inputting your SSH command (linux command) into the ApplyGlobals component
# You see an error now that "message" is missing
panel_34 = Panel("echo \"<message>\"")
overrides_6 = ApplyOverrides(Input_=panel_34)  # -> Output, Pairs

# ----
# If you don't depend on any local variables but only the globals,
# you can input the prompt directly to the Execute component
panel_35 = Panel("echo \"You'll use <cpus> cpus\"")
execute_ssh_async_5 = ExecuteSSHAsync(
    _SSHCommands_=panel_35,
    Run=Toggle(False),
    addPrefix=True,
    addSuffix=True,
    description="echo \"You'll use 11 cpus\"",
    fireLogs=False,
    stdouts="You'll use 11 cpus",
    suppressWarnings=False)  # -> Stdout, Stderr_, Log, Pid, Ran
panel_36 = Panel(execute_ssh_async_5.Stdout)

# ----
# 5) Uploading and downloading
# Download a file through SSH/sFTP
panel_37 = Panel("""echo "Hello World" > ~/hello_world.txt
echo ~/hello_world.txt""")
execute_ssh_async_6 = ExecuteSSHAsync(
    _SSHCommands_=panel_37,
    Run=Toggle(True),
    addPrefix=True,
    addSuffix=True,
    description="""echo "Hello World" > ~/hello_world.txt
echo ~/hello_world.txt""",
    fireLogs=False,
    stdouts="/home/mss/hello_world.txt",
    suppressWarnings=False)  # -> Stdout, Stderr_, Log, Pid, Ran
download = Download(
    LinuxFilePaths=execute_ssh_async_6.Stdout,
    TargetLocalFolder="C:\Temp",
    Run=execute_ssh_async_6.Ran,
    stdouts="C:\Temp\hello_world.txt")  # -> Status, FilePaths, Ran
panel_38 = Panel(download.Status)
filename = Text(download.FilePaths)
panel_39 = Panel(filename)

# ----
# Check the file in windows environment
filename_2 = Text(filename)
file = ReadFile(File=filename_2, PerLineParse=True)
panel_40 = Panel(file)

# ----
# Upload a file through SSH/sFTP
filename_3 = Text(filename)
run = Boolean(execute_ssh_async_6.Ran)
upload = Upload(LocalFilePaths=filename_3, SubfolderOverride="test", Run=run, stdouts="~/test/hello_world.txt")  # -> Status, FilePaths, Ran
panel_41 = Panel(upload.Status)
filename_4 = Text(upload.FilePaths)
panel_42 = Panel(filename_4)

# ----
# Check in linux
filename_5 = Text(filename_4)
run_2 = Boolean(upload.Ran)
overrides_7 = ApplyOverrides(Input_="cat <filename>", Filename=graft(filename_5))  # -> Output, Pairs
execute_ssh_async_7 = ExecuteSSHAsync(
    _SSHCommands_=overrides_7.Output,
    Run=run_2,
    addPrefix=True,
    addSuffix=True,
    description="cat ~/test/hello_world.txt",
    fireLogs=False,
    stdouts="Hello World",
    suppressWarnings=False)  # -> Stdout, Stderr_, Log, Pid, Ran
panel_43 = Panel(execute_ssh_async_7.Stdout)

convertpaths = ConvertPaths(I=filename_4)  # -> Linux, Windows
panel_44 = Panel(convertpaths.Windows)

# ----
# 6) First radiance script
# Example as pr 6.3
# Case Study I in Rendering with Radiance p355
# create a sky
panel_45 = Panel("""echo "
# uniform brightness sky (B=1)
void glow sky_glow
0
0
4 1 1 1 0
sky_glow source sky
0
0
4 0 0 1 180" > <target>
echo <target>""")
overrides_8 = ApplyOverrides(Input_=panel_45, Target=graft("myFile.rad"))  # -> Output, Pairs
execute_ssh_async_8 = ExecuteSSHAsync(
    _SSHCommands_=overrides_8.Output,
    Run=Toggle(True),
    addPrefix=True,
    addSuffix=True,
    description="""echo "
# uniform brightness sky (B=1)
void glow sky_glow
0
0
4 1 1 1 0
sky_glow source sky
0
0
4 0 0 1 180" > myFile.rad
echo myFile.rad""",
    fireLogs=False,
    stdouts="myFile.rad",
    suppressWarnings=False)  # -> Stdout, Stderr_, Log, Pid, Ran
panel_46 = Panel(execute_ssh_async_8.Stdout)

# ----
# show the content of the file (cat)
run_3 = Boolean(execute_ssh_async_8.Ran)
radfile = Text(panel_46)
overrides_9 = ApplyOverrides(Input_="cat <file>", File=graft(radfile))  # -> Output, Pairs
execute_ssh_async_9 = ExecuteSSHAsync(
    _SSHCommands_=overrides_9.Output,
    Run=run_3,
    addPrefix=True,
    addSuffix=True,
    description="cat myFile.rad",
    fireLogs=False,
    stdouts="""# uniform brightness sky (B=1)
void glow sky_glow
0
0
4 1 1 1 0
sky_glow source sky
0
0
4 0 0 1 180""",
    suppressWarnings=False)  # -> Stdout, Stderr_, Log, Pid, Ran
panel_47 = Panel(execute_ssh_async_9.Stdout)

# ----
# Right click on your component.
# It knows we are calling oconv and
# proposes to view oconv manpage
# Automatic manpages
panel_48 = Panel("""oconv <file> > <file-.>.oct
echo <file-.>.oct""")
radfile_2 = Text(panel_46)
run_4 = Boolean(execute_ssh_async_9.Ran)
overrides_10 = ApplyOverrides(Input_=panel_48, File=graft(radfile_2))  # -> Output, Pairs
execute_ssh_async_10 = ExecuteSSHAsync(
    _SSHCommands_=overrides_10.Output,
    Run=run_4,
    addPrefix=True,
    addSuffix=True,
    description="""oconv myFile.rad > myFile.oct
echo myFile.oct""",
    fireLogs=False,
    stdouts="myFile.oct",
    suppressWarnings=False)  # -> Stdout, Stderr_, Log, Pid, Ran
panel_49 = Panel(execute_ssh_async_10.Stdout)

# ----
# Assemble octree
panel_50 = Panel("""oconv <file> > <file-.>.oct
echo <file-.>.oct""")
radfile_3 = Text(panel_46)
run_5 = Boolean(execute_ssh_async_9.Ran)
overrides_11 = ApplyOverrides(Input_=panel_50, File=graft(radfile_3))  # -> Output, Pairs
execute_ssh_async_11 = ExecuteSSHAsync(
    _SSHCommands_=overrides_11.Output,
    Run=run_5,
    addPrefix=True,
    addSuffix=True,
    description="""oconv myFile.rad > myFile.oct
echo myFile.oct""",
    fireLogs=False,
    stdouts="myFile.oct",
    suppressWarnings=False)  # -> Stdout, Stderr_, Log, Pid, Ran
panel_51 = Panel(execute_ssh_async_11.Stdout)

# ----
# Illuminance on a 0,0,0 point
octree = Text(execute_ssh_async_11.Stdout)
run_6 = Boolean(execute_ssh_async_11.Ran)
overrides_12 = ApplyOverrides(Input_="echo \"0 0 0 0 0 1\" | rtrace -h -I+ -w -ab 1 <octree>", Octree=graft(octree))  # -> Output, Pairs
execute_ssh_async_12 = ExecuteSSHAsync(
    _SSHCommands_=overrides_12.Output,
    Run=run_6,
    addPrefix=True,
    addSuffix=True,
    description="echo \"0 0 0 0 0 1\" | rtrace -h -I+ -w -ab 1 myFile.oct",
    fireLogs=False,
    stdouts="3.141593e+00\t3.141593e+00\t3.141593e+00\t",
    suppressWarnings=False)  # -> Stdout, Stderr_, Log, Pid, Ran
panel_52 = Panel(execute_ssh_async_12.Stdout)

# ----
# converted
# OMG it's close to PI!
# The litterature will tell you why
run_7 = Boolean(execute_ssh_async_12.Ran)
octree_2 = Text(execute_ssh_async_11.Stdout)
panel_53 = Panel("""echo "0 0 0 0 0 1" | rtrace -w -h -I+ -ab 1 <octree> | rcalc -e \
'$1=$1*0.265+$2*0.670+$3*0.065'""")
overrides_13 = ApplyOverrides(Input_=panel_53, Octree=graft(octree_2))  # -> Output, Pairs
execute_ssh_async_13 = ExecuteSSHAsync(
    _SSHCommands_=overrides_13.Output,
    Run=run_7,
    addPrefix=True,
    addSuffix=True,
    description="""echo "0 0 0 0 0 1" | rtrace -w -h -I+ -ab 1 myFile.oct | rcalc -e \
'$1=$1*0.265+$2*0.670+$3*0.065'""",
    fireLogs=False,
    stdouts="3.141593",
    suppressWarnings=False)  # -> Stdout, Stderr_, Log, Pid, Ran
panel_54 = Panel(execute_ssh_async_13.Stdout)

# ----
# 7) Rad viewer
panel_55 = Panel("C:\Users\mm1013\source\repos\MantaRay\Examples\radFiles")
python = GhPythonScript(dir=panel_55)  # -> out
# ---------- python: Python ----------
__author__ = "mm1013"
__version__ = "2022.08.05"

import rhinoscriptsyntax as rs

import glob, os
os.chdir(dir)
for file in glob.glob("*.rad"):
    print(file)
for file in glob.glob("*.mat"):
    print(file)
# ---------- end python ----------
panel_56 = Panel(python)
radviewer = RadViewer(RadFiles=panel_56, IsTwoSided=True, Polychromatic=True, ShowEdges=True, Transparent=True)  # -> Meshes, Names, ModifierNames, Modifiers, FailedWireFrame
