# Grasshopper definition TestRenders.gh (Grasshopper 1.0.7)
# Copyright: 2021
# Copyright: 2022-29-14
# Copyright: 2022-22-28
# plug-ins: MantaRay, LadybugGrasshopper, Human, Telepathy

# ----
# Remote Connect
# Be sure to check the above profile files if your EXPORT PATH=radiance stuff is included
# Also, here i set "cd <proj>" which will
# automatically set the active folder for all of the prompts.
# export PATH=$PATH:/usr/local/radiance/bin:/usr/local/accelerad/bin;export RAYPATH=.:/usr/local/accelerad/lib:/usr/local/radiance/lib;export DISPLAY=$(ip route list default | awk '{print $3}'):0;export LIBGL_ALWAYS_INDIRECT=1;export LD_LIBRARY_PATH=/usr/local/accelerad/bin:$LD_LIBRARY_PATH
panel = Panel(". /etc/profile;. ~/.profile;cd <proj>")
panel_2 = Panel("C:\MantaRayLinux")
connect = ConnectSSHFTP(
    User="lio",
    Ip="mm-c0d0e-028",
    ProjectName="TestFolder",
    Password="_prompt",
    _port="2222",
    Connect=Toggle(True),
    Prefixes=panel)  # -> Status, Prefixes, Run
panel_3 = Panel(connect.Status)

# ----
# Setup globals
panel_4 = Panel("""<LinuxHome>
simulation""")
panel_5 = Panel("""proj
projname""")
global_overrides = GlobalOverrides(Keys=panel_5, Values=panel_4)
panel_6 = Panel(global_overrides)

# ----
# Local Connect
python = GhPythonScript()  # -> username; disabled
# ---------- python: Python ----------
__author__ = "mm1013"
__version__ = "2022.09.25"

import rhinoscriptsyntax as rs

import System

username = System.Environment.UserName

if username == "mm1013":
    username = "mss"
# ---------- end python ----------
toggle = BooleanToggle(True)  # disabled
panel_7 = Panel("127.0.0.1")  # disabled
panel_8 = Panel(python)  # disabled
connect_2 = ConnectSSHFTP(User=panel_8, Ip="127.0.0.1", Password="_prompt", _port=22, Connect=toggle)  # -> Status, Prefixes, Run; disabled
panel_9 = Panel(connect_2.Status)  # disabled

od_outdated = ColourSwatch(SwatchColor=RGBA(97, 97, 97, 150))
u_updated = ColourSwatch(SwatchColor=RGBA(208, 115, 230, 112))
toggle_2 = BooleanToggle(False)
g_general = ColourSwatch(SwatchColor=RGBA(245, 243, 237, 156))
o_outputs = ColourSwatch(SwatchColor=RGBA(160, 218, 242, 203))
s_settings = ColourSwatch(SwatchColor=RGBA(224, 145, 81, 154))
cc_core2 = ColourSwatch(SwatchColor=RGBA(230, 216, 186, 208))
y_yellow = ColourSwatch(SwatchColor=RGBA(247, 244, 64, 188))
i_inputs = ColourSwatch(SwatchColor=RGBA(125, 217, 98, 150))
c_core = ColourSwatch(SwatchColor=RGBA(235, 227, 206, 203))
r_red = ColourSwatch(SwatchColor=RGBA(242, 63, 63, 203))

# ----
# double click to update
parserhinofile = ParseRhinoFile(LayerPrefix="Daylight_Inputs::_", Grids="_Grids")  # -> GlassGeometries, GlassModifiers, port, OpaqueGeometries, OpaqueModifiers, port_2, CustomGeometries, ModifierNames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

# ----
# Test connection
testconnection = TestConnection()  # -> Status, Errors
panel_10 = Panel(testconnection.Status)
panel_11 = Panel(testconnection.Errors)

# ----
# Log of latest(10) SSH Commands
logviewer = LogViewer(Number=10)  # -> CurrentTasks, Logs
panel_12 = Panel(logviewer.CurrentTasks)
panel_13 = Panel(logviewer.Logs)

colorgroups = CSharpScript(
    Colors=[i_inputs, s_settings, g_general, c_core, o_outputs, r_red, y_yellow, u_updated, od_outdated, cc_core2],
    Enable=toggle_2,
    Rename=Toggle(False),
    RunOnce=Button(),
    Debug=Toggle(False))  # -> out; inputs Colors: list of Color, Enable: Boolean, Rename: Boolean, RunOnce: Boolean, Debug: Boolean
# ---------- colorgroups: C# usings ----------
using System.Linq;
using System.Text;
using System.Reflection;
# ---------- colorgroups: C# ----------
    msg.Clear();


    this.Component.Message = "id: " + id.ToString();

    _debug = Debug; //Set to true to have all events printed in rhino log
    _rename = Rename;

    if (Enable)
    {
      msg.AppendFormat("Set up events on ID {0}\n", id);
      SetupDict(); // Create a dictionary of the input swatches
      SetEventHandlers(); // This would do the job.


    }
    else
    {
      RemoveEventHandlers();
    }
    if (RunOnce)
    {
      foreach(Grasshopper.Kernel.Special.GH_Group grp in Grasshopper.Instances.ActiveCanvas.Document.Objects.OfType<Grasshopper.Kernel.Special.GH_Group>())
      {
        ColorGroup(grp, null); // You decide if it should run once on all existing groups

      }
    }

    Print(msg.ToString());


    // Component setup
    Component.Description = "Set up event handlers to color groups based on prefixes such as 'in_' and 'out_'.\n"
      + "Please insert only swatcheds directly into the Colors input\n\n"
      + "MIT License. Copyright Mathias Sønderskov Schaltz 2022";
    Component.Params.Input[0].Description = "Please insert only swatcheds directly into the Colors input.\nRemember to rename them";
    Component.Params.Input[1].Description = "Toggle to run...";
    Component.Params.Input[2].Description = "Set to true if you want to automatically rename the groups and remove prefix. Default is false.";
    Component.Params.Input[3].Description = "Set to true to run it once and color all existing groups.";
    Component.Params.Input[Component.Params.Input.Count - 1].Description = "Set debug to true to get all the events printed in the rhino log";
# ---------- colorgroups: C# additional code ----------
  public static Random rnd = new Random();
  public int id = rnd.Next(0, 1000);
  StringBuilder msg = new StringBuilder();
  Dictionary<string, System.Drawing.Color> colorDict = new Dictionary<string, System.Drawing.Color>();

  bool _debug = false;
  bool _rename = false;

  public bool IdExists(int id)
  {
    IList<IGH_DocumentObject> objs = Grasshopper.Instances.ActiveCanvas.Document.Objects;
    return objs
      .OfType<IGH_Component>()
      .Where(ob => ob.NickName == this.Component.NickName)
      .Where(ob => ob.GetType().ToString() == "ScriptComponents.Component_CSNET_Script")
      .Where(ob => ob.Message == "id: " + id.ToString()).Any();

  }


  public void SetupDict()
  {
    colorDict.Clear();
    // Get all inputs to "Colors"
    IList<IGH_Param> colorSources = this.Component.Params.Input[0].Sources;
    if (colorSources.Count == 0)
    {
      throw new Exception("You forgot to setup the colors. Please input swatch components and rename them");
    }
    foreach(IGH_Param source in colorSources)
    {
      //if (source.Type.ToString() == "Grasshopper.Kernel.Types.GH_Colour")
      if (source is Grasshopper.Kernel.Special.GH_ColourSwatch)
      {
        string nickName = source.NickName.Split('_')[0].Trim() + "_";
        if(!colorDict.ContainsKey(nickName))
        {
          Grasshopper.Kernel.Special.GH_ColourSwatch swatch = (Grasshopper.Kernel.Special.GH_ColourSwatch) source;
          colorDict.Add(nickName, swatch.SwatchColour);
        }
        else
        {
          throw new Exception("Multiple swatches using the same name detected. Please rename");
        }
      }
      else
      {
        throw new Exception("Whacko! Why did you input a non-swatch into the Colors? " + source.Type.ToString());
      }

    }

    msg.AppendFormat("Set up the dictionaries with {0} colors\n", colorDict.Count);
    foreach(var pairs in colorDict)
    {
      msg.AppendFormat("{0} -> {1}\n", ("\"" + pairs.Key + "\"").PadRight(5 + colorDict.Keys.Select(k => k.Length).Max()), pairs.Value);
    }
  }

  public void SetEventHandlers()
  {

    // Always remove events first to avoid duplicates
    GrasshopperDocument.ObjectsAdded -= OnObjectsAdded;
    GrasshopperDocument.ObjectsDeleted -= OnObjectsRemoved;
    GrasshopperDocument.ObjectsDeleted -= OnDeleteThisComponent;

    // Attach events
    GrasshopperDocument.ObjectsAdded += OnObjectsAdded;
    GrasshopperDocument.ObjectsDeleted += OnObjectsRemoved;
    GrasshopperDocument.ObjectsDeleted += OnDeleteThisComponent;


    foreach(Grasshopper.Kernel.Special.GH_Group grp in GrasshopperDocument.Objects.OfType<Grasshopper.Kernel.Special.GH_Group>())
    {
      grp.ObjectChanged -= ColorGroup;
      grp.ObjectChanged += ColorGroup;

      //ColorGroup(grp, null); // Make sure to run it once
    }
    msg.AppendFormat("Added the eventhandlers on {0} existing groups and on future created groups\n", GrasshopperDocument.Objects.OfType<Grasshopper.Kernel.Special.GH_Group>().Count());
  }

  public void OnObjectsAdded(object sender, GH_DocObjectEventArgs e)
  {
    bool any = false;
    foreach (Grasshopper.Kernel.Special.GH_Group grp in e.Objects.OfType<Grasshopper.Kernel.Special.GH_Group>())
    {
      grp.ObjectChanged -= ColorGroup;
      grp.ObjectChanged += ColorGroup;
      any = true;
    }

    DebugWrite(any ? "Group Objects Added: Attaching Events to ObjectChanged" : "Objects Added - but no groups");
  }

  //Same but reversed
  public void OnObjectsRemoved(object sender, GH_DocObjectEventArgs e)
  {
    bool any = false;
    foreach (Grasshopper.Kernel.Special.GH_Group grp in e.Objects.OfType<Grasshopper.Kernel.Special.GH_Group>())
    {
      grp.ObjectChanged -= ColorGroup;
      any = true;
    }

    DebugWrite(any ? "Group Objects Removed, removing event" : "Objects Removed - although not a group");

  }



  public void RemoveEventHandlers()
  {
    GrasshopperDocument.ObjectsAdded -= OnObjectsAdded;
    GrasshopperDocument.ObjectsDeleted -= OnObjectsRemoved;


    foreach(Grasshopper.Kernel.Special.GH_Group grp in GrasshopperDocument.Objects.OfType<Grasshopper.Kernel.Special.GH_Group>())
    {
      grp.ObjectChanged -= ColorGroup;

    }
    msg.AppendFormat("Removed event handlers on document and on {0} groups\n", GrasshopperDocument.Objects.OfType<Grasshopper.Kernel.Special.GH_Group>().Count());

  }

  public void ColorGroup(object sender, EventArgs e)
  {
    if (!IdExists(id))
    {
      DebugWrite("Component not relevant. Disabling old id + " + id.ToString());
      RemoveEventHandlers();
      return;
    }

    Grasshopper.Kernel.Special.GH_Group grp = sender as Grasshopper.Kernel.Special.GH_Group;
    if (grp == null) return; //not type GH_Group
    //if (!grp.NickName.EndsWith("_")) return;

    string[] nameParts = grp.NickName.Split('_');
    if (nameParts.Length <= 1)
      return;
    string prefix = grp.NickName.Split('_')[0].Trim() + '_';

    string prefixes = String.Join(", ", colorDict.Keys.Select(k => "\"" + k + "\""));

    msg.Append("prefix " + prefix + "\n");
    if (colorDict.ContainsKey(prefix))
    {
      //if (grp.NickName.EndsWith("_"))
      grp.Colour = colorDict[prefix];
      if (_rename)
      {
        grp.NickName = grp.NickName.Replace(prefix, "");
      }

      DebugWrite("Colored " + grp.NickName);

    }
    else
    {
      DebugWrite("Group changed but not relevant: prefix " + prefix + " is not among " + prefixes);
    }

  }
  public void DebugWrite(string msg)
  {
    if (_debug)
    {
      Rhino.RhinoApp.WriteLine(String.Format("[ColGrps {0}]: {1}", id, msg));
    }
  }

  public void OnDeleteThisComponent(object sender, GH_DocObjectEventArgs e)
  {

    if (e.Objects.OfType<Grasshopper.Kernel.GH_Component>().Where(o => o.NickName == this.Component.NickName).Any())
    {
      DebugWrite("Removed template component. Removing all the eventhandlers");
      RemoveEventHandlers();
    }

  }
# ---------- end colorgroups ----------

fixparams = CSharpScript(FixOnce=Button(), Enable=toggle_2, Debug=Toggle(False))  # -> out; inputs FixOnce: Boolean, Enable: Boolean, Debug: Boolean
# ---------- fixparams: C# usings ----------
using System.Text;
using System.Linq;
using Grasshopper.Kernel.Special;
# ---------- fixparams: C# ----------
    _debug = Debug;
    _enable = Enable;
    msg.Clear();
    this.Component.Message = "id: " + id.ToString();




    if (Enable)
    {
      SetEventHandlers();
    }
    else
    {
      RemoveEventHandlers();
    }


    if (FixOnce)
    {
      FixAll();
    }

    Print(msg.ToString());

    // Component setup
    Component.Description = "Set up event handlers to change params to show nickname and not icon"
      + "\n\n"
      + "MIT License. Copyright Mathias Sønderskov Schaltz 2022";
    Component.Params.Input[0].Description = "Run me once on the document";
    Component.Params.Input[1].Description = "Toggle to enable event listener";
    Component.Params.Input[Component.Params.Input.Count - 1].Description = "Set debug to true to get all the events printed in the rhino log";
# ---------- fixparams: C# additional code ----------
  public static Random rnd = new Random();
  public int id = rnd.Next(0, 1000);
  StringBuilder msg = new StringBuilder();
  bool _debug = false;
  bool _enable = false;

  public Dictionary<IGH_ActiveObject, HashSet<GH_Group>> groupsPerObject = new Dictionary<IGH_ActiveObject, HashSet<GH_Group>>();


  public void OnObjectsAdded(object sender, GH_DocObjectEventArgs e)
  {
    if (!IdExists(id))
    {
      DebugWrite("[FixParam] Component not relevant. Disabling old id " + id.ToString());
      RemoveEventHandlers();
      return;
    }


    if(_enable)
    {
      foreach(IGH_Param par in e.Objects.OfType<IGH_Param>())
      {
        FixInputs(par);
      }
    }


  }

  public void FixAll()
  {
    //DebugWrite("Fixing all?");
    foreach(IGH_Param par in GrasshopperDocument.Objects.OfType<IGH_Param>())
    {

      FixInputs(par);
    }
  }




  public void FixInputs(IGH_ActiveObject obj)
  {



    IGH_Param par = obj as IGH_Param;
    if (par != null)
    {

      par.IconDisplayMode = GH_IconDisplayMode.name;


    }

  }


  public void SetEventHandlers()
  {

    GrasshopperDocument.ObjectsAdded -= OnObjectsAdded;
    GrasshopperDocument.ObjectsAdded += OnObjectsAdded;
    GrasshopperDocument.ObjectsDeleted -= OnDeleteThisComponent;
    GrasshopperDocument.ObjectsDeleted += OnDeleteThisComponent;
    msg.AppendFormat("Added the eventhandlers to OnObjectsAdded\n", GrasshopperDocument.Objects.OfType<Grasshopper.Kernel.Special.GH_Group>().Count());
  }

  public void RemoveEventHandlers()
  {
    GrasshopperDocument.ObjectsAdded -= OnObjectsAdded;
    GrasshopperDocument.ObjectsDeleted -= OnDeleteThisComponent;

    msg.AppendFormat("Removed wire event handlers on document\n", GrasshopperDocument.Objects.OfType<Grasshopper.Kernel.Special.GH_Group>().Count());

  }

  public void OnDeleteThisComponent(object sender, GH_DocObjectEventArgs e)
  {

    if (e.Objects.OfType<Grasshopper.Kernel.GH_Component>().Where(o => o.NickName == this.Component.NickName).Any())
    {
      DebugWrite("Removed template component. Removing all the eventhandlers");
      RemoveEventHandlers();
    }

  }

  public bool IdExists(int id)
  {
    IList<IGH_DocumentObject> objs = Grasshopper.Instances.ActiveCanvas.Document.Objects;
    return objs
      .OfType<IGH_Component>()
      .Where(ob => ob.NickName == this.Component.NickName)
      .Where(ob => ob.GetType().ToString() == "ScriptComponents.Component_CSNET_Script")
      .Where(ob => ob.Message == "id: " + id.ToString()).Any();

  }

  public void DebugWrite(string msg)
  {
    if (_debug)
    {
      Rhino.RhinoApp.WriteLine(String.Format("[FixParams {0}]: {1}", id, msg));
    }
  }
# ---------- end fixparams ----------

fixwires = CSharpScript(FixOnce=Button(), Enable=toggle_2, Debug=Toggle(False))  # -> out; inputs FixOnce: Boolean, Enable: Boolean, Debug: Boolean
# ---------- fixwires: C# ----------
    _debug = Debug;
    _enable = Enable;
    msg.Clear();
    this.Component.Message = "id: " + id.ToString();


    SetDictionary();

    if (Enable)
    {
      SetEventHandlers();
    }
    else
    {
      RemoveEventHandlers();
    }


    if (FixOnce)
    {
      FixAll();
    }

    Print(msg.ToString());
    
    // Component setup
    Component.Description = "Set up event handlers to change all wire types across groups to faint"
      + "\n\n"
      + "MIT License. Copyright Mathias Sønderskov Schaltz 2022";
    Component.Params.Input[0].Description = "Run me once on the document";
    Component.Params.Input[1].Description = "Toggle to enable event listener";
    Component.Params.Input[Component.Params.Input.Count - 1].Description = "Set debug to true to get all the events printed in the rhino log";
# ---------- fixwires: C# additional code ----------
  public static Random rnd = new Random();
  public int id = rnd.Next(0, 1000);
  StringBuilder msg = new StringBuilder();
  bool _debug = false;
  bool _enable = false;

  public Dictionary<IGH_ActiveObject, HashSet<GH_Group>> groupsPerObject = new Dictionary<IGH_ActiveObject, HashSet<GH_Group>>();


  public void OnSolutionExpired(object sender, GH_DocUndoEventArgs e)
  {
    if(_enable)
      FixAll();
  }

  public void FixAll()
  {
    //DebugWrite("Fixing all?");
    foreach(IGH_ActiveObject key in groupsPerObject.Keys.Where(k => groupsPerObject[k].Count() > 0))
    {

      FixInputs(key);
    }
  }



  public bool HasGroup(IGH_ActiveObject obj)
  {
    return groupsPerObject[obj].Count > 0;
  }


  public void FixInputs(IGH_ActiveObject obj)
  {

    if (!IdExists(id))
    {
      DebugWrite("Component not relevant. Disabling old id " + id.ToString());
      RemoveEventHandlers();
      return;
    }

    //List<List<IGH_ActiveObject>> parents = new List<List<IGH_ActiveObject>>();
    IGH_Param par = obj as IGH_Param;
    if (par != null && par.Sources != null)
    {


      IEnumerable<IGH_ActiveObject> p = par.Sources.Select(s => s.Attributes.GetTopLevel.DocObject as IGH_ActiveObject);
      //parents.Add(p);
      if(HasGroup(obj) && p.All(o => !HasGroupsInCommon(o, obj)) && par.WireDisplay != GH_ParamWireDisplay.faint)
      {
        DebugWrite("Fixing " + par.Attributes.GetTopLevel.DocObject.NickName);
        par.WireDisplay = GH_ParamWireDisplay.faint;
      }

    }

    IGH_Component comp = obj as IGH_Component;
    if (comp != null)
    {
      foreach(IGH_Param inp in comp.Params.Input)
      {

        IEnumerable<IGH_ActiveObject> p = inp.Sources.Select(i => i.Attributes.GetTopLevel.DocObject as IGH_ActiveObject);

        if(HasGroup(obj) && p.All(o => !HasGroupsInCommon(o, obj)) && inp.WireDisplay != GH_ParamWireDisplay.faint)
        {
          DebugWrite("Fixing " + inp.Attributes.GetTopLevel.DocObject.NickName);
          inp.WireDisplay = GH_ParamWireDisplay.faint;
        }
      }

    }



  }





  public void SetDictionary()
  {
    IList<IGH_DocumentObject> objects = Grasshopper.Instances.ActiveCanvas.Document.Objects.ToList();
    //Print(String.Join(", ", objects.Select(o => o.NickName)));

    groupsPerObject = objects
      .Where(o => o.GetType() != typeof(GH_Group))
      .OfType<IGH_ActiveObject>()
      .ToDictionary(o => o, o => new HashSet<GH_Group>());

    foreach(GH_Group grp in objects.OfType<GH_Group>())
    {

      foreach(IGH_ActiveObject obj in grp.ObjectsRecursive().OfType<IGH_ActiveObject>())
      {
        groupsPerObject[obj].Add(grp);

      }
    }



  }

  public bool HasGroupsInCommon(IGH_ActiveObject obj1, IGH_ActiveObject obj2)
  {
    HashSet<GH_Group> set1 = groupsPerObject[obj1];
    HashSet<GH_Group> set2 = groupsPerObject[obj2];

    set1.IntersectWith(set2);

    return set1.Any();
  }

  public void SetEventHandlers()
  {

    GrasshopperDocument.UndoStateChanged -= OnSolutionExpired;
    GrasshopperDocument.UndoStateChanged += OnSolutionExpired;
    GrasshopperDocument.ObjectsDeleted -= OnDeleteThisComponent;
    GrasshopperDocument.ObjectsDeleted += OnDeleteThisComponent;
    msg.AppendFormat("Added the eventhandlers to UndoStateChanged\n", GrasshopperDocument.Objects.OfType<Grasshopper.Kernel.Special.GH_Group>().Count());
  }

  public void RemoveEventHandlers()
  {
    GrasshopperDocument.UndoStateChanged -= OnSolutionExpired;
    GrasshopperDocument.ObjectsDeleted -= OnDeleteThisComponent;

    msg.AppendFormat("Removed wire event handlers on document\n", GrasshopperDocument.Objects.OfType<Grasshopper.Kernel.Special.GH_Group>().Count());

  }

  public void OnDeleteThisComponent(object sender, GH_DocObjectEventArgs e)
  {

    if (e.Objects.OfType<Grasshopper.Kernel.GH_Component>().Where(o => o.NickName == this.Component.NickName).Any())
    {
      DebugWrite("Removed template component. Removing all the eventhandlers");
      RemoveEventHandlers();
    }

  }

  public bool IdExists(int id)
  {
    IList<IGH_DocumentObject> objs = Grasshopper.Instances.ActiveCanvas.Document.Objects;
    return objs
      .OfType<IGH_Component>()
      .Where(ob => ob.NickName == this.Component.NickName)
      .Where(ob => ob.GetType().ToString() == "ScriptComponents.Component_CSNET_Script")
      .Where(ob => ob.Message == "id: " + id.ToString()).Any();

  }

  public void DebugWrite(string msg)
  {
    if (_debug)
    {
      Rhino.RhinoApp.WriteLine(String.Format("[FixWire {0}]: {1}", id, msg));
    }
  }
# ---------- end fixwires ----------

# ----
# processes to kill
panel_14 = Panel("""dctimestep
rcontrib
rtrace
oconv
rvu
rmtxop""")
kill = LBFalseStartToggle(False)

# ----
# Kill processes running on linux
panel_15 = Panel("pkill -f <instance>")
overrides = ApplyOverrides(Input=panel_15, Instance=graft(panel_14))  # -> Output, DynamicOutput
join = TextJoin(Text=flatten(overrides.Output), Join=";")
executessh = ExecuteSSH(_SSHCommands_=join, Run=kill, addPrefix=True, fireLogs=False, lastRunTime=0, suppressWarnings=False)  # -> Stdout, Stderr_, Ran
panel_16 = Panel(executessh.Stderr_)

# ----
# Keep biggest srf
# Colored skies! Why not?
# from https://discourse.radiance-online.org/t/new-tool-for-generating-colored-sky/5891
largest_brep = LargestBREP(window_breps=[<geometry referenced from the Rhino model> x224])

# ----
# Read rhino file and prepare simple geometry
falsestart = LBFalseStartToggle(True)
panel_17 = Panel(parserhinofile.SkippedLayers)

# ----
# Create working folder
panel_18 = Panel("""mkdir -p <proj>
mkdir -p <proj>/radFiles
mkdir -p <proj>/objFiles""")
overrides_2 = ApplyOverrides(Input=panel_18)  # -> Output, DynamicOutput
executessh_2 = ExecuteSSH(
    _SSHCommands_=overrides_2.DynamicOutput,
    Run=falsestart,
    addPrefix=True,
    description="""mkdir -p ~/MantaRay/TestFolder
mkdir -p ~/MantaRay/TestFolder/radFiles
mkdir -p ~/MantaRay/TestFolder/objFiles""",
    fireLogs=False,
    lastRunTime=88.2059,
    name="Create working dir",
    suppressWarnings=False,
    commands="""mkdir -p ~/MantaRay/TestFolder
mkdir -p ~/MantaRay/TestFolder/radFiles
mkdir -p ~/MantaRay/TestFolder/objFiles""")  # -> Stdout, Stderr_, Ran

# ----
# Template methods
# By Mathias Sønderskov Schaltz 2022
# Check for updates here https://github.com/Sonderwoods/GrasshopperScribbles
panel_19 = Panel(colorgroups)
panel_20 = Panel(fixwires)
panel_21 = Panel(fixparams)

bool = Boolean(executessh_2.Ran)
cluster = Cluster(mod=parserhinofile.GlassModifiers)  # -> name_geo, name_mod
geo = Geometry(parserhinofile.GlassGeometries)
overrides_3 = ApplyOverrides(Input="<proj>\objFiles")
mesh2obj = MeshToObj(
    Mesh=graft(geo),
    Name=graft(cluster.name_geo),
    MapFileName="mapping_glass",
    ModifierName=graft(cluster.name_mod),
    TargetFolder=overrides_3,
    Run=bool)  # -> ObjFiles, MapFile, Run
entwine = Entwine(Branch00=mesh2obj.ObjFiles, Branch01=mesh2obj.MapFile, FlattenInputs=True)
upload = Upload(
    LocalFilePaths=flatten(entwine),
    TargetFolder=overrides_3,
    Run=mesh2obj.Run,
    stdouts="/home/lio/MantaRay/TestFolderobjFiles/Glass_70_geo.obj>JOIN</home/lio/MantaRay/TestFolderobjFiles/mapping_glass.map")  # -> Status, FilePaths, Ran
panel_22 = Panel("""obj2rad -m <mapfile> -f <objFile> > <LinuxHome>/radFiles/<name>.rad
echo <LinuxHome>/radFiles/<name>.rad""")
python_2 = GhPythonScript(f=upload.FilePaths)  # -> m, o; inputs f: list
# ---------- python_2: Python ----------
__author__ = "mm1013"
__version__ = "2023.03.11"

import rhinoscriptsyntax as rs

try:
    m = f[-1]
    o = f[:-1]
except:
    pass
# ---------- end python_2 ----------
overrides_4 = ApplyOverrides(Input=panel_22, Mapfile=graft(python_2.m), ObjFile=graft(python_2.o), Name=graft(cluster.name_geo))  # -> Output, flatten(DynamicOutput)
executessh_3 = ExecuteSSH(
    _SSHCommands_=graft(overrides_4.DynamicOutput),
    Run=upload.Ran,
    addPrefix=True,
    description="""obj2rad -m /home/lio/MantaRay/TestFolderobjFiles/mapping_glass.map -f /home/lio/MantaRay/TestFolderobjFiles/Glass_70_geo.obj > ~/MantaRay/TestFolder/radFiles/Glass_70_geo.rad
echo ~/MantaRay/TestFolder/radFiles/Glass_70_geo.rad""",
    fireLogs=True,
    lastRunTime=140.5134,
    name="obj2map - glass",
    suppressWarnings=False,
    results="/home/lio/MantaRay/TestFolder/radFiles/Glass_70_geo.rad",
    commands="""obj2rad -m /home/lio/MantaRay/TestFolderobjFiles/mapping_glass.map -f /home/lio/MantaRay/TestFolderobjFiles/Glass_70_geo.obj > ~/MantaRay/TestFolder/radFiles/Glass_70_geo.rad
echo ~/MantaRay/TestFolder/radFiles/Glass_70_geo.rad""")  # -> flatten(Stdout), Stderr_, Ran
window_rad = Text(executessh_3.Stdout)

bool_2 = Boolean(executessh_2.Ran)
cluster_2 = Cluster(mod=parserhinofile.OpaqueModifiers)  # -> name_geo, name_mod
geo_2 = Geometry(parserhinofile.OpaqueGeometries)
overrides_5 = ApplyOverrides(Input="<proj>\objFiles")
mesh2obj_2 = MeshToObj(
    Mesh=graft(geo_2),
    Name=graft(cluster_2.name_geo),
    MapFileName="mapping_opaque",
    ModifierName=graft(cluster_2.name_mod),
    TargetFolder=overrides_5,
    Run=bool_2)  # -> ObjFiles, MapFile, Run
entwine_2 = Entwine(Branch00=mesh2obj_2.ObjFiles, Branch01=mesh2obj_2.MapFile, FlattenInputs=True)
upload_2 = Upload(
    LocalFilePaths=flatten(entwine_2),
    TargetFolder=overrides_5,
    Run=mesh2obj_2.Run,
    stdouts="/home/lio/MantaRay/TestFolderobjFiles/FloorMat_70_geo.obj>JOIN</home/lio/MantaRay/TestFolderobjFiles/Cladding_50_geo.obj>JOIN</home/lio/MantaRay/TestFolderobjFiles/ConcreteWhite_80_geo.obj>JOIN</home/lio/MantaRay/TestFolderobjFiles/ConcreteStructure_30_geo.obj>JOIN</home/lio/MantaRay/TestFolderobjFiles/ConcreteGrey_50_geo.obj>JOIN</home/lio/MantaRay/TestFolderobjFiles/IntWalls_90_geo.obj>JOIN</home/lio/MantaRay/TestFolderobjFiles/Pipes_3_geo.obj>JOIN</home/lio/MantaRay/TestFolderobjFiles/ConcreteDarker_10_geo.obj>JOIN</home/lio/MantaRay/TestFolderobjFiles/Frames_60_geo.obj>JOIN</home/lio/MantaRay/TestFolderobjFiles/Black_1_geo.obj>JOIN</home/lio/MantaRay/TestFolderobjFiles/CurvedCeiling_80_geo.obj>JOIN</home/lio/MantaRay/TestFolderobjFiles/IntWalls_80_geo.obj>JOIN</home/lio/MantaRay/TestFolderobjFiles/FloorBox_75_geo.obj>JOIN</home/lio/MantaRay/TestFolderobjFiles/mapping_opaque.map")  # -> Status, FilePaths, Ran
panel_23 = Panel("""obj2rad -m <mapfile> -f <objFile> > <LinuxHome>/radFiles/<name>.rad
echo <LinuxHome>/radFiles/<name>.rad""")
python_3 = GhPythonScript(f=upload_2.FilePaths)  # -> m, o; inputs f: list; same code as python_2
overrides_6 = ApplyOverrides(Input=panel_23, Mapfile=graft(python_3.m), ObjFile=graft(python_3.o), Name=graft(cluster_2.name_geo))  # -> Output, flatten(DynamicOutput)
executessh_4 = ExecuteSSH(
    _SSHCommands_=graft(overrides_6.DynamicOutput),
    Run=upload_2.Ran,
    addPrefix=True,
    description="""obj2rad -m /home/lio/MantaRay/TestFolderobjFiles/mapping_opaque.map -f /home/lio/MantaRay/TestFolderobjFiles/FloorMat_70_geo.obj > ~/MantaRay/TestFolder/radFiles/FloorMat_70_geo.rad
echo ~/MantaRay/TestFolder/radFiles/FloorMat_70_geo.rad


- - -

obj2rad -m /home/lio/MantaRay/TestFolderobjFiles/mapping_opaque.map -f /home/lio/MantaRay/TestFolderobjFiles/Cladding_50_geo.obj > ~/MantaRay/TestFolder/radFiles/Cladding_50_geo.rad
echo ~/MantaRay/TestFolder/radFiles/Cladding_50_geo.rad


- - -

obj2rad -m /home/lio/MantaRay/TestFolderobjFiles/mapping_opaque.map -f /home/lio/MantaRay/TestFolderobjFiles/ConcreteWhite_80_geo.obj > ~/MantaRay/TestFolder/radFiles/ConcreteWhite_80_geo.rad
echo ~/MantaRay/TestFolder/radFiles/ConcreteWhite_80_geo.rad


- - -

obj2rad -m /home/lio/MantaRay/TestFolderobjFiles/mapping_opaque.map -f /home/lio/MantaRay/TestFolderobjFiles/ConcreteStructure_30_geo.obj > ~/MantaRay/TestFolder/radFiles/ConcreteStructure_30_geo.rad
echo ~/MantaRay/TestFolder/radFiles/ConcreteStructure_30_geo.rad


- - -

obj2rad -m /home/lio/MantaRay/TestFolderobjFiles/mapping_opaque.map -f /home/lio/MantaRay/TestFolderobjFiles/ConcreteGrey_50_geo.obj > ~/MantaRay/TestFolder/radFiles/ConcreteGrey_50_geo.rad
echo ~/MantaRay/TestFolder/radFiles/ConcreteGrey_50_geo.rad


- - -

obj2rad -m /home/lio/MantaRay/TestFolderobjFiles/mapping_opaque.map -f /home/lio/MantaRay/TestFolderobjFiles/IntWalls_90_geo.obj > ~/MantaRay/TestFolder/radFiles/IntWalls_90_geo.rad
echo ~/MantaRay/TestFolder/radFiles/IntWalls_90_geo.rad


- - -

obj2rad -m /home/lio/MantaRay/TestFolderobjFiles/mapping_opaque.map -f /home/lio/MantaRay/TestFolderobjFiles/Pipes_3_geo.obj > ~/MantaRay/TestFolder/radFiles/Pipes_3_geo.rad
echo ~/MantaRay/TestFolder/radFiles/Pipes_3_geo.rad


- - -

obj2rad -m /home/lio/MantaRay/TestFolderobjFiles/mapping_opaque.map -f /home/lio/MantaRay/TestFolderobjFiles/ConcreteDarker_10_geo.obj > ~/MantaRay/TestFolder/radFiles/ConcreteDarker_10_geo.rad
echo ~/MantaRay/TestFolder/radFiles/ConcreteDarker_10_geo.rad


- - -

obj2rad -m /home/lio/MantaRay/TestFolderobjFiles/mapping_opaque.map -f /home/lio/MantaRay/TestFolderobjFiles/Frames_60_geo.obj > ~/MantaRay/TestFolder/radFiles/Frames_60_geo.rad
echo ~/MantaRay/TestFolder/radFiles/Frames_60_geo.rad


- - -

obj2rad -m /home/lio/MantaRay/TestFolderobjFiles/mapping_opaque.map -f /home/lio/MantaRay/TestFolderobjFiles/Black_1_geo.obj > ~/MantaRay/TestFolder/radFiles/Black_1_geo.rad
echo ~/MantaRay/TestFolder/radFiles/Black_1_geo.rad


- - -

obj2rad -m /home/lio/MantaRay/TestFolderobjFiles/mapping_opaque.map -f /home/lio/MantaRay/TestFolderobjFiles/CurvedCeiling_80_geo.obj > ~/MantaRay/TestFolder/radFiles/CurvedCeiling_80_geo.rad
echo ~/MantaRay/TestFolder/radFiles/CurvedCeiling_80_geo.rad


- - -

obj2rad -m /home/lio/MantaRay/TestFolderobjFiles/mapping_opaque.map -f /home/lio/MantaRay/TestFolderobjFiles/IntWalls_80_geo.obj > ~/MantaRay/TestFolder/radFiles/IntWalls_80_geo.rad
echo ~/MantaRay/TestFolder/radFiles/IntWalls_80_geo.rad


- - -

obj2rad -m /home/lio/MantaRay/TestFolderobjFiles/mapping_opaque.map -f /home/lio/MantaRay/TestFolderobjFiles/FloorBox_75_geo.obj > ~/MantaRay/TestFolder/radFiles/FloorBox_75_geo.rad
echo ~/MantaRay/TestFolder/radFiles/FloorBox_75_geo.rad""",
    fireLogs=True,
    lastRunTime=240.5634,
    name="obj2map - opaque",
    suppressWarnings=False,
    results=["/home/lio/MantaRay/TestFolder/radFiles/FloorMat_70_geo.rad", "/home/lio/MantaRay/TestFolder/radFiles/Cladding_50_geo.rad", "/home/lio/MantaRay/TestFolder/radFiles/ConcreteWhite_80_geo.rad", "/home/lio/MantaRay/TestFolder/radFiles/ConcreteStructure_30_geo.rad", "/home/lio/MantaRay/TestFolder/radFiles/ConcreteGrey_50_geo.rad", "/home/lio/MantaRay/TestFolder/radFiles/IntWalls_90_geo.rad", "/home/lio/MantaRay/TestFolder/radFiles/Pipes_3_geo.rad", "/home/lio/MantaRay/TestFolder/radFiles/ConcreteDarker_10_geo.rad", "/home/lio/MantaRay/TestFolder/radFiles/Frames_60_geo.rad", "/home/lio/MantaRay/TestFolder/radFiles/Black_1_geo.rad", "/home/lio/MantaRay/TestFolder/radFiles/CurvedCeiling_80_geo.rad", "/home/lio/MantaRay/TestFolder/radFiles/IntWalls_80_geo.rad", "/home/lio/MantaRay/TestFolder/radFiles/FloorBox_75_geo.rad"],
    commands=["""obj2rad -m /home/lio/MantaRay/TestFolderobjFiles/mapping_opaque.map -f /home/lio/MantaRay/TestFolderobjFiles/FloorMat_70_geo.obj > ~/MantaRay/TestFolder/radFiles/FloorMat_70_geo.rad
echo ~/MantaRay/TestFolder/radFiles/FloorMat_70_geo.rad""", """obj2rad -m /home/lio/MantaRay/TestFolderobjFiles/mapping_opaque.map -f /home/lio/MantaRay/TestFolderobjFiles/Cladding_50_geo.obj > ~/MantaRay/TestFolder/radFiles/Cladding_50_geo.rad
echo ~/MantaRay/TestFolder/radFiles/Cladding_50_geo.rad""", """obj2rad -m /home/lio/MantaRay/TestFolderobjFiles/mapping_opaque.map -f /home/lio/MantaRay/TestFolderobjFiles/ConcreteStructure_30_geo.obj > ~/MantaRay/TestFolder/radFiles/ConcreteStructure_30_geo.rad
echo ~/MantaRay/TestFolder/radFiles/ConcreteStructure_30_geo.rad""", """obj2rad -m /home/lio/MantaRay/TestFolderobjFiles/mapping_opaque.map -f /home/lio/MantaRay/TestFolderobjFiles/ConcreteWhite_80_geo.obj > ~/MantaRay/TestFolder/radFiles/ConcreteWhite_80_geo.rad
echo ~/MantaRay/TestFolder/radFiles/ConcreteWhite_80_geo.rad""", """obj2rad -m /home/lio/MantaRay/TestFolderobjFiles/mapping_opaque.map -f /home/lio/MantaRay/TestFolderobjFiles/ConcreteGrey_50_geo.obj > ~/MantaRay/TestFolder/radFiles/ConcreteGrey_50_geo.rad
echo ~/MantaRay/TestFolder/radFiles/ConcreteGrey_50_geo.rad""", """obj2rad -m /home/lio/MantaRay/TestFolderobjFiles/mapping_opaque.map -f /home/lio/MantaRay/TestFolderobjFiles/IntWalls_90_geo.obj > ~/MantaRay/TestFolder/radFiles/IntWalls_90_geo.rad
echo ~/MantaRay/TestFolder/radFiles/IntWalls_90_geo.rad"""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])  # -> flatten(Stdout), Stderr_, Ran
opaque_rad = Text(executessh_4.Stdout)

bool_3 = Boolean(executessh_2.Ran)
geo_3 = Geometry(parserhinofile.CustomGeometries)
cluster_3 = Cluster_3(L=geo_3)
n = N(mod=parserhinofile.ModifierNames)  # -> name_geo, name_mod
and = GateAnd(A=bool_3, B=cluster_3)
overrides_7 = ApplyOverrides(Input="<proj>\objFiles")
mesh2obj_3 = MeshToObj(
    Mesh=graft(geo_3),
    Name=graft(n.name_geo),
    MapFileName="mapping_other",
    ModifierName=graft(n.name_mod),
    TargetFolder=overrides_7,
    Run=and)  # -> ObjFiles, MapFile, Run
entwine_3 = Entwine(Branch00=mesh2obj_3.ObjFiles, Branch01=mesh2obj_3.MapFile, FlattenInputs=True)
upload_3 = Upload(LocalFilePaths=flatten(entwine_3), TargetFolder=overrides_7, Run=mesh2obj_3.Run)  # -> Status, FilePaths, Ran
panel_24 = Panel("""obj2rad -m <mapfile> -f <objFile> > <LinuxHome>/radFiles/<name>.rad
echo <LinuxHome>/radFiles/<name>.rad""")
python_4 = GhPythonScript(f=upload_3.FilePaths)  # -> m, o; inputs f: list; same code as python_2
cull = CullPattern(List=panel_24, CullPattern=and)
overrides_8 = ApplyOverrides(Input=cull, Mapfile=graft(python_4.m), ObjFile=graft(python_4.o), Name=graft(n.name_geo))  # -> Output, flatten(DynamicOutput)
executessh_5 = ExecuteSSH(
    _SSHCommands_=graft(overrides_8.DynamicOutput),
    Run=upload_3.Ran,
    addPrefix=True,
    fireLogs=True,
    lastRunTime=186,
    name="obj2map - other",
    suppressWarnings=False,
    stderr="""bash: -c: line 0: syntax error near unexpected token `>'
bash: -c: line 0: `. /etc/profile;. ~/.profile;obj2rad -m <mapfile> -f <objFile> > ~/MantaRay/Andrei/radFiles/<name>.rad'""",
    commands="""obj2rad -m <mapfile> -f <objFile> > ~/MantaRay/Andrei/radFiles/<name>.rad
echo ~/MantaRay/Andrei/radFiles/<name>.rad""")  # -> flatten(Stdout), Stderr_, Ran
cull_2 = CullPattern(List=executessh_5.Stdout, CullPattern=and)
other_rad = Text(cull_2)

# ----
# Other users, linux
panel_25 = Panel("w")
falsestart_2 = LBFalseStartToggle(False)
falsestart_3 = LBFalseStartToggle(False)
executessh_6 = ExecuteSSH(
    _SSHCommands_="last -10 --ip",
    Run=falsestart_3,
    addPrefix=True,
    fireLogs=False,
    lastRunTime=20,
    name="Last Users",
    suppressWarnings=False,
    results="""lio      pts/1        172.19.128.1     Mon Mar 13 08:12 - 14:42  (06:29)
lio      pts/1        172.19.128.1     Sun Mar 12 21:37 - 21:45  (00:07)
lio      pts/0        172.19.128.1     Mon Mar  6 14:14   still logged in
lio      pts/0        172.19.128.1     Fri Mar  3 14:04 - 14:14  (00:09)
lio      pts/0        172.19.128.1     Fri Mar  3 09:07 - 11:42  (02:35)
reboot   system boot  0.0.0.0          Fri Mar  3 08:55   still running
lio      pts/0        192.168.112.1    Thu Mar  2 15:13 - 15:13  (00:00)
reboot   system boot  0.0.0.0          Thu Mar  2 15:11   still running
lio      pts/0        172.19.64.1      Thu Mar  2 15:04 - 15:09  (00:05)
lio      pts/0        172.19.64.1      Thu Mar  2 14:12 - 14:12  (00:00)

wtmp begins Fri Oct 14 13:16:38 2022""",
    commands="last -10 --ip")  # -> Stdout, Stderr_, Ran
executessh_7 = ExecuteSSH(
    _SSHCommands_=panel_25,
    Run=falsestart_2,
    addPrefix=True,
    fireLogs=False,
    lastRunTime=17,
    name="Who is logged in",
    suppressWarnings=False,
    results=""" 08:43:49 up 10 days, 23:47,  1 user,  load average: 0.00, 0.00, 0.00
USER     TTY      FROM             LOGIN@   IDLE   JCPU   PCPU WHAT
lio      pts/0    172.19.128.1     06Mar23  7days  0.03s  0.03s -bash""",
    commands="w")  # -> Stdout, Stderr_, Ran
panel_26 = Panel(executessh_7.Stdout)
panel_27 = Panel(executessh_6.Stdout)

# ----
# Vertex order (and normal)
# 
# source : https://www.radiance-online.org/learning/tutorials/Tutorial-ThreePhaseMethod.pdf
image = ImageSampler(Filter="Colour", Interpolate=True, Umax=1, Umin=0, Vmax=1, Vmin=0, Wrap=1)  # disabled

# ----
# Dummy
swatch = ColourSwatch(SwatchColor=RGB(188, 118, 194))
nickname = GH_TestComponentColor(Color=swatch, SelColor=ColourSwatch(SwatchColor=RGB(191, 128, 128)))

# ----
# Check radiance
# Radiacnce versino
# check ssh login
panel_28 = Panel("head /usr/local/radiance/bin/rtpict -n 2")
# Read more
# 
# 
# Ambient cache
# https://discourse.radiance-online.org/t/what-data-does-ambfile-store/4785/2
toggle_3 = BooleanToggle(True)
panel_29 = Panel("""whoami
pwd""")
executessh_8 = ExecuteSSH(
    _SSHCommands_="genbox",
    Run=Toggle(True),
    addPrefix=True,
    fireLogs=False,
    lastRunTime=73.6677,
    suppressWarnings=False,
    stderr="Usage: genbox material name xsize ysize zsize [-i] [-b bevel | -r round [-n nsegs][-s]] [-o]",
    commands="genbox")  # -> Stdout, Stderr_, Ran
# FILE NAMES: *.vmx - view matrix (data)
# *.hdr - view matrix (renderings)
# *.dmx - daylight matrix
# *.skv - sky vector
# *.smx – sky matrix
# *.xml - transmission matrix (the file is xml format)
# 
# *.rad - radiance scene data
# *.oct - octree file
# *.vf - view file
# *.dat - data
# 
# source : https://www.radiance-online.org/learning/tutorials/Tutorial-ThreePhaseMethod.pdf
executessh_9 = ExecuteSSH(
    _SSHCommands_=panel_29,
    Run=toggle_3,
    addPrefix=True,
    fireLogs=False,
    lastRunTime=74.8474,
    suppressWarnings=False,
    results="""lio
/home/lio/MantaRay/TestFolder""",
    commands="""whoami
pwd""")  # -> Stdout, Stderr_, Ran
executessh_10 = ExecuteSSH(
    _SSHCommands_=panel_28,
    Run=Toggle(True),
    addPrefix=True,
    fireLogs=False,
    lastRunTime=63.6854,
    suppressWarnings=False,
    results="""#!/usr/bin/perl -w
# RCSid $Id: rtpict.pl,v 2.25 2022/04/12 00:30:58 greg Exp $""",
    commands="head /usr/local/radiance/bin/rtpict -n 2")  # -> Stdout, Stderr_, Ran
panel_30 = Panel(executessh_8.Stdout)
panel_31 = Panel(executessh_8.Stderr_)
panel_32 = Panel(executessh_9.Stdout)
panel_33 = Panel(executessh_10.Stdout)

panel_34 = Panel("""void trans polycarbon35diff55ref0spec
0
0
7 0.968 0.968 0.968 0.070 0.010 0.389 0.000""")

# ----
# materials
run = Boolean(executessh_2.Ran)

# ----
# other materials (trans etc, NOT BSDF)
opaque_mats = Data(panel_34)
panel_35 = Panel("echo \"<mats>\" > <LinuxHome>/radFiles/<target>;echo \"<LinuxHome>/radFiles/<target>\"")
join_2 = TextJoin(Text=opaque_mats)
overrides_9 = ApplyOverrides(Input=panel_35, Mats=graft(join_2), Target=graft("other_materials.mat"))  # -> Output, DynamicOutput
executessh_11 = ExecuteSSH(
    _SSHCommands_=overrides_9.DynamicOutput,
    Run=run,
    addPrefix=True,
    description="""echo "void trans polycarbon35diff55ref0spec
0
0
7 0.968 0.968 0.968 0.070 0.010 0.389 0.000" > ~/MantaRay/TestFolder/radFiles/other_materials.mat;echo "~/MantaRay/TestFolder/radFiles/other_materials.mat"
""",
    fireLogs=False,
    lastRunTime=325.9905,
    name="otherMats",
    suppressWarnings=False,
    results="~/MantaRay/TestFolder/radFiles/other_materials.mat",
    commands="""echo "void trans polycarbon35diff55ref0spec
0
0
7 0.968 0.968 0.968 0.070 0.010 0.389 0.000" > ~/MantaRay/TestFolder/radFiles/other_materials.mat;echo "~/MantaRay/TestFolder/radFiles/other_materials.mat"
""")  # -> Stdout, Stderr_, Ran
other_mat = Text(executessh_11.Stdout)

# ----
# opaque materials
opaque_mats_2 = Data(parserhinofile.OpaqueModifiers)
panel_36 = Panel("echo \"<mats>\" > <LinuxHome>/radFiles/<target>;echo \"<LinuxHome>/radFiles/<target>\"")
join_3 = TextJoin(Text=opaque_mats_2)
overrides_10 = ApplyOverrides(Input=panel_36, Mats=graft(join_3), Target=graft("opaque_materials.mat"))  # -> Output, DynamicOutput
executessh_12 = ExecuteSSH(
    _SSHCommands_=overrides_10.DynamicOutput,
    Run=run,
    addPrefix=True,
    description="""echo "void plastic FloorMat_70
0
0
5 0.700 0.700 0.700 0.000 0.000
void plastic Cladding_50
0
0
5 0.500 0.500 0.500 0.000 0.000
void plastic ConcreteWhite_80
0
0
5 0.800 0.800 0.800 0.000 0.000
void plastic ConcreteStructure_30
0
0
5 0.300 0.300 0.300 0.000 0.000
void plastic ConcreteGrey_50
0
0
5 0.500 0.500 0.500 0.000 0.000
void plastic IntWalls_90
0
0
5 0.900 0.900 0.900 0.000 0.000
void plastic Pipes_3
0
0
5 0.030 0.030 0.030 0.000 0.000
void plastic ConcreteDarker_10
0
0
5 0.100 0.100 0.100 0.000 0.000
void plastic Frames_60
0
0
5 0.600 0.600 0.600 0.000 0.000
void plastic Black_1
0
0
5 0.010 0.010 0.010 0.000 0.000
void plastic CurvedCeiling_80
0
0
5 0.800 0.800 0.800 0.000 0.000
void plastic IntWalls_80
0
0
5 0.800 0.800 0.800 0.000 0.000
void plastic FloorBox_75
0
0
5 0.750 0.750 0.750 0.000 0.000" > ~/MantaRay/TestFolder/radFiles/opaque_materials.mat;echo "~/MantaRay/TestFolder/radFiles/opaque_materials.mat"
""",
    fireLogs=False,
    lastRunTime=157.0388,
    name="opaqueMats",
    suppressWarnings=False,
    results="~/MantaRay/TestFolder/radFiles/opaque_materials.mat",
    commands="""echo "void plastic FloorMat_70
0
0
5 0.700 0.700 0.700 0.000 0.000
void plastic Cladding_50
0
0
5 0.500 0.500 0.500 0.000 0.000
void plastic ConcreteWhite_80
0
0
5 0.800 0.800 0.800 0.000 0.000
void plastic ConcreteStructure_30
0
0
5 0.300 0.300 0.300 0.000 0.000
void plastic ConcreteGrey_50
0
0
5 0.500 0.500 0.500 0.000 0.000
void plastic IntWalls_90
0
0
5 0.900 0.900 0.900 0.000 0.000
void plastic Pipes_3
0
0
5 0.030 0.030 0.030 0.000 0.000
void plastic ConcreteDarker_10
0
0
5 0.100 0.100 0.100 0.000 0.000
void plastic Frames_60
0
0
5 0.600 0.600 0.600 0.000 0.000
void plastic Black_1
0
0
5 0.010 0.010 0.010 0.000 0.000
void plastic CurvedCeiling_80
0
0
5 0.800 0.800 0.800 0.000 0.000
void plastic IntWalls_80
0
0
5 0.800 0.800 0.800 0.000 0.000
void plastic FloorBox_75
0
0
5 0.750 0.750 0.750 0.000 0.000" > ~/MantaRay/TestFolder/radFiles/opaque_materials.mat;echo "~/MantaRay/TestFolder/radFiles/opaque_materials.mat"
""")  # -> Stdout, Stderr_, Ran
opaque_mat = Text(executessh_12.Stdout)

# ----
# Setup glass materials
glass_mat = Data(parserhinofile.GlassModifiers)
panel_37 = Panel("echo \"<mats>\" > <LinuxHome>/radFiles/<target>;echo \"<LinuxHome>/radFiles/<target>\"")
overrides_11 = ApplyOverrides(Input="<mat>.mat", Mat=graft(cluster.name_mod))
overrides_12 = ApplyOverrides(Input=panel_37, Mats=graft(glass_mat), Target=graft(overrides_11))  # -> Output, DynamicOutput
cluster_4 = Cluster_2(L=glass_mat)
executessh_13 = ExecuteSSH(
    _SSHCommands_=overrides_12.DynamicOutput,
    Run=run,
    addPrefix=True,
    description="""echo "void glass Glass_70
0
0
3 0.763 0.763 0.763" > ~/MantaRay/TestFolder/radFiles/Glass_70.mat;echo "~/MantaRay/TestFolder/radFiles/Glass_70.mat"
""",
    fireLogs=False,
    lastRunTime=86.9992,
    name="glassMats",
    suppressWarnings=False,
    results="~/MantaRay/TestFolder/radFiles/Glass_70.mat",
    commands="""echo "void glass Glass_70
0
0
3 0.763 0.763 0.763" > ~/MantaRay/TestFolder/radFiles/Glass_70.mat;echo "~/MantaRay/TestFolder/radFiles/Glass_70.mat"
""")  # -> Stdout, Stderr_, Ran
cull_3 = CullPattern(List=executessh_13.Stdout, CullPattern=cluster_4)
window_mat = Text(flatten(cull_3))

# ----
# RAD files
# STANDARD octree
window_mat_2 = Text(window_mat)
window_rad_2 = Text(window_rad)
opaque_mat_2 = Text(opaque_mat)
other_mat_2 = Text(other_mat)
opaque_rad_2 = Text(opaque_rad)
other_rad_2 = Text(other_rad)
entwine_4 = Entwine(
    Branch00=window_mat_2,
    Branch01=window_rad_2,
    Branch02=opaque_mat_2,
    Branch03=opaque_rad_2,
    Branch04=other_mat_2,
    Branch05=other_rad_2,
    FlattenInputs=True)  # -> flatten(Result)

# ----
# Preview a RAD file with objpict
# can also use ra_tiff/normtiff/pfilt
# gamma will vary
# 
# check axel jacobs radiance tutorial p26
panel_38 = Panel("""mkdir -p <proj>/images/
objpict <rad> > <proj>/images/<target-.>.hdr
normtiff <proj>/images/<target-.>.hdr <proj>/images/<target-.>.tif
convert <proj>/images/<target-.>.tif <proj>/images/<target>
echo <proj>/images/<target>""")
falsestart_4 = LBFalseStartToggle(False)
radfile = Text(flatten(entwine_4))
list = ItemSelector(
    radfile,
    {"~/MantaRay/TestFolder/radFiles/Glass_70.mat", "/home/lio/MantaRay/TestFolder/radFiles/Glass_70_geo.rad", "~/MantaRay/TestFolder/radFiles/opaque_materials.mat", "/home/lio/MantaRay/TestFolder/radFiles/FloorMat_70_geo.rad", "/home/lio/MantaRay/TestFolder/radFiles/Cladding_50_geo.rad", "/home/lio/MantaRay/TestFolder/radFiles/ConcreteWhite_80_geo.rad", "/home/lio/MantaRay/TestFolder/radFiles/ConcreteStructure_30_geo.rad", "/home/lio/MantaRay/TestFolder/radFiles/ConcreteGrey_50_geo.rad", "/home/lio/MantaRay/TestFolder/radFiles/IntWalls_90_geo.rad", "/home/lio/MantaRay/TestFolder/radFiles/Pipes_3_geo.rad", "/home/lio/MantaRay/TestFolder/radFiles/ConcreteDarker_10_geo.rad", "/home/lio/MantaRay/TestFolder/radFiles/Frames_60_geo.rad", "/home/lio/MantaRay/TestFolder/radFiles/Black_1_geo.rad", "/home/lio/MantaRay/TestFolder/radFiles/CurvedCeiling_80_geo.rad", "/home/lio/MantaRay/TestFolder/radFiles/IntWalls_80_geo.rad", "/home/lio/MantaRay/TestFolder/radFiles/FloorBox_75_geo.rad", "~/MantaRay/TestFolder/radFiles/other_materials.mat"}, selected="~/MantaRay/TestFolder/radFiles/Glass_70.mat")
entwine_5 = Entwine(Branch00=window_mat_2, Branch01=opaque_mat_2, Branch02=list, FlattenInputs=True)  # -> flatten(Result)
join_4 = TextJoin(Text=entwine_5, Join=" ")
overrides_13 = ApplyOverrides(Input=panel_38, Rad=graft(join_4), Target=graft("quickRender.png"))  # -> Output, DynamicOutput
executessh_14 = ExecuteSSH(
    _SSHCommands_=overrides_13.DynamicOutput,
    Run=falsestart_4,
    addPrefix=True,
    description="""mkdir -p ~/MantaRay/TestFolder/images/
objpict ~/MantaRay/TestFolder/radFiles/Glass_70.mat ~/MantaRay/TestFolder/radFiles/opaque_materials.mat ~/MantaRay/TestFolder/radFiles/Glass_70.mat > ~/MantaRay/TestFolder/images/quickRender.hdr
normtiff ~/MantaRay/TestFolder/images/quickRender.hdr ~/MantaRay/TestFolder/images/quickRender.tif
convert ~/MantaRay/TestFolder/images/quickRender.tif ~/MantaRay/TestFolder/images/quickRender.png
echo ~/MantaRay/TestFolder/images/quickRender.png""",
    fireLogs=False,
    lastRunTime=537,
    suppressWarnings=False,
    results="""_JOIN_
_JOIN_
_JOIN_
_JOIN_
/home/lio/MantaRay/Andrei/images/quickRender.png""",
    stderr="""oconv: fatal - (standard input): undefined modifier "polycarbon35diff55ref0spec"
rpict: fatal - (/tmp/NP9HjfGHxP/op.oct): truncated octree
rpict: 0 rays, 0.00% after 0.000u 0.000s 0.000r hours on mm-c0d0e-028 (PID 93494)
rpict: fatal - (/tmp/NP9HjfGHxP/op.oct): truncated octree
rpict: 0 rays, 0.00% after 0.000u 0.000s 0.000r hours on mm-c0d0e-028 (PID 93496)
rpict: fatal - (/tmp/NP9HjfGHxP/op.oct): truncated octree
rpict: 0 rays, 0.00% after 0.000u 0.000s 0.000r hours on mm-c0d0e-028 (PID 93498)
rpict: fatal - (/tmp/NP9HjfGHxP/op.oct): truncated octree
rpict: 0 rays, 0.00% after 0.000u 0.000s 0.000r hours on mm-c0d0e-028 (PID 93500)
/tmp/NP9HjfGHxP/down.hdr: bad picture size
pfilt: bad picture size
/home/lio/MantaRay/Andrei/images/quickRender.hdr: Not a TIFF or MDI file, bad magic number 16163 (0x3f23).
normtiff: cannot open or interpret file "/home/lio/MantaRay/Andrei/images/quickRender.hdr"
""",
    commands="""mkdir -p ~/MantaRay/Andrei/images/
_JOIN_
objpict ~/MantaRay/Andrei/radFiles/Skylights_55.mat ~/MantaRay/Andrei/radFiles/RevitJintInnerDoors_80.mat ~/MantaRay/Andrei/radFiles/RevitJfacadeFacadesCWglass_74.mat ~/MantaRay/Andrei/radFiles/RevitJfacadeWindowGlass_74.mat ~/MantaRay/Andrei/radFiles/RevitJfacadeDoorPanel_70.mat ~/MantaRay/Andrei/radFiles/opaque_materials.mat /home/lio/MantaRay/Andrei/radFiles/polycarbon35diff55ref0spec_geo.rad > ~/MantaRay/Andrei/images/quickRender.hdr
_JOIN_
normtiff ~/MantaRay/Andrei/images/quickRender.hdr ~/MantaRay/Andrei/images/quickRender.tif
_JOIN_
convert ~/MantaRay/Andrei/images/quickRender.tif ~/MantaRay/Andrei/images/quickRender.png
_JOIN_
echo ~/MantaRay/Andrei/images/quickRender.png""")  # -> Stdout, Stderr_, Ran
download = Download(SftpPaths=executessh_14.Stdout, Run=executessh_14.Ran, stdouts="C:\Users\mm1013\MantaRay\Andrei\quickRender.png")  # -> FilePaths, Status, Ran
imageviewer = LBImageViewer(ImagePath_=download.FilePaths, _scale_=1, DisableClickable=False, SaveImgWithCoords=False, scale=1)  # -> ImagePath, Values, GIF

# ----
# Download and preview rad files
# (might take 1 min)
entwine_6 = Entwine(Branch00=window_mat_2, Branch01=window_rad_2, FlattenInputs=True)
entwine_7 = Entwine(Branch00=opaque_mat_2, Branch01=opaque_rad_2, FlattenInputs=True)
entwine_8 = Entwine(Branch00=other_mat_2, Branch01=other_rad_2, FlattenInputs=True)
falsestart_5 = LBFalseStartToggle(False)
falsestart_6 = LBFalseStartToggle(False)
overrides_14 = ApplyOverrides(Input="<WinHome>\Downloads")
falsestart_7 = LBFalseStartToggle(False)
download_2 = Download(
    LinuxFilePaths=flatten(entwine_6),
    TargetLocalFolder=overrides_14,
    Run=falsestart_7,
    stdouts="C:\Users\mm1013\MantaRay\TestingRemote\Downloads\Glass_70_mat.mat>JOIN<C:\Users\mm1013\MantaRay\TestingRemote\Downloads\Glass_70.rad")  # -> FilePaths, Status, Ran
download_3 = Download(
    LinuxFilePaths=entwine_8,
    TargetLocalFolder=overrides_14,
    Run=falsestart_5,
    stdouts="C:\Users\mm1013\MantaRay\Andrei\Downloads\polycarbon35diff55ref0spec_geo.rad")  # -> FilePaths, Status, Ran
download_4 = Download(
    LinuxFilePaths=entwine_7,
    TargetLocalFolder=overrides_14,
    Run=falsestart_6,
    stdouts="C:\Users\mm1013\MantaRay\Andrei\Downloads\RoofMullions_70_geo.rad>JOIN<C:\Users\mm1013\MantaRay\Andrei\Downloads\ContextMat_30_geo.rad>JOIN<C:\Users\mm1013\MantaRay\Andrei\Downloads\Ground_20_geo.rad>JOIN<C:\Users\mm1013\MantaRay\Andrei\Downloads\Floors_20_geo.rad>JOIN<C:\Users\mm1013\MantaRay\Andrei\Downloads\Ceilings_70_geo.rad>JOIN<C:\Users\mm1013\MantaRay\Andrei\Downloads\Roofs_20_geo.rad>JOIN<C:\Users\mm1013\MantaRay\Andrei\Downloads\RevitJintInnerWalls_50_geo.rad>JOIN<C:\Users\mm1013\MantaRay\Andrei\Downloads\RevitJintInnerDoors_50_geo.rad>JOIN<C:\Users\mm1013\MantaRay\Andrei\Downloads\RevitJfacadeFacadesWall_50_geo.rad>JOIN<C:\Users\mm1013\MantaRay\Andrei\Downloads\RevitJfacadeFacadesFrames_70_geo.rad>JOIN<C:\Users\mm1013\MantaRay\Andrei\Downloads\RevitJfacadeFacadeWHITE_70_geo.rad>JOIN<C:\Users\mm1013\MantaRay\Andrei\Downloads\RevitJfacadeWindowsFrames_70_geo.rad>JOIN<C:\Users\mm1013\MantaRay\Andrei\Downloads\RevitJfacadeDoors_55_geo.rad>JOIN<C:\Users\mm1013\MantaRay\Andrei\Downloads\RevitJfacadeDoorsMISC_55_geo.rad")  # -> FilePaths, Status, Ran
cull_4 = CullPattern(List=download_2.FilePaths, CullPattern=falsestart_7)
cull_5 = CullPattern(List=download_3.FilePaths, CullPattern=falsestart_5)
cull_6 = CullPattern(List=download_4.FilePaths, CullPattern=falsestart_6)
radviewer = RadViewer(
    RadFiles=flatten(cull_5),
    IsTwoSided=False,
    Polychromatic=True,
    ShowEdges=True,
    Transparent=True,
    ColorNames=["GlassTak_70_mat", "GlassInt_74_mat", "GlassFacade_74_mat", "GlassBSDF_70_mat", "SkylightWall_70_mat", "SlabCeiling_80_mat", "SlabFloor_30_mat", "SlabWall_50_mat", "SlabJ_50_mat", "WallExterior_50_mat"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],
    Colors=[RGB(177, 203, 218), RGB(149, 243, 118), RGB(218, 247, 105), RGB(165, 199, 252), RGB(100, 251, 165), RGB(203, 230, 172)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])  # -> Geo, ModifierNames, Modifiers, FailedWireFrame
radviewer_2 = RadViewer(
    RadFiles=flatten(cull_4),
    IsTwoSided=False,
    Polychromatic=True,
    ShowEdges=True,
    Transparent=True,
    ColorNames=["GlassTak_70_mat", "GlassInt_74_mat", "GlassFacade_74_mat", "GlassBSDF_70_mat", "SkylightWall_70_mat", "SlabCeiling_80_mat", "SlabFloor_30_mat", "SlabWall_50_mat", "SlabJ_50_mat", "WallExterior_50_mat", "Roofs_50_mat", "Doors_50_mat", "FramesCW_50_mat", "FacadeBright_70_mat", "ContextBright_70_mat", "WallInterior_70_mat", "FacadeDark_30_mat", "Frames_50_mat", "Terrain_20_mat", "Buildings_50_mat", "Glass_70_mat"],
    Colors=[RGB(177, 203, 218), RGB(149, 243, 118), RGB(218, 247, 105), RGB(165, 199, 252), RGB(100, 251, 165), RGB(203, 230, 172), RGB(169, 243, 224), RGB(238, 176, 232), RGB(242, 222, 239), RGB(146, 222, 239), RGB(144, 119, 233), RGB(174, 245, 124), RGB(120, 214, 159), RGB(156, 153, 225), RGB(117, 221, 150), RGB(184, 150, 138), RGB(158, 205, 172), RGB(189, 132, 143), RGB(106, 135, 236), RGB(102, 168, 232), RGB(245, 194, 251)])  # -> Geo, ModifierNames, Modifiers, FailedWireFrame
radviewer_3 = RadViewer(
    RadFiles=flatten(cull_6),
    IsTwoSided=False,
    Polychromatic=True,
    ShowEdges=True,
    Transparent=True,
    ColorNames=["GlassTak_70_mat", "GlassInt_74_mat", "GlassFacade_74_mat", "GlassBSDF_70_mat", "SkylightWall_70_mat", "SlabCeiling_80_mat", "SlabFloor_30_mat", "SlabWall_50_mat", "SlabJ_50_mat", "WallExterior_50_mat"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],
    Colors=[RGB(177, 203, 218), RGB(149, 243, 118), RGB(218, 247, 105), RGB(165, 199, 252), RGB(100, 251, 165), RGB(203, 230, 172)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])  # -> Geo, ModifierNames, Modifiers, FailedWireFrame

# ----
# OCONV - Creation of Octrees
# Scene + 10klx overcast sky (RwR p357)
# # start of sky definition for daylighting studies
# # location name: COPENHAGEN_DNK LAT: 55.63
# !gensky 5 14 14.0 -c -a 55.63 -o -12.67 -m -15.0 | xform -rz 0.0
# skyfunc glow sky_mat
# 0
# 0
# 4
# 1 1 1 0
# sky_mat source sky
# 0
# 0
# 4
# 0 0 1 180
# skyfunc glow ground_glow
# 0
# 0
# 4
# 1 .8 .5 0
# ground_glow source ground
# 0
# 0
# 4
# 0 0 -1 180
# # end of sky definition for daylighting studies
falsestart_8 = LBFalseStartToggle(True)
and_append_the_ground = Panel("""##The 1 will be multiplie with brightfunc
skyfunc glow sky_glow
0
0
4 1 1 1 0

##Set to 1 as it will be multiplied with the gensky result
sky_glow source sky
0
0
4 0 0 1 180

##Set to 1 as it will be multiplied with the gensky result
skyfunc glow ground_glow
0
0
4 1 1 1 0

##The ground pane
ground_glow source ground
0
0
4 0 0 -1 180""")
bool_4 = Boolean(falsestart_8)
executessh_15 = ExecuteSSH(
    _SSHCommands_="gensky -ang 45 0 -c -B 55.866",
    Run=bool_4,
    addPrefix=True,
    fireLogs=False,
    lastRunTime=72.7715,
    suppressWarnings=False,
    results="""# gensky -ang 45 0 -c -B 55.866
# Ground ambient level: 17.8

void brightfunc skyfunc
2 skybr skybright.cal
0
3 2 2.29e+01 3.56e+00""",
    commands="gensky -ang 45 0 -c -B 55.866")  # -> Stdout, Stderr_, Ran
concat = Concatenate(FragmentC="##Will control the gradient of the sky", FragmentA=executessh_15.Stdout, FragmentB=and_append_the_ground)
panel_39 = Panel(concat)
panel_40 = Panel("""mkdir -p <proj>/skies/
echo "<sky>" > <proj>/skies/<target>
echo "<proj>/skies/<target>"
""")
overrides_15 = ApplyOverrides(Input=panel_40, Sky=graft(panel_39), Target=graft("overcast_sky.rad"))  # -> Output, DynamicOutput
executessh_16 = ExecuteSSH(
    _SSHCommands_=overrides_15.DynamicOutput,
    Run=executessh_15.Ran,
    addPrefix=True,
    description="""mkdir -p ~/MantaRay/TestFolder/skies/
echo "##Will control the gradient of the sky
# gensky -ang 45 0 -c -B 55.866
# Ground ambient level: 17.8

void brightfunc skyfunc
2 skybr skybright.cal
0
3 2 2.29e+01 3.56e+00

##The 1 will be multiplie with brightfunc
skyfunc glow sky_glow
0
0
4 1 1 1 0

##Set to 1 as it will be multiplied with the gensky result
sky_glow source sky
0
0
4 0 0 1 180

##Set to 1 as it will be multiplied with the gensky result
skyfunc glow ground_glow
0
0
4 1 1 1 0

##The ground pane
ground_glow source ground
0
0
4 0 0 -1 180" > ~/MantaRay/TestFolder/skies/overcast_sky.rad
echo "~/MantaRay/TestFolder/skies/overcast_sky.rad"
""",
    fireLogs=False,
    lastRunTime=74.8295,
    suppressWarnings=False,
    results="""_JOIN_
_JOIN_
~/MantaRay/TestFolder/skies/overcast_sky.rad""",
    commands="""mkdir -p ~/MantaRay/TestFolder/skies/
_JOIN_
echo "##Will control the gradient of the sky
# gensky -ang 45 0 -c -B 55.866
# Ground ambient level: 17.8

void brightfunc skyfunc
2 skybr skybright.cal
0
3 2 2.29e+01 3.56e+00

##The 1 will be multiplie with brightfunc
skyfunc glow sky_glow
0
0
4 1 1 1 0

##Set to 1 as it will be multiplied with the gensky result
sky_glow source sky
0
0
4 0 0 1 180

##Set to 1 as it will be multiplied with the gensky result
skyfunc glow ground_glow
0
0
4 1 1 1 0

##The ground pane
ground_glow source ground
0
0
4 0 0 -1 180" > ~/MantaRay/TestFolder/skies/overcast_sky.rad
_JOIN_
echo "~/MantaRay/TestFolder/skies/overcast_sky.rad"
""")  # -> Stdout, Stderr_, Ran
panel_41 = Panel(overrides_15.DynamicOutput)
panel_42 = Panel(executessh_16.Stderr_)
sky_ovc = Text(executessh_16.Stdout)

# ----
# Scene + 10 sunny skies (SET LAT AND LON)
panel_43 = Panel("gensky 7 4 <h>:00CEST +s -a <lat> -o <lon>")
falsestart_9 = LBFalseStartToggle(False)
series = Series(Start=8, Step=1, Count=10)
overrides_16 = ApplyOverrides(Input=panel_43, H=graft(series), Lat=graft("59.9"), Lon=graft("10.7"))  # -> Output, DynamicOutput
bool_5 = Boolean(falsestart_9)
and_append_the_ground_2 = Panel("""##The 1 will be multiplie with brightfunc
skyfunc glow sky_glow
0
0
4 1 1 1 0

##Set to 1 as it will be multiplied with the gensky result
sky_glow source sky
0
0
4 0 0 1 180

##Set to 1 as it will be multiplied with the gensky result
skyfunc glow ground_glow
0
0
4 1 1 1 0

##The ground pane
ground_glow source ground
0
0
4 0 0 -1 180""")
executessh_17 = ExecuteSSH(
    _SSHCommands_=overrides_16.DynamicOutput,
    Run=bool_5,
    addPrefix=True,
    description="""gensky 7 4 8:00CEST +s -a 59.9 -o 10.7


- - -

gensky 7 4 9:00CEST +s -a 59.9 -o 10.7


- - -

gensky 7 4 10:00CEST +s -a 59.9 -o 10.7


- - -

gensky 7 4 11:00CEST +s -a 59.9 -o 10.7


- - -

gensky 7 4 12:00CEST +s -a 59.9 -o 10.7


- - -

gensky 7 4 13:00CEST +s -a 59.9 -o 10.7


- - -

gensky 7 4 14:00CEST +s -a 59.9 -o 10.7


- - -

gensky 7 4 15:00CEST +s -a 59.9 -o 10.7


- - -

gensky 7 4 16:00CEST +s -a 59.9 -o 10.7


- - -

gensky 7 4 17:00CEST +s -a 59.9 -o 10.7""",
    fireLogs=False,
    lastRunTime=39,
    suppressWarnings=False,
    results=["""# gensky 7 4 8:00CEST +s -a 59.9 -o 10.7
# Local solar time: 5.22
# Solar altitude and azimuth: 14.1 -111.6
# Ground ambient level: 8.8

void light solar
0
0
3 3.92e+06 3.92e+06 3.92e+06

solar source sun
0
0
4 0.901641 0.357186 0.243849 0.5

void brightfunc skyfunc
2 skybr skybright.cal
0
7 1 3.81e+00 5.41e+00 3.08e-01 0.901641 0.357186 0.243849""", """# gensky 7 4 9:00CEST +s -a 59.9 -o 10.7
# Local solar time: 6.22
# Solar altitude and azimuth: 21.4 -99.3
# Ground ambient level: 10.8

void light solar
0
0
3 5.36e+06 5.36e+06 5.36e+06

solar source sun
0
0
4 0.919246 0.149788 0.364073 0.5

void brightfunc skyfunc
2 skybr skybright.cal
0
7 1 4.88e+00 9.62e+00 3.41e-01 0.919246 0.149788 0.364073""", """# gensky 7 4 10:00CEST +s -a 59.9 -o 10.7
# Local solar time: 7.22
# Solar altitude and azimuth: 28.8 -86.4
# Ground ambient level: 12.6

void light solar
0
0
3 6.07e+06 6.07e+06 6.07e+06

solar source sun
0
0
4 0.874207 -0.054485 0.482486 0.5

void brightfunc skyfunc
2 skybr skybright.cal
0
7 1 6.11e+00 1.37e+01 3.90e-01 0.874207 -0.054485 0.482486""", """# gensky 7 4 11:00CEST +s -a 59.9 -o 10.7
# Local solar time: 8.22
# Solar altitude and azimuth: 36.2 -72.6
# Ground ambient level: 13.8

void light solar
0
0
3 6.48e+06 6.48e+06 6.48e+06

solar source sun
0
0
4 0.769592 -0.241712 0.591018 0.5

void brightfunc skyfunc
2 skybr skybright.cal
0
7 1 7.51e+00 1.74e+01 4.56e-01 0.769592 -0.241712 0.591018""", """# gensky 7 4 12:00CEST +s -a 59.9 -o 10.7
# Local solar time: 9.22
# Solar altitude and azimuth: 43.0 -56.9
# Ground ambient level: 14.6

void light solar
0
0
3 6.72e+06 6.72e+06 6.72e+06

solar source sun
0
0
4 0.612531 -0.399135 0.682273 0.5

void brightfunc skyfunc
2 skybr skybright.cal
0
7 1 9.05e+00 2.04e+01 5.41e-01 0.612531 -0.399135 0.682273""", """# gensky 7 4 13:00CEST +s -a 59.9 -o 10.7
# Local solar time: 10.22
# Solar altitude and azimuth: 48.6 -38.7
# Ground ambient level: 15.0

void light solar
0
0
3 6.86e+06 6.86e+06 6.86e+06

solar source sun
0
0
4 0.413727 -0.516025 0.750032 0.5

void brightfunc skyfunc
2 skybr skybright.cal
0
7 1 1.06e+01 2.26e+01 6.32e-01 0.413727 -0.516025 0.750032"""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],
    commands=["gensky 7 4 12:00CEST +s -a 59.9 -o 10.7", "gensky 7 4 8:00CEST +s -a 59.9 -o 10.7", "gensky 7 4 9:00CEST +s -a 59.9 -o 10.7", "gensky 7 4 13:00CEST +s -a 59.9 -o 10.7", "gensky 7 4 15:00CEST +s -a 59.9 -o 10.7", "gensky 7 4 16:00CEST +s -a 59.9 -o 10.7", "gensky 7 4 17:00CEST +s -a 59.9 -o 10.7"])  # -> Stdout, Stderr_, Ran
panel_44 = Panel(executessh_17.Stdout)
concat_2 = Concatenate(FragmentC="##Will control the gradient of the sky", FragmentA=executessh_17.Stdout, FragmentB=and_append_the_ground_2)
panel_45 = Panel("""mkdir -p <proj>/skies/
echo "<sky>" > <proj>/skies/<target>
echo "<proj>/skies/<target>"
""")
overrides_17 = ApplyOverrides(Input=panel_45, Sky=graft(concat_2), Target=graft("sunny_sky_<h>.rad"), H=graft(series))  # -> Output, DynamicOutput
executessh_18 = ExecuteSSH(
    _SSHCommands_=overrides_17.DynamicOutput,
    Run=executessh_17.Ran,
    addPrefix=True,
    description="""mkdir -p ~/MantaRay/TestFolder/skies/
echo "##Will control the gradient of the sky
# gensky 7 4 8:00CEST +s -a 59.9 -o 10.7
# Local solar time: 5.22
# Solar altitude and azimuth: 14.1 -111.6
# Ground ambient level: 8.8

void light solar
0
0
3 3.92e+06 3.92e+06 3.92e+06

solar source sun
0
0
4 0.901641 0.357186 0.243849 0.5

void brightfunc skyfunc
2 skybr skybright.cal
0
7 1 3.81e+00 5.41e+00 3.08e-01 0.901641 0.357186 0.243849

##The 1 will be multiplie with brightfunc
skyfunc glow sky_glow
0
0
4 1 1 1 0

##Set to 1 as it will be multiplied with the gensky result
sky_glow source sky
0
0
4 0 0 1 180

##Set to 1 as it will be multiplied with the gensky result
skyfunc glow ground_glow
0
0
4 1 1 1 0

##The ground pane
ground_glow source ground
0
0
4 0 0 -1 180" > ~/MantaRay/TestFolder/skies/sunny_sky_8.rad
echo "~/MantaRay/TestFolder/skies/sunny_sky_8.rad"


- - -

mkdir -p ~/MantaRay/TestFolder/skies/
echo "##Will control the gradient of the sky
# gensky 7 4 9:00CEST +s -a 59.9 -o 10.7
# Local solar time: 6.22
# Solar altitude and azimuth: 21.4 -99.3
# Ground ambient level: 10.8

void light solar
0
0
3 5.36e+06 5.36e+06 5.36e+06

solar source sun
0
0
4 0.919246 0.149788 0.364073 0.5

void brightfunc skyfunc
2 skybr skybright.cal
0
7 1 4.88e+00 9.62e+00 3.41e-01 0.919246 0.149788 0.364073

##The 1 will be multiplie with brightfunc
skyfunc glow sky_glow
0
0
4 1 1 1 0

##Set to 1 as it will be multiplied with the gensky result
sky_glow source sky
0
0
4 0 0 1 180

##Set to 1 as it will be multiplied with the gensky result
skyfunc glow ground_glow
0
0
4 1 1 1 0

##The ground pane
ground_glow source ground
0
0
4 0 0 -1 180" > ~/MantaRay/TestFolder/skies/sunny_sky_9.rad
echo "~/MantaRay/TestFolder/skies/sunny_sky_9.rad"


- - -

mkdir -p ~/MantaRay/TestFolder/skies/
echo "##Will control the gradient of the sky
# gensky 7 4 10:00CEST +s -a 59.9 -o 10.7
# Local solar time: 7.22
# Solar altitude and azimuth: 28.8 -86.4
# Ground ambient level: 12.6

void light solar
0
0
3 6.07e+06 6.07e+06 6.07e+06

solar source sun
0
0
4 0.874207 -0.054485 0.482486 0.5

void brightfunc skyfunc
2 skybr skybright.cal
0
7 1 6.11e+00 1.37e+01 3.90e-01 0.874207 -0.054485 0.482486

##The 1 will be multiplie with brightfunc
skyfunc glow sky_glow
0
0
4 1 1 1 0

##Set to 1 as it will be multiplied with the gensky result
sky_glow source sky
0
0
4 0 0 1 180

##Set to 1 as it will be multiplied with the gensky result
skyfunc glow ground_glow
0
0
4 1 1 1 0

##The ground pane
ground_glow source ground
0
0
4 0 0 -1 180" > ~/MantaRay/TestFolder/skies/sunny_sky_10.rad
echo "~/MantaRay/TestFolder/skies/sunny_sky_10.rad"


- - -

mkdir -p ~/MantaRay/TestFolder/skies/
echo "##Will control the gradient of the sky
# gensky 7 4 11:00CEST +s -a 59.9 -o 10.7
# Local solar time: 8.22
# Solar altitude and azimuth: 36.2 -72.6
# Ground ambient level: 13.8

void light solar
0
0
3 6.48e+06 6.48e+06 6.48e+06

solar source sun
0
0
4 0.769592 -0.241712 0.591018 0.5

void brightfunc skyfunc
2 skybr skybright.cal
0
7 1 7.51e+00 1.74e+01 4.56e-01 0.769592 -0.241712 0.591018

##The 1 will be multiplie with brightfunc
skyfunc glow sky_glow
0
0
4 1 1 1 0

##Set to 1 as it will be multiplied with the gensky result
sky_glow source sky
0
0
4 0 0 1 180

##Set to 1 as it will be multiplied with the gensky result
skyfunc glow ground_glow
0
0
4 1 1 1 0

##The ground pane
ground_glow source ground
0
0
4 0 0 -1 180" > ~/MantaRay/TestFolder/skies/sunny_sky_11.rad
echo "~/MantaRay/TestFolder/skies/sunny_sky_11.rad"


- - -

mkdir -p ~/MantaRay/TestFolder/skies/
echo "##Will control the gradient of the sky
# gensky 7 4 12:00CEST +s -a 59.9 -o 10.7
# Local solar time: 9.22
# Solar altitude and azimuth: 43.0 -56.9
# Ground ambient level: 14.6

void light solar
0
0
3 6.72e+06 6.72e+06 6.72e+06

solar source sun
0
0
4 0.612531 -0.399135 0.682273 0.5

void brightfunc skyfunc
2 skybr skybright.cal
0
7 1 9.05e+00 2.04e+01 5.41e-01 0.612531 -0.399135 0.682273

##The 1 will be multiplie with brightfunc
skyfunc glow sky_glow
0
0
4 1 1 1 0

##Set to 1 as it will be multiplied with the gensky result
sky_glow source sky
0
0
4 0 0 1 180

##Set to 1 as it will be multiplied with the gensky result
skyfunc glow ground_glow
0
0
4 1 1 1 0

##The ground pane
ground_glow source ground
0
0
4 0 0 -1 180" > ~/MantaRay/TestFolder/skies/sunny_sky_12.rad
echo "~/MantaRay/TestFolder/skies/sunny_sky_12.rad"


- - -

mkdir -p ~/MantaRay/TestFolder/skies/
echo "##Will control the gradient of the sky
# gensky 7 4 13:00CEST +s -a 59.9 -o 10.7
# Local solar time: 10.22
# Solar altitude and azimuth: 48.6 -38.7
# Ground ambient level: 15.0

void light solar
0
0
3 6.86e+06 6.86e+06 6.86e+06

solar source sun
0
0
4 0.413727 -0.516025 0.750032 0.5

void brightfunc skyfunc
2 skybr skybright.cal
0
7 1 1.06e+01 2.26e+01 6.32e-01 0.413727 -0.516025 0.750032

##The 1 will be multiplie with brightfunc
skyfunc glow sky_glow
0
0
4 1 1 1 0

##Set to 1 as it will be multiplied with the gensky result
sky_glow source sky
0
0
4 0 0 1 180

##Set to 1 as it will be multiplied with the gensky result
skyfunc glow ground_glow
0
0
4 1 1 1 0

##The ground pane
ground_glow source ground
0
0
4 0 0 -1 180" > ~/MantaRay/TestFolder/skies/sunny_sky_13.rad
echo "~/MantaRay/TestFolder/skies/sunny_sky_13.rad"


- - -

mkdir -p ~/MantaRay/TestFolder/skies/
echo "##Will control the gradient of the sky
# gensky 7 4 14:00CEST +s -a 59.9 -o 10.7
# Local solar time: 11.22
# Solar altitude and azimuth: 52.2 -17.7
# Ground ambient level: 15.1

void light solar
0
0
3 6.93e+06 6.93e+06 6.93e+06

solar source sun
0
0
4 0.186727 -0.584417 0.789677 0.5

void brightfunc skyfunc
2 skybr skybright.cal
0
7 1 1.18e+01 2.39e+01 7.04e-01 0.186727 -0.584417 0.789677

##The 1 will be multiplie with brightfunc
skyfunc glow sky_glow
0
0
4 1 1 1 0

##Set to 1 as it will be multiplied with the gensky result
sky_glow source sky
0
0
4 0 0 1 180

##Set to 1 as it will be multiplied with the gensky result
skyfunc glow ground_glow
0
0
4 1 1 1 0

##The ground pane
ground_glow source ground
0
0
4 0 0 -1 180" > ~/MantaRay/TestFolder/skies/sunny_sky_14.rad
echo "~/MantaRay/TestFolder/skies/sunny_sky_14.rad"


- - -

mkdir -p ~/MantaRay/TestFolder/skies/
echo "##Will control the gradient of the sky
# gensky 7 4 15:00CEST +s -a 59.9 -o 10.7
# Local solar time: 12.22
# Solar altitude and azimuth: 53.0 5.1
# Ground ambient level: 15.2

void light solar
0
0
3 6.94e+06 6.94e+06 6.94e+06

solar source sun
0
0
4 -0.052997 -0.599649 0.798507 0.5

void brightfunc skyfunc
2 skybr skybright.cal
0
7 1 1.21e+01 2.42e+01 7.23e-01 -0.052997 -0.599649 0.798507

##The 1 will be multiplie with brightfunc
skyfunc glow sky_glow
0
0
4 1 1 1 0

##Set to 1 as it will be multiplied with the gensky result
sky_glow source sky
0
0
4 0 0 1 180

##Set to 1 as it will be multiplied with the gensky result
skyfunc glow ground_glow
0
0
4 1 1 1 0

##The ground pane
ground_glow source ground
0
0
4 0 0 -1 180" > ~/MantaRay/TestFolder/skies/sunny_sky_15.rad
echo "~/MantaRay/TestFolder/skies/sunny_sky_15.rad"


- - -

mkdir -p ~/MantaRay/TestFolder/skies/
echo "##Will control the gradient of the sky
# gensky 7 4 16:00CEST +s -a 59.9 -o 10.7
# Local solar time: 13.22
# Solar altitude and azimuth: 50.9 27.3
# Ground ambient level: 15.1

void light solar
0
0
3 6.91e+06 6.91e+06 6.91e+06

solar source sun
0
0
4 -0.289110 -0.560683 0.775919 0.5

void brightfunc skyfunc
2 skybr skybright.cal
0
7 1 1.13e+01 2.35e+01 6.77e-01 -0.289110 -0.560683 0.775919

##The 1 will be multiplie with brightfunc
skyfunc glow sky_glow
0
0
4 1 1 1 0

##Set to 1 as it will be multiplied with the gensky result
sky_glow source sky
0
0
4 0 0 1 180

##Set to 1 as it will be multiplied with the gensky result
skyfunc glow ground_glow
0
0
4 1 1 1 0

##The ground pane
ground_glow source ground
0
0
4 0 0 -1 180" > ~/MantaRay/TestFolder/skies/sunny_sky_16.rad
echo "~/MantaRay/TestFolder/skies/sunny_sky_16.rad"


- - -

mkdir -p ~/MantaRay/TestFolder/skies/
echo "##Will control the gradient of the sky
# gensky 7 4 17:00CEST +s -a 59.9 -o 10.7
# Local solar time: 14.22
# Solar altitude and azimuth: 46.3 47.1
# Ground ambient level: 14.8

void light solar
0
0
3 6.81e+06 6.81e+06 6.81e+06

solar source sun
0
0
4 -0.505520 -0.470175 0.723454 0.5

void brightfunc skyfunc
2 skybr skybright.cal
0
7 1 9.93e+00 2.18e+01 5.92e-01 -0.505520 -0.470175 0.723454

##The 1 will be multiplie with brightfunc
skyfunc glow sky_glow
0
0
4 1 1 1 0

##Set to 1 as it will be multiplied with the gensky result
sky_glow source sky
0
0
4 0 0 1 180

##Set to 1 as it will be multiplied with the gensky result
skyfunc glow ground_glow
0
0
4 1 1 1 0

##The ground pane
ground_glow source ground
0
0
4 0 0 -1 180" > ~/MantaRay/TestFolder/skies/sunny_sky_17.rad
echo "~/MantaRay/TestFolder/skies/sunny_sky_17.rad"
""",
    fireLogs=False,
    lastRunTime=45,
    suppressWarnings=False,
    results=["""_JOIN_
_JOIN_
~/MantaRay/TestingRemote/skies/sunny_sky_8.rad""", """_JOIN_
_JOIN_
~/MantaRay/TestingRemote/skies/sunny_sky_9.rad""", """_JOIN_
_JOIN_
~/MantaRay/TestingRemote/skies/sunny_sky_10.rad""", """_JOIN_
_JOIN_
~/MantaRay/TestingRemote/skies/sunny_sky_11.rad""", """_JOIN_
_JOIN_
~/MantaRay/TestingRemote/skies/sunny_sky_12.rad""", """_JOIN_
_JOIN_
~/MantaRay/TestingRemote/skies/sunny_sky_13.rad""", """_JOIN_
_JOIN_
~/MantaRay/TestingRemote/skies/sunny_sky_14.rad""", """_JOIN_
_JOIN_
~/MantaRay/TestingRemote/skies/sunny_sky_15.rad""", """_JOIN_
_JOIN_
~/MantaRay/TestingRemote/skies/sunny_sky_16.rad""", """_JOIN_
_JOIN_
~/MantaRay/TestingRemote/skies/sunny_sky_17.rad"""],
    commands=["""mkdir -p ~/MantaRay/TestingRemote/skies/
_JOIN_
echo "##Will control the gradient of the sky
# gensky 7 4 10:00CEST +s -a 59.9 -o 10.7
# Local solar time: 7.22
# Solar altitude and azimuth: 28.8 -86.4
# Ground ambient level: 12.6

void light solar
0
0
3 6.07e+06 6.07e+06 6.07e+06

solar source sun
0
0
4 0.874207 -0.054485 0.482486 0.5

void brightfunc skyfunc
2 skybr skybright.cal
0
7 1 6.11e+00 1.37e+01 3.90e-01 0.874207 -0.054485 0.482486

##The 1 will be multiplie with brightfunc
skyfunc glow sky_glow
0
0
4 1 1 1 0

##Set to 1 as it will be multiplied with the gensky result
sky_glow source sky
0
0
4 0 0 1 180

##Set to 1 as it will be multiplied with the gensky result
skyfunc glow ground_glow
0
0
4 1 1 1 0

##The ground pane
ground_glow source ground
0
0
4 0 0 -1 180" > ~/MantaRay/TestingRemote/skies/sunny_sky_10.rad
_JOIN_
echo "~/MantaRay/TestingRemote/skies/sunny_sky_10.rad"
""", """mkdir -p ~/MantaRay/TestingRemote/skies/
_JOIN_
echo "##Will control the gradient of the sky
# gensky 7 4 9:00CEST +s -a 59.9 -o 10.7
# Local solar time: 6.22
# Solar altitude and azimuth: 21.4 -99.3
# Ground ambient level: 10.8

void light solar
0
0
3 5.36e+06 5.36e+06 5.36e+06

solar source sun
0
0
4 0.919246 0.149788 0.364073 0.5

void brightfunc skyfunc
2 skybr skybright.cal
0
7 1 4.88e+00 9.62e+00 3.41e-01 0.919246 0.149788 0.364073

##The 1 will be multiplie with brightfunc
skyfunc glow sky_glow
0
0
4 1 1 1 0

##Set to 1 as it will be multiplied with the gensky result
sky_glow source sky
0
0
4 0 0 1 180

##Set to 1 as it will be multiplied with the gensky result
skyfunc glow ground_glow
0
0
4 1 1 1 0

##The ground pane
ground_glow source ground
0
0
4 0 0 -1 180" > ~/MantaRay/TestingRemote/skies/sunny_sky_9.rad
_JOIN_
echo "~/MantaRay/TestingRemote/skies/sunny_sky_9.rad"
""", """mkdir -p ~/MantaRay/TestingRemote/skies/
_JOIN_
echo "##Will control the gradient of the sky
# gensky 7 4 14:00CEST +s -a 59.9 -o 10.7
# Local solar time: 11.22
# Solar altitude and azimuth: 52.2 -17.7
# Ground ambient level: 15.1

void light solar
0
0
3 6.93e+06 6.93e+06 6.93e+06

solar source sun
0
0
4 0.186727 -0.584417 0.789677 0.5

void brightfunc skyfunc
2 skybr skybright.cal
0
7 1 1.18e+01 2.39e+01 7.04e-01 0.186727 -0.584417 0.789677

##The 1 will be multiplie with brightfunc
skyfunc glow sky_glow
0
0
4 1 1 1 0

##Set to 1 as it will be multiplied with the gensky result
sky_glow source sky
0
0
4 0 0 1 180

##Set to 1 as it will be multiplied with the gensky result
skyfunc glow ground_glow
0
0
4 1 1 1 0

##The ground pane
ground_glow source ground
0
0
4 0 0 -1 180" > ~/MantaRay/TestingRemote/skies/sunny_sky_14.rad
_JOIN_
echo "~/MantaRay/TestingRemote/skies/sunny_sky_14.rad"
""", """mkdir -p ~/MantaRay/TestingRemote/skies/
_JOIN_
echo "##Will control the gradient of the sky
# gensky 7 4 12:00CEST +s -a 59.9 -o 10.7
# Local solar time: 9.22
# Solar altitude and azimuth: 43.0 -56.9
# Ground ambient level: 14.6

void light solar
0
0
3 6.72e+06 6.72e+06 6.72e+06

solar source sun
0
0
4 0.612531 -0.399135 0.682273 0.5

void brightfunc skyfunc
2 skybr skybright.cal
0
7 1 9.05e+00 2.04e+01 5.41e-01 0.612531 -0.399135 0.682273

##The 1 will be multiplie with brightfunc
skyfunc glow sky_glow
0
0
4 1 1 1 0

##Set to 1 as it will be multiplied with the gensky result
sky_glow source sky
0
0
4 0 0 1 180

##Set to 1 as it will be multiplied with the gensky result
skyfunc glow ground_glow
0
0
4 1 1 1 0

##The ground pane
ground_glow source ground
0
0
4 0 0 -1 180" > ~/MantaRay/TestingRemote/skies/sunny_sky_12.rad
_JOIN_
echo "~/MantaRay/TestingRemote/skies/sunny_sky_12.rad"
""", """mkdir -p ~/MantaRay/TestingRemote/skies/
_JOIN_
echo "##Will control the gradient of the sky
# gensky 7 4 8:00CEST +s -a 59.9 -o 10.7
# Local solar time: 5.22
# Solar altitude and azimuth: 14.1 -111.6
# Ground ambient level: 8.8

void light solar
0
0
3 3.92e+06 3.92e+06 3.92e+06

solar source sun
0
0
4 0.901641 0.357186 0.243849 0.5

void brightfunc skyfunc
2 skybr skybright.cal
0
7 1 3.81e+00 5.41e+00 3.08e-01 0.901641 0.357186 0.243849

##The 1 will be multiplie with brightfunc
skyfunc glow sky_glow
0
0
4 1 1 1 0

##Set to 1 as it will be multiplied with the gensky result
sky_glow source sky
0
0
4 0 0 1 180

##Set to 1 as it will be multiplied with the gensky result
skyfunc glow ground_glow
0
0
4 1 1 1 0

##The ground pane
ground_glow source ground
0
0
4 0 0 -1 180" > ~/MantaRay/TestingRemote/skies/sunny_sky_8.rad
_JOIN_
echo "~/MantaRay/TestingRemote/skies/sunny_sky_8.rad"
""", """mkdir -p ~/MantaRay/TestingRemote/skies/
_JOIN_
echo "##Will control the gradient of the sky
# gensky 7 4 16:00CEST +s -a 59.9 -o 10.7
# Local solar time: 13.22
# Solar altitude and azimuth: 50.9 27.3
# Ground ambient level: 15.1

void light solar
0
0
3 6.91e+06 6.91e+06 6.91e+06

solar source sun
0
0
4 -0.289110 -0.560683 0.775919 0.5

void brightfunc skyfunc
2 skybr skybright.cal
0
7 1 1.13e+01 2.35e+01 6.77e-01 -0.289110 -0.560683 0.775919

##The 1 will be multiplie with brightfunc
skyfunc glow sky_glow
0
0
4 1 1 1 0

##Set to 1 as it will be multiplied with the gensky result
sky_glow source sky
0
0
4 0 0 1 180

##Set to 1 as it will be multiplied with the gensky result
skyfunc glow ground_glow
0
0
4 1 1 1 0

##The ground pane
ground_glow source ground
0
0
4 0 0 -1 180" > ~/MantaRay/TestingRemote/skies/sunny_sky_16.rad
_JOIN_
echo "~/MantaRay/TestingRemote/skies/sunny_sky_16.rad"
"""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])  # -> Stdout, Stderr_, Ran
item = ListItem(List=executessh_18.Stdout, Index=0, Wrap=True)  # -> Item1, Item
python_5 = GhPythonScript(x=series)  # -> a; inputs x: Int32
# ---------- python_5: Python ----------
__author__ = "mm1013"
__version__ = "2022.08.30"

import rhinoscriptsyntax as rs

a = "%02d00" % x
# ---------- end python_5 ----------
hours = Number(python_5)
hours_2 = Text(python_5)

overrides_18 = ApplyOverrides(Input="cat <target>", Target=graft(executessh_16.Stdout))  # -> Output, DynamicOutput
executessh_19 = ExecuteSSH(
    _SSHCommands_=overrides_18.Output,
    Run=False,
    addPrefix=True,
    fireLogs=False,
    lastRunTime=0,
    suppressWarnings=False,
    results="""##Will control the gradient of the sky
# gensky -ang 45 0 -c -B 55.866
# Ground ambient level: 17.8

void brightfunc skyfunc
2 skybr skybright.cal
0
3 2 2.29e+01 3.56e+00

##The 1 will be multiplie with brightfunc
skyfunc glow sky_glow
0
0
4 1 1 1 0

##Set to 1 as it will be multiplied with the gensky result
sky_glow source sky
0
0
4 0 0 1 180

##Set to 1 as it will be multiplied with the gensky result
skyfunc glow ground_glow
0
0
4 1 1 1 0

##The ground pane
ground_glow source ground
0
0
4 0 0 -1 180""",
    commands="cat ~/MantaRay/UnnamedProject/skies/overcast_sky.rad")  # -> Stdout, Stderr_, Ran
panel_46 = Panel(executessh_19.Stdout)

overrides_19 = ApplyOverrides(Input="head <target>", Target=graft(item.Item1))  # -> Output, DynamicOutput
executessh_20 = ExecuteSSH(
    _SSHCommands_=overrides_19.DynamicOutput,
    Run=executessh_18.Ran,
    addPrefix=True,
    description="""head ~/MantaRay/TestingRemote/skies/sunny_sky_8.rad


- - -

head ~/MantaRay/TestingRemote/skies/sunny_sky_9.rad


- - -

head ~/MantaRay/TestingRemote/skies/sunny_sky_10.rad


- - -

head ~/MantaRay/TestingRemote/skies/sunny_sky_11.rad


- - -

head ~/MantaRay/TestingRemote/skies/sunny_sky_12.rad


- - -

head ~/MantaRay/TestingRemote/skies/sunny_sky_13.rad


- - -

head ~/MantaRay/TestingRemote/skies/sunny_sky_14.rad


- - -

head ~/MantaRay/TestingRemote/skies/sunny_sky_15.rad


- - -

head ~/MantaRay/TestingRemote/skies/sunny_sky_16.rad


- - -

head ~/MantaRay/TestingRemote/skies/sunny_sky_17.rad""",
    fireLogs=False,
    lastRunTime=40,
    suppressWarnings=False,
    results=["""##Will control the gradient of the sky
# gensky 7 4 8:00CEST +s -a 59.9 -o 10.7
# Local solar time: 5.22
# Solar altitude and azimuth: 14.1 -111.6
# Ground ambient level: 8.8

void light solar
0
0
3 3.92e+06 3.92e+06 3.92e+06""", """##Will control the gradient of the sky
# gensky 7 4 9:00CEST +s -a 59.9 -o 10.7
# Local solar time: 6.22
# Solar altitude and azimuth: 21.4 -99.3
# Ground ambient level: 10.8

void light solar
0
0
3 5.36e+06 5.36e+06 5.36e+06""", """##Will control the gradient of the sky
# gensky 7 4 10:00CEST +s -a 59.9 -o 10.7
# Local solar time: 7.22
# Solar altitude and azimuth: 28.8 -86.4
# Ground ambient level: 12.6

void light solar
0
0
3 6.07e+06 6.07e+06 6.07e+06""", """##Will control the gradient of the sky
# gensky 7 4 11:00CEST +s -a 59.9 -o 10.7
# Local solar time: 8.22
# Solar altitude and azimuth: 36.2 -72.6
# Ground ambient level: 13.8

void light solar
0
0
3 6.48e+06 6.48e+06 6.48e+06""", """##Will control the gradient of the sky
# gensky 7 4 12:00CEST +s -a 59.9 -o 10.7
# Local solar time: 9.22
# Solar altitude and azimuth: 43.0 -56.9
# Ground ambient level: 14.6

void light solar
0
0
3 6.72e+06 6.72e+06 6.72e+06""", """##Will control the gradient of the sky
# gensky 7 4 13:00CEST +s -a 59.9 -o 10.7
# Local solar time: 10.22
# Solar altitude and azimuth: 48.6 -38.7
# Ground ambient level: 15.0

void light solar
0
0
3 6.86e+06 6.86e+06 6.86e+06""", """##Will control the gradient of the sky
# gensky 7 4 14:00CEST +s -a 59.9 -o 10.7
# Local solar time: 11.22
# Solar altitude and azimuth: 52.2 -17.7
# Ground ambient level: 15.1

void light solar
0
0
3 6.93e+06 6.93e+06 6.93e+06""", """##Will control the gradient of the sky
# gensky 7 4 15:00CEST +s -a 59.9 -o 10.7
# Local solar time: 12.22
# Solar altitude and azimuth: 53.0 5.1
# Ground ambient level: 15.2

void light solar
0
0
3 6.94e+06 6.94e+06 6.94e+06""", """##Will control the gradient of the sky
# gensky 7 4 16:00CEST +s -a 59.9 -o 10.7
# Local solar time: 13.22
# Solar altitude and azimuth: 50.9 27.3
# Ground ambient level: 15.1

void light solar
0
0
3 6.91e+06 6.91e+06 6.91e+06""", """##Will control the gradient of the sky
# gensky 7 4 17:00CEST +s -a 59.9 -o 10.7
# Local solar time: 14.22
# Solar altitude and azimuth: 46.3 47.1
# Ground ambient level: 14.8

void light solar
0
0
3 6.81e+06 6.81e+06 6.81e+06"""],
    commands=["head ~/MantaRay/TestingRemote/skies/sunny_sky_8.rad", "head ~/MantaRay/TestingRemote/skies/sunny_sky_9.rad", "head ~/MantaRay/TestingRemote/skies/sunny_sky_11.rad", "head ~/MantaRay/TestingRemote/skies/sunny_sky_10.rad", "head ~/MantaRay/TestingRemote/skies/sunny_sky_12.rad", "head ~/MantaRay/TestingRemote/skies/sunny_sky_13.rad", "head ~/MantaRay/TestingRemote/skies/sunny_sky_15.rad", "head ~/MantaRay/TestingRemote/skies/sunny_sky_14.rad", "head ~/MantaRay/TestingRemote/skies/sunny_sky_17.rad"])  # -> Stdout, Stderr_, Ran
panel_47 = Panel(executessh_20.Stdout)

falsestart_10 = LBFalseStartToggle(False)

# ----
# OCTREE (overcast)
scene_rads = Text(entwine_4)
sky_ovc_2 = Text(sky_ovc)
python_6 = GhPythonScript(x=flatten(scene_rads))  # -> noNulls; inputs x: list
# ---------- python_6: Python ----------
__author__ = "mm1013"
__version__ = "2022.06.15"

import rhinoscriptsyntax as rs

noNulls = None not in x and len(x) > 0
# ---------- end python_6 ----------
entwine_9 = Entwine(Branch01=sky_ovc_2, Branch02=scene_rads, FlattenInputs=True)  # -> flatten(Radfiles)
panel_48 = Panel("""mkdir -p octrees/
oconv -r 2048 -w -f <rads> > octrees/<target>
echo octrees/<target>""")
and_2 = GateAnd(A=python_6, B=falsestart_10)
join_5 = TextJoin(Text=entwine_9, Join=" ")
overrides_20 = ApplyOverrides(Input=panel_48, Rads=graft(join_5), Target=graft("Scene_Overcast10klux.oct"))  # -> Output, DynamicOutput
executessh_21 = ExecuteSSH(
    _SSHCommands=overrides_20.DynamicOutput,
    Run=and_2,
    addPrefix=True,
    description="""mkdir -p octrees/
oconv -r 2048 -w -f ~/MantaRay/TestFolder/skies/overcast_sky.rad ~/MantaRay/TestFolder/radFiles/Glass_70.mat /home/lio/MantaRay/TestFolder/radFiles/Glass_70_geo.rad ~/MantaRay/TestFolder/radFiles/opaque_materials.mat /home/lio/MantaRay/TestFolder/radFiles/FloorMat_70_geo.rad /home/lio/MantaRay/TestFolder/radFiles/Cladding_50_geo.rad /home/lio/MantaRay/TestFolder/radFiles/ConcreteWhite_80_geo.rad /home/lio/MantaRay/TestFolder/radFiles/ConcreteStructure_30_geo.rad /home/lio/MantaRay/TestFolder/radFiles/ConcreteGrey_50_geo.rad /home/lio/MantaRay/TestFolder/radFiles/IntWalls_90_geo.rad /home/lio/MantaRay/TestFolder/radFiles/Pipes_3_geo.rad /home/lio/MantaRay/TestFolder/radFiles/ConcreteDarker_10_geo.rad /home/lio/MantaRay/TestFolder/radFiles/Frames_60_geo.rad /home/lio/MantaRay/TestFolder/radFiles/Black_1_geo.rad /home/lio/MantaRay/TestFolder/radFiles/CurvedCeiling_80_geo.rad /home/lio/MantaRay/TestFolder/radFiles/IntWalls_80_geo.rad /home/lio/MantaRay/TestFolder/radFiles/FloorBox_75_geo.rad ~/MantaRay/TestFolder/radFiles/other_materials.mat > octrees/Scene_Overcast10klux.oct
echo octrees/Scene_Overcast10klux.oct""",
    fireLogs=True,
    lastRunTime=1574.6059,
    name="oconv Scene_Overcast10klux.oct",
    staticDescription="""mkdir -p ~/MantaRay/Andrei/octrees/
oconv -r 2048 -w -f ~/MantaRay/Andrei/skies/overcast_sky.rad ~/MantaRay/Andrei/radFiles/Glass_70.mat /home/lio/MantaRay/Andrei/radFiles/Glass_70_geo.rad ~/MantaRay/Andrei/radFiles/opaque_materials.mat /home/lio/MantaRay/Andrei/radFiles/FloorMat_0.7_geo.rad /home/lio/MantaRay/Andrei/radFiles/Cladding_0.5_geo.rad /home/lio/MantaRay/Andrei/radFiles/ConcreteWhite_0.8_geo.rad /home/lio/MantaRay/Andrei/radFiles/ConcreteStructure_0.3_geo.rad /home/lio/MantaRay/Andrei/radFiles/ConcreteGrey_0.5_geo.rad /home/lio/MantaRay/Andrei/radFiles/IntWalls_0.9_geo.rad /home/lio/MantaRay/Andrei/radFiles/Pipes_0.03_geo.rad /home/lio/MantaRay/Andrei/radFiles/ConcreteDarker_0.1_geo.rad /home/lio/MantaRay/Andrei/radFiles/Frames_0.6_geo.rad /home/lio/MantaRay/Andrei/radFiles/Black_0.01_geo.rad /home/lio/MantaRay/Andrei/radFiles/CurvedCeiling_0.8_geo.rad /home/lio/MantaRay/Andrei/radFiles/IntWalls_0.8_geo.rad /home/lio/MantaRay/Andrei/radFiles/FloorBox_0.75_geo.rad ~/MantaRay/Andrei/radFiles/other_materials.mat > ~/MantaRay/Andrei/octrees/Scene_Overcast10klux.oct
echo ~/MantaRay/Andrei/octrees/Scene_Overcast10klux.oct""",
    suppressWarnings=False,
    results="octrees/Scene_Overcast10klux.oct",
    commands="""mkdir -p octrees/
oconv -r 2048 -w -f ~/MantaRay/TestFolder/skies/overcast_sky.rad ~/MantaRay/TestFolder/radFiles/Glass_70.mat /home/lio/MantaRay/TestFolder/radFiles/Glass_70_geo.rad ~/MantaRay/TestFolder/radFiles/opaque_materials.mat /home/lio/MantaRay/TestFolder/radFiles/FloorMat_70_geo.rad /home/lio/MantaRay/TestFolder/radFiles/Cladding_50_geo.rad /home/lio/MantaRay/TestFolder/radFiles/ConcreteWhite_80_geo.rad /home/lio/MantaRay/TestFolder/radFiles/ConcreteStructure_30_geo.rad /home/lio/MantaRay/TestFolder/radFiles/ConcreteGrey_50_geo.rad /home/lio/MantaRay/TestFolder/radFiles/IntWalls_90_geo.rad /home/lio/MantaRay/TestFolder/radFiles/Pipes_3_geo.rad /home/lio/MantaRay/TestFolder/radFiles/ConcreteDarker_10_geo.rad /home/lio/MantaRay/TestFolder/radFiles/Frames_60_geo.rad /home/lio/MantaRay/TestFolder/radFiles/Black_1_geo.rad /home/lio/MantaRay/TestFolder/radFiles/CurvedCeiling_80_geo.rad /home/lio/MantaRay/TestFolder/radFiles/IntWalls_80_geo.rad /home/lio/MantaRay/TestFolder/radFiles/FloorBox_75_geo.rad ~/MantaRay/TestFolder/radFiles/other_materials.mat > octrees/Scene_Overcast10klux.oct
echo octrees/Scene_Overcast10klux.oct""")  # -> Stdout, Stderr_, Ran
panel_49 = Panel(overrides_20.Output)
panel_50 = Panel(executessh_21.Stderr_)
octree_overcast = Text(executessh_21.Stdout)

# ----
# OCTREE (Sunny - 10 hourly skies!)
scene_rads_2 = Text(entwine_4)
falsestart_11 = LBFalseStartToggle(False)
entwine_10 = Entwine(Branch02=scene_rads_2, FlattenInputs=True)  # -> flatten(Radfiles)
python_7 = GhPythonScript(x=flatten(scene_rads_2))  # -> a; inputs x: list
# ---------- python_7: Python ----------
__author__ = "mm1013"
__version__ = "2022.06.15"

import rhinoscriptsyntax as rs

a = None not in x
# ---------- end python_7 ----------
panel_51 = Panel("""cd <proj>
mkdir -p octrees/
oconv -r 2048 -f -w <rads> > octrees/<target>
echo octrees/<target>""")
join_6 = TextJoin(Text=entwine_10, Join=" ")
overrides_21 = ApplyOverrides(Input=panel_51, Rads=graft(join_6), Target=graft("my_test_scene_NOSKY.oct"))  # -> Output, DynamicOutput
panel_52 = Panel("""cd <proj>
oconv -r 2048 -i <oldOct> -f <newRads> > octrees/<target>_<h>.oct;echo octrees/<target>_<h>.oct""")
executessh_22 = ExecuteSSH(
    _SSHCommands_=overrides_21.DynamicOutput,
    Run=[python_7, falsestart_11],
    addPrefix=True,
    description="""cd ~/MantaRay/TestFolder
mkdir -p octrees/
oconv -r 2048 -f -w ~/MantaRay/TestFolder/radFiles/Glass_70.mat /home/lio/MantaRay/TestFolder/radFiles/Glass_70_geo.rad ~/MantaRay/TestFolder/radFiles/opaque_materials.mat /home/lio/MantaRay/TestFolder/radFiles/FloorMat_70_geo.rad /home/lio/MantaRay/TestFolder/radFiles/Cladding_50_geo.rad /home/lio/MantaRay/TestFolder/radFiles/ConcreteWhite_80_geo.rad /home/lio/MantaRay/TestFolder/radFiles/ConcreteStructure_30_geo.rad /home/lio/MantaRay/TestFolder/radFiles/ConcreteGrey_50_geo.rad /home/lio/MantaRay/TestFolder/radFiles/IntWalls_90_geo.rad /home/lio/MantaRay/TestFolder/radFiles/Pipes_3_geo.rad /home/lio/MantaRay/TestFolder/radFiles/ConcreteDarker_10_geo.rad /home/lio/MantaRay/TestFolder/radFiles/Frames_60_geo.rad /home/lio/MantaRay/TestFolder/radFiles/Black_1_geo.rad /home/lio/MantaRay/TestFolder/radFiles/CurvedCeiling_80_geo.rad /home/lio/MantaRay/TestFolder/radFiles/IntWalls_80_geo.rad /home/lio/MantaRay/TestFolder/radFiles/FloorBox_75_geo.rad ~/MantaRay/TestFolder/radFiles/other_materials.mat > octrees/my_test_scene_NOSKY.oct
echo octrees/my_test_scene_NOSKY.oct""",
    fireLogs=False,
    lastRunTime=1581.0624,
    suppressWarnings=False,
    results="octrees/my_test_scene_NOSKY.oct",
    commands="""cd ~/MantaRay/TestFolder
mkdir -p octrees/
oconv -r 2048 -f -w ~/MantaRay/TestFolder/radFiles/Glass_70.mat /home/lio/MantaRay/TestFolder/radFiles/Glass_70_geo.rad ~/MantaRay/TestFolder/radFiles/opaque_materials.mat /home/lio/MantaRay/TestFolder/radFiles/FloorMat_70_geo.rad /home/lio/MantaRay/TestFolder/radFiles/Cladding_50_geo.rad /home/lio/MantaRay/TestFolder/radFiles/ConcreteWhite_80_geo.rad /home/lio/MantaRay/TestFolder/radFiles/ConcreteStructure_30_geo.rad /home/lio/MantaRay/TestFolder/radFiles/ConcreteGrey_50_geo.rad /home/lio/MantaRay/TestFolder/radFiles/IntWalls_90_geo.rad /home/lio/MantaRay/TestFolder/radFiles/Pipes_3_geo.rad /home/lio/MantaRay/TestFolder/radFiles/ConcreteDarker_10_geo.rad /home/lio/MantaRay/TestFolder/radFiles/Frames_60_geo.rad /home/lio/MantaRay/TestFolder/radFiles/Black_1_geo.rad /home/lio/MantaRay/TestFolder/radFiles/CurvedCeiling_80_geo.rad /home/lio/MantaRay/TestFolder/radFiles/IntWalls_80_geo.rad /home/lio/MantaRay/TestFolder/radFiles/FloorBox_75_geo.rad ~/MantaRay/TestFolder/radFiles/other_materials.mat > octrees/my_test_scene_NOSKY.oct
echo octrees/my_test_scene_NOSKY.oct""")  # -> Stdout, Stderr_, Ran
hours_3 = Text(hours_2)
sky_sunny = Text(graft(item.Item1))
panel_53 = Panel(executessh_22.Stdout)
overrides_22 = ApplyOverrides(
    Input=panel_52,
    OldOct=graft(executessh_22.Stdout),
    NewRads=graft(sky_sunny),
    Target=graft("my_test_scene"),
    H=graft(hours_3))  # -> Output, DynamicOutput
executessh_23 = ExecuteSSH(
    _SSHCommands_=overrides_22.DynamicOutput,
    Run=executessh_22.Ran,
    addPrefix=True,
    description="""cd ~/MantaRay/TestFolder
oconv -r 2048 -i octrees/my_test_scene_NOSKY.oct -f ~/MantaRay/TestingRemote/skies/sunny_sky_8.rad > octrees/my_test_scene_0800.oct;echo octrees/my_test_scene_0800.oct


- - -

cd ~/MantaRay/TestFolder
oconv -r 2048 -i octrees/my_test_scene_NOSKY.oct -f ~/MantaRay/TestingRemote/skies/sunny_sky_9.rad > octrees/my_test_scene_0900.oct;echo octrees/my_test_scene_0900.oct


- - -

cd ~/MantaRay/TestFolder
oconv -r 2048 -i octrees/my_test_scene_NOSKY.oct -f ~/MantaRay/TestingRemote/skies/sunny_sky_10.rad > octrees/my_test_scene_1000.oct;echo octrees/my_test_scene_1000.oct


- - -

cd ~/MantaRay/TestFolder
oconv -r 2048 -i octrees/my_test_scene_NOSKY.oct -f ~/MantaRay/TestingRemote/skies/sunny_sky_11.rad > octrees/my_test_scene_1100.oct;echo octrees/my_test_scene_1100.oct


- - -

cd ~/MantaRay/TestFolder
oconv -r 2048 -i octrees/my_test_scene_NOSKY.oct -f ~/MantaRay/TestingRemote/skies/sunny_sky_12.rad > octrees/my_test_scene_1200.oct;echo octrees/my_test_scene_1200.oct


- - -

cd ~/MantaRay/TestFolder
oconv -r 2048 -i octrees/my_test_scene_NOSKY.oct -f ~/MantaRay/TestingRemote/skies/sunny_sky_13.rad > octrees/my_test_scene_1300.oct;echo octrees/my_test_scene_1300.oct


- - -

cd ~/MantaRay/TestFolder
oconv -r 2048 -i octrees/my_test_scene_NOSKY.oct -f ~/MantaRay/TestingRemote/skies/sunny_sky_14.rad > octrees/my_test_scene_1400.oct;echo octrees/my_test_scene_1400.oct


- - -

cd ~/MantaRay/TestFolder
oconv -r 2048 -i octrees/my_test_scene_NOSKY.oct -f ~/MantaRay/TestingRemote/skies/sunny_sky_15.rad > octrees/my_test_scene_1500.oct;echo octrees/my_test_scene_1500.oct


- - -

cd ~/MantaRay/TestFolder
oconv -r 2048 -i octrees/my_test_scene_NOSKY.oct -f ~/MantaRay/TestingRemote/skies/sunny_sky_16.rad > octrees/my_test_scene_1600.oct;echo octrees/my_test_scene_1600.oct


- - -

cd ~/MantaRay/TestFolder
oconv -r 2048 -i octrees/my_test_scene_NOSKY.oct -f ~/MantaRay/TestingRemote/skies/sunny_sky_17.rad > octrees/my_test_scene_1700.oct;echo octrees/my_test_scene_1700.oct""",
    fireLogs=False,
    lastRunTime=704.3619,
    suppressWarnings=False,
    results=["octrees/my_test_scene_0800.oct", "octrees/my_test_scene_0900.oct", "octrees/my_test_scene_1000.oct", "octrees/my_test_scene_1100.oct", "octrees/my_test_scene_1200.oct", "octrees/my_test_scene_1300.oct", "octrees/my_test_scene_1400.oct", "octrees/my_test_scene_1500.oct", "octrees/my_test_scene_1600.oct", "octrees/my_test_scene_1700.oct"],
    commands=["""cd ~/MantaRay/TestFolder
oconv -r 2048 -i octrees/my_test_scene_NOSKY.oct -f ~/MantaRay/TestingRemote/skies/sunny_sky_9.rad > octrees/my_test_scene_0900.oct;echo octrees/my_test_scene_0900.oct""", """cd ~/MantaRay/TestFolder
oconv -r 2048 -i octrees/my_test_scene_NOSKY.oct -f ~/MantaRay/TestingRemote/skies/sunny_sky_8.rad > octrees/my_test_scene_0800.oct;echo octrees/my_test_scene_0800.oct""", """cd ~/MantaRay/TestFolder
oconv -r 2048 -i octrees/my_test_scene_NOSKY.oct -f ~/MantaRay/TestingRemote/skies/sunny_sky_10.rad > octrees/my_test_scene_1000.oct;echo octrees/my_test_scene_1000.oct""", """cd ~/MantaRay/TestFolder
oconv -r 2048 -i octrees/my_test_scene_NOSKY.oct -f ~/MantaRay/TestingRemote/skies/sunny_sky_12.rad > octrees/my_test_scene_1200.oct;echo octrees/my_test_scene_1200.oct""", """cd ~/MantaRay/TestFolder
oconv -r 2048 -i octrees/my_test_scene_NOSKY.oct -f ~/MantaRay/TestingRemote/skies/sunny_sky_11.rad > octrees/my_test_scene_1100.oct;echo octrees/my_test_scene_1100.oct""", """cd ~/MantaRay/TestFolder
oconv -r 2048 -i octrees/my_test_scene_NOSKY.oct -f ~/MantaRay/TestingRemote/skies/sunny_sky_13.rad > octrees/my_test_scene_1300.oct;echo octrees/my_test_scene_1300.oct""", """cd ~/MantaRay/TestFolder
oconv -r 2048 -i octrees/my_test_scene_NOSKY.oct -f ~/MantaRay/TestingRemote/skies/sunny_sky_14.rad > octrees/my_test_scene_1400.oct;echo octrees/my_test_scene_1400.oct""", """cd ~/MantaRay/TestFolder
oconv -r 2048 -i octrees/my_test_scene_NOSKY.oct -f ~/MantaRay/TestingRemote/skies/sunny_sky_15.rad > octrees/my_test_scene_1500.oct;echo octrees/my_test_scene_1500.oct""", """cd ~/MantaRay/TestFolder
oconv -r 2048 -i octrees/my_test_scene_NOSKY.oct -f ~/MantaRay/TestingRemote/skies/sunny_sky_17.rad > octrees/my_test_scene_1700.oct;echo octrees/my_test_scene_1700.oct""", """cd ~/MantaRay/TestFolder
oconv -r 2048 -i octrees/my_test_scene_NOSKY.oct -f ~/MantaRay/TestingRemote/skies/sunny_sky_16.rad > octrees/my_test_scene_1600.oct;echo octrees/my_test_scene_1600.oct"""])  # -> Stdout, Stderr_, Ran

view = CreateView(Viewport="Perspective")  # -> ViewfileContent, ImageRatio
panel_54 = Panel("""mkdir -p <proj>/views/
echo "<vf>" > <proj>/views/<target>.vf
echo <proj>/views/<target>.vf""")
concat_3 = Concatenate(FragmentA="Perspective", FragmentB="3")
vf = Text(view.ViewfileContent)
panel_55 = Panel(view.ViewfileContent)
overrides_23 = ApplyOverrides(Input=panel_54, Vf=graft(vf), Target=graft(concat_3))  # -> Output, DynamicOutput
executessh_24 = ExecuteSSH(
    _SSHCommands_=overrides_23.DynamicOutput,
    Run=Toggle(True),
    addPrefix=True,
    description="""mkdir -p ~/MantaRay/TestFolder/views/
echo "rvu -vtv -vp 76.210958985352 16.4300937305602 1.83584927923156 -vd -0.349680913647465 0.927360836447747 0.133135786524922 -vu 0.0469732080515546 -0.124573895254805 0.991097806649975 -vh 103.484 -vv 50.000" > ~/MantaRay/TestFolder/views/Perspective3.vf
echo ~/MantaRay/TestFolder/views/Perspective3.vf""",
    fireLogs=False,
    lastRunTime=111.1801,
    suppressWarnings=False,
    results="/home/lio/MantaRay/TestFolder/views/Perspective3.vf",
    commands="""mkdir -p ~/MantaRay/TestFolder/views/
echo "rvu -vtv -vp 76.210958985352 16.4300937305602 1.83584927923156 -vd -0.349680913647465 0.927360836447747 0.133135786524922 -vu 0.0469732080515546 -0.124573895254805 0.991097806649975 -vh 103.484 -vv 50.000" > ~/MantaRay/TestFolder/views/Perspective3.vf
echo ~/MantaRay/TestFolder/views/Perspective3.vf""")  # -> Stdout, Stderr_, Ran
viewname = Text(concat_3)

# ----
# img size
target_res = ValueList({"750x330": 750, "1500x750": 1500, "3000x1500": 3000, "5000x2500": 5000, "7000x3500": 7000, "8000x4000": 8000}, selected="750x330")
division = Division(A=target_res, B=2)
x = RemoteSender(target_res)
y = RemoteSender(division)

view_2 = CreateView(Viewport="Perspective")  # -> ViewfileContent, ImageRatio
panel_56 = Panel("""mkdir -p views/
echo "<vf>" > views/<target>.vf
echo views/<target>.vf""")
panel_57 = Panel(view_2.ViewfileContent)
concat_4 = Concatenate(FragmentA="Perspective", FragmentB="2")
vf_2 = Text(view_2.ViewfileContent)
overrides_24 = ApplyOverrides(Input=panel_56, Vf=graft(vf_2), Target=graft(concat_4))  # -> Output, DynamicOutput
executessh_25 = ExecuteSSH(
    _SSHCommands_=overrides_24.DynamicOutput,
    Run=Toggle(True),
    addPrefix=True,
    description="""mkdir -p views/
echo "rvu -vtv -vp 76.210958985352 16.4300937305602 1.83584927923156 -vd -0.349680913647465 0.927360836447747 0.133135786524922 -vu 0.0469732080515546 -0.124573895254805 0.991097806649975 -vh 103.484 -vv 50.000" > views/Perspective2.vf
echo views/Perspective2.vf""",
    fireLogs=False,
    lastRunTime=138.6182,
    suppressWarnings=False,
    results="views/Perspective2.vf",
    commands="""mkdir -p views/
echo "rvu -vtv -vp 76.210958985352 16.4300937305602 1.83584927923156 -vd -0.349680913647465 0.927360836447747 0.133135786524922 -vu 0.0469732080515546 -0.124573895254805 0.991097806649975 -vh 103.484 -vv 50.000" > views/Perspective2.vf
echo views/Perspective2.vf""")  # -> Stdout, Stderr_, Ran
viewname_2 = Text(concat_4)

# ----
# Set focus zone to RAD
# to calculate parameters
type = ValueList({"Interior": "I", "Exterior": "E"}, selected="Exterior")
zone = Box({Plane=PlaneXY(67.34687306, 14.8177948, 0), X=Domain(0, 14.49025655), Y=Domain(0, 18.20965901), Z=Domain(0, 13.53214381)})
zone_2 = GhPythonScript(zoneBox=zone, type=type)  # -> out, zone; inputs zoneBox: Box
# ---------- zone_2: Python ----------
__author__ = "mm1013"
__version__ = "2022.10.06"

import rhinoscriptsyntax as rs
import Rhino.Geometry as rg

import Grasshopper.Kernel as gh

#e = gh.GH_RuntimeMessageLevel.Error
w = gh.GH_RuntimeMessageLevel.Warning

zone =""

testPlane = rg.Plane(rg.Point3d(0,0,0), zoneBox.Plane.XAxis, zoneBox.Plane.YAxis)
if testPlane != rg.Plane.WorldXY:
    ghenv.Component.AddRuntimeMessage(w, "Bounding box must have XY as base plane")
else:
    zone = "ZONE={type} {Xmin:.2f} {Xmax:.2f} {Ymin:.2f} {Ymax:.2f} {Zmin:.2f} {Zmax:.2f}\n".format( \
    type=type, Xmin = zoneBox.X.Min, Xmax = zoneBox.X.Max, Ymin = zoneBox.Y.Min, Ymax = zoneBox.Y.Max, Zmin = zoneBox.Z.Min, Zmax = zoneBox.Z.Max)
# ---------- end zone_2 ----------

panel_58 = Panel("~/MantaRay/Andrei/images/2023_03_12_2232_rtpict_rendering_aa0_5000_sunny_ad32_0/radiance.hdr")

resolution = ValueList({"750x330": 750, "1500x750": 1500, "3000x1500": 3000, "5000x2500": 5000, "7000x3500": 7000, "8000x4000": 8000, "16000x8000": 16000, "20000x12000": 20000}, selected="750x330")
x_2 = Number(resolution)

falsestart_12 = LBFalseStartToggle(False)
download_5 = Download(SftpPaths=panel_58, Run=falsestart_12, stdouts="C:\Users\mm1013\MantaRay\Andrei\radiance.hdr")  # -> FilePaths, Status, Ran
supersampling = Panel("4")

# ----
# Parallel RTRACE render
# with ambient cache - with error log
run_2 = LBFalseStartToggle(True)
octree = Text(executessh_21.Stdout)
viewfile = Text(executessh_25.Stdout)
panel_59 = Panel("""mkdir -p images/
mkdir -p ambientFiles/
vwrays -ff -x 300 -y 300 -vf <vf> -pa 1 | rtrace <radOptions> -af ambientFiles/<af> -w -n <cpus> `vwrays -d -ff -x 300 -y 300 -vf <vf> -pa 1` -ffc -e ambientFiles/<target-.>_ot.err <oct> > /dev/null
vwrays -ff -x <x> -y <y> -vf <vf> -pa 1 | rtrace <radOptions> -af ambientFiles/<af> -w -n <cpus> `vwrays -d -ff -x <x> -y <y> -vf <vf> -pa 1` -ffc -e ambientFiles/<target-.>.err <oct> > images/<target-.>.hdr
echo images/<target-.>.hdr""")
python_8 = GhPythonScript(x=viewfile)  # -> a
# ---------- python_8: Python ----------
__author__ = "mm1013"
__version__ = "2022.09.13"

import rhinoscriptsyntax as rs

a = x.split("/")[-1].split(".")[0]
# ---------- end python_8 ----------
panel_60 = Panel("<time>_<view>_render.hdr")
panel_61 = Panel("-ar 512 -as 128 -ab 2 -aa 0.2 -ad 4096")
overrides_25 = ApplyOverrides(
    Input=panel_59,
    X=graft("<x>"),
    Y=graft("<y>"),
    Vf=graft("<vf>"),
    RadOptions=graft(panel_61),
    Oct=graft(octree),
    Af=graft("<af>"),
    Time=graft("<time>"),
    View=graft("<view>"))  # -> Output, DynamicOutput
python_9 = GhPythonScript(update=overrides_25.Output)  # -> time; inputs update: tree
# ---------- python_9: Python ----------
#if not update:
#    return self.time
"""Provides a scripting component.
    Inputs:
        x: The x script variable
        y: The y script variable
    Output:
        a: The a output variable"""
        
__author__ = "mm1013"
__version__ = "2022.08.30"
        
import rhinoscriptsyntax as rs
        
from datetime import datetime
dt = datetime.now()
        
time = "%02d_%02d_%02d_%02d%02d_%02d" % (dt.year, dt.month, dt.day, dt.hour, dt.minute, dt.second)
# ---------- end python_9 ----------
x_3 = RemoteReceiver(x)
y_2 = RemoteReceiver(y)
overrides_26 = ApplyOverrides(
    Input=overrides_25.DynamicOutput,
    time=graft(python_9),
    view=graft(viewname_2),
    vf=graft(executessh_25.Stdout),
    af=graft("ambfile2_<time>.af"),
    x=graft(x_3),
    y=graft(y_2),
    target=graft(panel_60))  # -> Output, DynamicOutput
falsestart_13 = LBFalseStartToggle(False)
executessh_26 = ExecuteSSH(
    _SSHCommands_=overrides_26.DynamicOutput,
    Run=run_2,
    addPrefix=True,
    description="""mkdir -p images/
mkdir -p ambientFiles/
vwrays -ff -x 300 -y 300 -vf views/Perspective2.vf -pa 1 | rtrace -ar 512 -as 128 -ab 2 -aa 0.2 -ad 4096 -af ambientFiles/ambfile2_2023_03_31_2208_54.af -w -n 63 `vwrays -d -ff -x 300 -y 300 -vf views/Perspective2.vf -pa 1` -ffc -e ambientFiles/2023_03_31_2208_54_Perspective2_render.hdr_ot.err octrees/Scene_Overcast10klux.oct > /dev/null
vwrays -ff -x 750 -y 375 -vf views/Perspective2.vf -pa 1 | rtrace -ar 512 -as 128 -ab 2 -aa 0.2 -ad 4096 -af ambientFiles/ambfile2_2023_03_31_2208_54.af -w -n 63 `vwrays -d -ff -x 750 -y 375 -vf views/Perspective2.vf -pa 1` -ffc -e ambientFiles/2023_03_31_2208_54_Perspective2_render.hdr.err octrees/Scene_Overcast10klux.oct > images/2023_03_31_2208_54_Perspective2_render.hdr.hdr
echo images/2023_03_31_2208_54_Perspective2_render.hdr.hdr""",
    fireLogs=False,
    lastRunTime=139786.2498,
    suppressWarnings=False,
    results="images/2023_03_31_2208_54_Perspective2_render.hdr.hdr",
    commands="""mkdir -p images/
mkdir -p ambientFiles/
vwrays -ff -x 300 -y 300 -vf views/Perspective2.vf -pa 1 | rtrace -ar 512 -as 128 -ab 2 -aa 0.2 -ad 4096 -af ambientFiles/ambfile2_2023_03_31_2208_54.af -w -n 63 `vwrays -d -ff -x 300 -y 300 -vf views/Perspective2.vf -pa 1` -ffc -e ambientFiles/2023_03_31_2208_54_Perspective2_render.hdr_ot.err octrees/Scene_Overcast10klux.oct > /dev/null
vwrays -ff -x 750 -y 375 -vf views/Perspective2.vf -pa 1 | rtrace -ar 512 -as 128 -ab 2 -aa 0.2 -ad 4096 -af ambientFiles/ambfile2_2023_03_31_2208_54.af -w -n 63 `vwrays -d -ff -x 750 -y 375 -vf views/Perspective2.vf -pa 1` -ffc -e ambientFiles/2023_03_31_2208_54_Perspective2_render.hdr.err octrees/Scene_Overcast10klux.oct > images/2023_03_31_2208_54_Perspective2_render.hdr.hdr
echo images/2023_03_31_2208_54_Perspective2_render.hdr.hdr""")  # -> Stdout, Stderr_, Ran
or = GateOr(A=falsestart_13, B=executessh_26.Ran)

# ----
# Parallel RTRACE render (illuminance)
# with ambient cache (reusing file from above!)
panel_62 = Panel("""mkdir -p images/
mkdir -p ambientFiles/
vwrays -ff -x <x> -y <y> -vf <vf> -pa 1 | rtrace -i <radOptions> -af ambientFiles/<af> -w -n <cpus> `vwrays -d -ff -x <x> -y <y> -vf <vf> -pa 1` -ffc <oct> > images/<target-.>.hdr
echo images/<target-.>.hdr""")
octree_2 = Text(executessh_21.Stdout)
viewfile_2 = Text(executessh_25.Stdout)
run_3 = LBFalseStartToggle(True)
python_10 = GhPythonScript(x=viewfile_2)  # -> a; same code as python_8
overrides_27 = ApplyOverrides(
    Input=panel_62,
    X=graft("<x>"),
    Y=graft("<y>"),
    Vf=graft(viewfile_2),
    RadOptions=graft(panel_61),
    Oct=graft(octree_2),
    Af=graft("<af>"),
    View=graft(python_10),
    Time=graft("<time>"))  # -> Output, DynamicOutput
x_4 = RemoteReceiver(x)
y_3 = RemoteReceiver(y)
overrides_28 = ApplyOverrides(
    Input=overrides_27.DynamicOutput,
    time=graft(python_9),
    view=graft(viewname_2),
    vf=graft(executessh_25.Stdout),
    af=graft("ambfile2_<time>.af"),
    target=graft("<time>_<view>_render_illum.hdr"),
    x=graft(x_4),
    y=graft(y_3))  # -> Output, DynamicOutput
executessh_27 = ExecuteSSH(
    _SSHCommands_=overrides_28.DynamicOutput,
    Run=run_3,
    addPrefix=True,
    description="""mkdir -p images/
mkdir -p ambientFiles/
vwrays -ff -x 750 -y 375 -vf views/Perspective2.vf -pa 1 | rtrace -i -ar 512 -as 128 -ab 2 -aa 0.2 -ad 4096 -af ambientFiles/ambfile2_2023_03_31_2208_54.af -w -n 63 `vwrays -d -ff -x 750 -y 375 -vf views/Perspective2.vf -pa 1` -ffc octrees/Scene_Overcast10klux.oct > images/2023_03_31_2208_54_Perspective2_render_illum.hdr.hdr
echo images/2023_03_31_2208_54_Perspective2_render_illum.hdr.hdr""",
    fireLogs=False,
    lastRunTime=6614.4253,
    suppressWarnings=False,
    results="images/2023_03_31_2208_54_Perspective2_render_illum.hdr.hdr",
    commands="""mkdir -p images/
mkdir -p ambientFiles/
vwrays -ff -x 750 -y 375 -vf views/Perspective2.vf -pa 1 | rtrace -i -ar 512 -as 128 -ab 2 -aa 0.2 -ad 4096 -af ambientFiles/ambfile2_2023_03_31_2208_54.af -w -n 63 `vwrays -d -ff -x 750 -y 375 -vf views/Perspective2.vf -pa 1` -ffc octrees/Scene_Overcast10klux.oct > images/2023_03_31_2208_54_Perspective2_render_illum.hdr.hdr
echo images/2023_03_31_2208_54_Perspective2_render_illum.hdr.hdr""")  # -> Stdout, Stderr_, Ran

y_4 = RemoteReceiver(y)
x_5 = RemoteReceiver(x)
multiplication = Multiplication(A=x_5, B=supersampling)
multiplication_2 = Multiplication(A=y_4, B=supersampling)
panel_63 = Panel(overrides_26.Output)

# ----
# attempt to do overcast discretized sky (rtcontrib tutorial p20)
panel_64 = Panel("gensky 3 21 10 -c -a 51 -o 0 -m 0 -b 22.86")  # disabled
falsestart_14 = LBFalseStartToggle(False)  # disabled
panel_65 = Panel("""gensky 3 21 10 -c -a 51 -o 0 -m 0 -b 22.86 \
|rcalc -i '3 2 <zenithbr> <groundbr>' \
-e '$1=<groundbr>'""")  # disabled
executessh_28 = ExecuteSSH(
    _SSHCommands_=panel_64,
    Run=falsestart_14,
    addPrefix=True,
    fireLogs=False,
    lastRunTime=76.3352,
    suppressWarnings=False,
    results="""# gensky 3 21 10 -c -a 51 -o 0 -m 0 -b 22.86
# Local solar time: 9.88
# Solar altitude and azimuth: 31.9 -38.5
# Ground ambient level: 17.8

void brightfunc skyfunc
2 skybr skybright.cal
0
3 2 2.29e+01 3.56e+00""",
    commands="gensky 3 21 10 -c -a 51 -o 0 -m 0 -b 22.86")  # -> Stdout, Stderr_, Ran; disabled
python_11 = GhPythonScript(x=executessh_28.Stdout)  # -> a; disabled
# ---------- python_11: Python ----------
__author__ = "mm1013"
__version__ = "2022.09.27"

import rhinoscriptsyntax as rs

a = float(x.split("\n")[3].split(" ")[-1])
# ---------- end python_11 ----------
python_12 = GhPythonScript(x=executessh_28.Stdout)  # -> a; disabled
# ---------- python_12: Python ----------
__author__ = "mm1013"
__version__ = "2022.09.27"

import rhinoscriptsyntax as rs

a = float(x.split(" ")[-2])
# ---------- end python_12 ----------
panel_66 = Panel(executessh_28.Stdout)  # disabled
overrides_29 = ApplyOverrides(Input=panel_65, Zenithbr=graft(python_12), Groundbr=graft(python_11))  # -> Output, DynamicOutput; disabled
executessh_29 = ExecuteSSH(
    _SSHCommands_=overrides_29.Output,
    Run=executessh_28.Ran,
    addPrefix=True,
    fireLogs=False,
    lastRunTime=62.9233,
    suppressWarnings=False,
    stderr="3 2 22.9 17.8: cannot open",
    commands="""gensky 3 21 10 -c -a 51 -o 0 -m 0 -b 22.86 \
|rcalc -i '3 2 22.9 17.8' \
-e '$1=17.8'""")  # -> Stdout, Stderr_, Ran; disabled
panel_67 = Panel(executessh_29.Stderr_)  # disabled

panel_68 = Panel("""pkill rtpict
pkill rtrace
pkill rpict""")
executessh_30 = ExecuteSSH(
    _SSHCommands_=panel_68,
    Run=Button(),
    addPrefix=True,
    fireLogs=False,
    lastRunTime=65.4618,
    suppressWarnings=False,
    commands="""pkill rtpict
pkill rtrace
pkill rpict""")  # -> Stdout, Stderr_, Ran

panel_69 = Panel("""pfilt -e -1 <hdr> > <hdr-.>_exposed2.hdr
ra_tiff <hdr-.>_exposed2.hdr <hdr-.>_exposed2.tif
convert <hdr-.>_exposed2.tif <hdr-.>_exposed2.png
echo <hdr-.>_exposed2.png""")
logviewer_2 = LogViewer(Number=10)  # -> CurrentTasks, Logs

# ----
# False color with illuminance curves
# on top of luminance picture
panel_70 = Panel("falsecolor -s 0.1 -n 10 -m 1.79 -l DF -p <irrad> -i <irrad> -cp > <irrad-.>_fc4.hdr;echo <irrad-.>_fc4.hdr")
overrides_30 = ApplyOverrides(Input=panel_70, Irrad=graft(executessh_27.Stdout))  # -> Output, DynamicOutput
executessh_31 = ExecuteSSH(
    _SSHCommands_=overrides_30.DynamicOutput,
    Run=executessh_27.Ran,
    addPrefix=True,
    description="falsecolor -s 0.1 -n 10 -m 1.79 -l DF -p images/2023_03_31_2208_54_Perspective2_render_illum.hdr.hdr -i images/2023_03_31_2208_54_Perspective2_render_illum.hdr.hdr -cp > images/2023_03_31_2208_54_Perspective2_render_illum.hdr_fc4.hdr;echo images/2023_03_31_2208_54_Perspective2_render_illum.hdr_fc4.hdr",
    fireLogs=False,
    lastRunTime=573.7751,
    suppressWarnings=False,
    results="images/2023_03_31_2208_54_Perspective2_render_illum.hdr_fc4.hdr",
    commands="falsecolor -s 0.1 -n 10 -m 1.79 -l DF -p images/2023_03_31_2208_54_Perspective2_render_illum.hdr.hdr -i images/2023_03_31_2208_54_Perspective2_render_illum.hdr.hdr -cp > images/2023_03_31_2208_54_Perspective2_render_illum.hdr_fc4.hdr;echo images/2023_03_31_2208_54_Perspective2_render_illum.hdr_fc4.hdr")  # -> Stdout, Stderr_, Ran
download_6 = Download(
    LinuxFilePaths=executessh_31.Stdout,
    Run=executessh_31.Ran,
    stdouts="C:\Users\mm1013\MantaRay\TestFolder\2023_03_31_2208_54_Perspective2_render_illum.hdr_fc4.hdr")  # -> FilePaths, Status, Ran
imageviewer_2 = LBImageViewer(ImagePath_=download_6.FilePaths, _scale_="1", DisableClickable=False, SaveImgWithCoords=False, scale=1)  # -> ImagePath, Values, GIF

# ----
# Using PCOND to set automatic exposure
# and convert to PNG
no_auto_exposure = Panel("""pfilt -1 -e +4 <hdr> > <hdr-.>_exposed2.hdr
ra_tiff <hdr-.>_exposed2.hdr <hdr-.>_exposed2.tif
convert <hdr-.>_exposed2.tif <hdr-.>_exposed2.png
echo <hdr-.>_exposed2.png""")
panel_71 = Panel("""pcond -h <hdr> <hdr-.>_exposed.hdr
ra_tiff <hdr-.>_exposed.hdr <hdr-.>_exposed.tif
convert <hdr-.>_exposed.tif <hdr-.>_exposed.png
echo <hdr-.>_exposed.png""")
overrides_31 = ApplyOverrides(Input=[no_auto_exposure, panel_71], Hdr=graft(executessh_26.Stdout))  # -> Output, DynamicOutput
executessh_32 = ExecuteSSH(
    _SSHCommands_=overrides_31.DynamicOutput,
    Run=or,
    addPrefix=True,
    description="""pfilt -1 -e +4 images/2023_03_31_2208_54_Perspective2_render.hdr.hdr > images/2023_03_31_2208_54_Perspective2_render.hdr_exposed2.hdr
ra_tiff images/2023_03_31_2208_54_Perspective2_render.hdr_exposed2.hdr images/2023_03_31_2208_54_Perspective2_render.hdr_exposed2.tif
convert images/2023_03_31_2208_54_Perspective2_render.hdr_exposed2.tif images/2023_03_31_2208_54_Perspective2_render.hdr_exposed2.png
echo images/2023_03_31_2208_54_Perspective2_render.hdr_exposed2.png
pcond -h images/2023_03_31_2208_54_Perspective2_render.hdr.hdr images/2023_03_31_2208_54_Perspective2_render.hdr_exposed.hdr
ra_tiff images/2023_03_31_2208_54_Perspective2_render.hdr_exposed.hdr images/2023_03_31_2208_54_Perspective2_render.hdr_exposed.tif
convert images/2023_03_31_2208_54_Perspective2_render.hdr_exposed.tif images/2023_03_31_2208_54_Perspective2_render.hdr_exposed.png
echo images/2023_03_31_2208_54_Perspective2_render.hdr_exposed.png""",
    fireLogs=False,
    lastRunTime=64.8426,
    suppressWarnings=False,
    results="""images/2023_03_31_2208_54_Perspective2_render.hdr_exposed2.png
_JOIN_
images/2023_03_31_2208_54_Perspective2_render.hdr_exposed.png""",
    commands="""pfilt -1 -e +4 images/2023_03_31_2208_54_Perspective2_render.hdr.hdr > images/2023_03_31_2208_54_Perspective2_render.hdr_exposed2.hdr
ra_tiff images/2023_03_31_2208_54_Perspective2_render.hdr_exposed2.hdr images/2023_03_31_2208_54_Perspective2_render.hdr_exposed2.tif
convert images/2023_03_31_2208_54_Perspective2_render.hdr_exposed2.tif images/2023_03_31_2208_54_Perspective2_render.hdr_exposed2.png
echo images/2023_03_31_2208_54_Perspective2_render.hdr_exposed2.png
_JOIN_
pcond -h images/2023_03_31_2208_54_Perspective2_render.hdr.hdr images/2023_03_31_2208_54_Perspective2_render.hdr_exposed.hdr
ra_tiff images/2023_03_31_2208_54_Perspective2_render.hdr_exposed.hdr images/2023_03_31_2208_54_Perspective2_render.hdr_exposed.tif
convert images/2023_03_31_2208_54_Perspective2_render.hdr_exposed.tif images/2023_03_31_2208_54_Perspective2_render.hdr_exposed.png
echo images/2023_03_31_2208_54_Perspective2_render.hdr_exposed.png""")  # -> Stdout, Stderr_, Ran
download_7 = Download(
    LinuxFilePaths=executessh_32.Stdout,
    Run=executessh_32.Ran,
    stdouts="C:\Users\mm1013\MantaRay\TestFolder\2023_03_31_2208_54_Perspective2_render.hdr_exposed2.png>JOIN<C:\Users\mm1013\MantaRay\TestFolder\2023_03_31_2208_54_Perspective2_render.hdr_exposed.png")  # -> FilePaths, Status, Ran
imageviewer_3 = LBImageViewer(ImagePath_=download_7.FilePaths, _scale_="1", DisableClickable=False, SaveImgWithCoords=False, scale=1)  # -> ImagePath, Values, GIF

# ----
# False color with illuminance curves
# on top of luminance picture
panel_72 = Panel("""pcond -h <rad> <rad-.>_exposed.hdr
falsecolor -s 9000 -d 0 -l lux -p <rad-.>_exposed.hdr -i <irrad> -cl -log 3 > <rad-.>_fc.hdr;echo <rad-.>_fc.hdr""")
rad = Text(executessh_26.Stdout)
irrad = Text(executessh_27.Stdout)
bool_6 = Boolean([or, executessh_27.Ran])
overrides_32 = ApplyOverrides(Input=panel_72, Rad=graft(rad), Irrad=graft(irrad))  # -> Output, DynamicOutput
executessh_33 = ExecuteSSH(
    _SSHCommands_=overrides_32.DynamicOutput,
    Run=bool_6,
    addPrefix=True,
    description="""pcond -h images/2023_03_31_2208_54_Perspective2_render.hdr.hdr images/2023_03_31_2208_54_Perspective2_render.hdr_exposed.hdr
falsecolor -s 9000 -d 0 -l lux -p images/2023_03_31_2208_54_Perspective2_render.hdr_exposed.hdr -i images/2023_03_31_2208_54_Perspective2_render_illum.hdr.hdr -cl -log 3 > images/2023_03_31_2208_54_Perspective2_render.hdr_fc.hdr;echo images/2023_03_31_2208_54_Perspective2_render.hdr_fc.hdr""",
    fireLogs=False,
    lastRunTime=95.5874,
    suppressWarnings=False,
    results="images/2023_03_31_2208_54_Perspective2_render.hdr_fc.hdr",
    commands="""pcond -h images/2023_03_31_2208_54_Perspective2_render.hdr.hdr images/2023_03_31_2208_54_Perspective2_render.hdr_exposed.hdr
falsecolor -s 9000 -d 0 -l lux -p images/2023_03_31_2208_54_Perspective2_render.hdr_exposed.hdr -i images/2023_03_31_2208_54_Perspective2_render_illum.hdr.hdr -cl -log 3 > images/2023_03_31_2208_54_Perspective2_render.hdr_fc.hdr;echo images/2023_03_31_2208_54_Perspective2_render.hdr_fc.hdr""")  # -> Stdout, Stderr_, Ran
download_8 = Download(
    LinuxFilePaths=executessh_33.Stdout,
    Run=executessh_33.Ran,
    stdouts="C:\Users\mm1013\MantaRay\TestFolder\2023_03_31_2208_54_Perspective2_render.hdr_fc.hdr")  # -> FilePaths, Status, Ran
imageviewer_4 = LBImageViewer(ImagePath_=download_8.FilePaths, _scale_="1", DisableClickable=False, SaveImgWithCoords=False, scale=1)  # -> ImagePath, Values, GIF

default = DefaultMSS(
    data=flatten(["date", "top -b -n1 | grep \"Cpu(s)\" | awk '{print $2 + $4}'"]),
    default_value_flattened=flatten(logviewer_2.CurrentTasks))
falsestart_15 = LBFalseStartToggle(False)
panel_73 = Panel("""pwd
ls""")
falsestart_16 = LBFalseStartToggle(True)
falsestart_17 = LBFalseStartToggle(True)

# ----
# killl the task
panel_74 = Panel("cat <LinuxHome>/ambientFiles/<target-.>_ot.err")
overrides_33 = ApplyOverrides(Input=panel_74, Target=graft(panel_60), Time=graft(python_9), View=graft(viewname_2))  # -> Output, DynamicOutput
executessh_34 = ExecuteSSH(
    _SSHCommands_=overrides_33.DynamicOutput,
    Run=falsestart_17,
    addPrefix=True,
    description="cat ~/MantaRay/TestFolder/ambientFiles/2023_03_31_2208_54_Perspective2_render_ot.err",
    fireLogs=False,
    lastRunTime=64.8046,
    suppressWarnings=False,
    stderr="cat: /home/lio/MantaRay/TestFolder/ambientFiles/2023_03_31_2208_54_Perspective2_render_ot.err: No such file or directory",
    commands="cat ~/MantaRay/TestFolder/ambientFiles/2023_03_31_2208_54_Perspective2_render_ot.err")  # -> Stdout, Stderr_, Ran
panel_75 = Panel(executessh_34.Stdout)
python_13 = GhPythonScript(errIn=executessh_34.Stdout)  # -> pid, run
# ---------- python_13: Python ----------
__author__ = "mm1013"
__version__ = "2022.10.06"

import rhinoscriptsyntax as rs

start = errIn.split(":")[0].split(" ")[-1]
print(start)
try:
    pid = int(start)
    run = True
except:
    run = False
# ---------- end python_13 ----------
falsestart_18 = LBFalseStartToggle(False)
overrides_34 = ApplyOverrides(Input="kill <pid>", Pid=graft(python_13.pid))  # -> Output, DynamicOutput
executessh_35 = ExecuteSSH(
    _SSHCommands_=overrides_34.Output,
    Run=flatten([python_13.run, falsestart_18]),
    addPrefix=True,
    fireLogs=False,
    lastRunTime=0,
    suppressWarnings=False)  # -> Stdout, Stderr_, Ran

executessh_36 = ExecuteSSH(_SSHCommands_=default, Run=falsestart_15, addPrefix=True, fireLogs=False, lastRunTime=64.4889, suppressWarnings=False)  # -> Stdout, Stderr_, Ran
executessh_37 = ExecuteSSH(
    _SSHCommands_=panel_73,
    Run=falsestart_16,
    addPrefix=True,
    fireLogs=False,
    lastRunTime=63.8618,
    suppressWarnings=False,
    results="""/home/lio/MantaRay/TestFolder
ambFiles
ambfileX_2023_03_31_2028_36.af
ambfileX_2023_03_31_2030_52.af
ambfileX_2023_03_31_2030_54.af
ambfileX_2023_03_31_2031_00.af
ambfileX_2023_03_31_2032_15.af
ambfileX_2023_03_31_2032_43.af
ambfileX_2023_03_31_2032_50.af
ambfileX_2023_03_31_2032_53.af
ambientFiles
images
myRender_exposed.hdr
myRender_exposed.png
myRender_exposed.tif
myRender.hdr
myRender_overture.hdr
objFiles
octrees
radFiles
render.opt
scene.rif
skies
views""",
    commands="""pwd
ls""")  # -> Stdout, Stderr_, Ran
cpu_usage = Panel(executessh_36.Stdout)
pwd = Panel(executessh_37.Stdout)

falsestart_19 = LBFalseStartToggle(True)

# ----
# Test an overcast sky illuminance at a horizontal surface (RiR)
# try running below on your windows machine if you have RVU setup.
# It should show the sky seen from below
panel_76 = Panel("PureSky_Overcast10klux.oct")
panel_77 = Panel("""mkdir -p <proj>/octrees/
oconv -r 2048 -w -f <rads> > <proj>/octrees/<target>
echo <proj>/octrees/<target>""")
sky_ovc_3 = Text(sky_ovc)
panel_78 = Panel("echo \"0 0 0 0 0 1\" | rtrace -h -w -I+ -w -ab 1 -ad 10000 <oct> | rcalc -e '$1=($1*0.265+$2*0.670+$3*0.065)*179'")
overrides_35 = ApplyOverrides(Input=panel_77, Rads=graft(sky_ovc_3), Target=graft(panel_76))  # -> Output, DynamicOutput
executessh_38 = ExecuteSSH(
    _SSHCommands=overrides_35.DynamicOutput,
    Run=falsestart_19,
    addPrefix=True,
    description="""mkdir -p ~/MantaRay/TestFolder/octrees/
oconv -r 2048 -w -f ~/MantaRay/TestFolder/skies/overcast_sky.rad > ~/MantaRay/TestFolder/octrees/PureSky_Overcast10klux.oct
echo ~/MantaRay/TestFolder/octrees/PureSky_Overcast10klux.oct""",
    fireLogs=True,
    lastRunTime=66.0209,
    name="oconv PureSky_Overcast10klux.oct",
    staticDescription="""mkdir -p ~/MantaRay/Andrei/octrees/
oconv -r 2048 -w -f ~/MantaRay/Andrei/skies/overcast_sky.rad ~/MantaRay/Andrei/radFiles/Glass_70.mat /home/lio/MantaRay/Andrei/radFiles/Glass_70_geo.rad ~/MantaRay/Andrei/radFiles/opaque_materials.mat /home/lio/MantaRay/Andrei/radFiles/FloorMat_0.7_geo.rad /home/lio/MantaRay/Andrei/radFiles/Cladding_0.5_geo.rad /home/lio/MantaRay/Andrei/radFiles/ConcreteWhite_0.8_geo.rad /home/lio/MantaRay/Andrei/radFiles/ConcreteStructure_0.3_geo.rad /home/lio/MantaRay/Andrei/radFiles/ConcreteGrey_0.5_geo.rad /home/lio/MantaRay/Andrei/radFiles/IntWalls_0.9_geo.rad /home/lio/MantaRay/Andrei/radFiles/Pipes_0.03_geo.rad /home/lio/MantaRay/Andrei/radFiles/ConcreteDarker_0.1_geo.rad /home/lio/MantaRay/Andrei/radFiles/Frames_0.6_geo.rad /home/lio/MantaRay/Andrei/radFiles/Black_0.01_geo.rad /home/lio/MantaRay/Andrei/radFiles/CurvedCeiling_0.8_geo.rad /home/lio/MantaRay/Andrei/radFiles/IntWalls_0.8_geo.rad /home/lio/MantaRay/Andrei/radFiles/FloorBox_0.75_geo.rad ~/MantaRay/Andrei/radFiles/other_materials.mat > ~/MantaRay/Andrei/octrees/Scene_Overcast10klux.oct
echo ~/MantaRay/Andrei/octrees/Scene_Overcast10klux.oct""",
    suppressWarnings=False,
    results="/home/lio/MantaRay/TestFolder/octrees/PureSky_Overcast10klux.oct",
    commands="""mkdir -p ~/MantaRay/TestFolder/octrees/
oconv -r 2048 -w -f ~/MantaRay/TestFolder/skies/overcast_sky.rad > ~/MantaRay/TestFolder/octrees/PureSky_Overcast10klux.oct
echo ~/MantaRay/TestFolder/octrees/PureSky_Overcast10klux.oct""")  # -> Stdout, Stderr_, Ran
overrides_36 = ApplyOverrides(Input=panel_78, Oct=graft(executessh_38.Stdout))  # -> Output, DynamicOutput
download_9 = Download(
    SftpPaths=executessh_38.Stdout,
    Run=executessh_38.Ran,
    stdouts="C:\Users\mm1013\MantaRay\TestFolder\PureSky_Overcast10klux.oct")  # -> FilePaths, Status, Ran
panel_79 = Panel("rvu -vta -vp 0 0 0 -vd 0 0 1 -vu 0 1 0 -vh 180 -vv 180 <oct>")
panel_80 = Panel(download_9.FilePaths)
executessh_39 = ExecuteSSH(
    _SSHCommands_=overrides_36.DynamicOutput,
    Run=executessh_38.Ran,
    addPrefix=True,
    description="echo \"0 0 0 0 0 1\" | rtrace -h -w -I+ -w -ab 1 -ad 10000 /home/lio/MantaRay/TestFolder/octrees/PureSky_Overcast10klux.oct | rcalc -e '$1=($1*0.265+$2*0.670+$3*0.065)*179'",
    fireLogs=False,
    lastRunTime=74.878,
    suppressWarnings=False,
    results="10003.449",
    commands="echo \"0 0 0 0 0 1\" | rtrace -h -w -I+ -w -ab 1 -ad 10000 /home/lio/MantaRay/TestFolder/octrees/PureSky_Overcast10klux.oct | rcalc -e '$1=($1*0.265+$2*0.670+$3*0.065)*179'")  # -> Stdout, Stderr_, Ran
_10000_lux_wohoo = Panel(executessh_39.Stdout)
overrides_37 = ApplyOverrides(Input=panel_79, Text=graft(panel_80))  # -> Output, DynamicOutput
panel_81 = Panel(overrides_37.Output)

x_6 = RemoteReceiver(x)

# ---- group: Extracted Coordinates
pt = Point([Point(811, 630, 0), Point(812, 668, 0), Point(814, 715, 0), Point(816, 753, 0), Point(816, 798, 0), Point(1312, 468, 0), Point(1308, 506, 0), Point(1305, 547, 0), Point(1305, 574, 0), Point(1299, 606, 0), Point(1627, 410, 0), Point(1619, 440, 0), Point(1614, 468, 0), Point(1608, 500, 0), Point(132, 21, 0)])  # disabled

# ----
# attempt to probe values from pixels
panel_82 = Panel("pcomb -o <hdr> | pcompos -x 2 -y 2 - -<x> -<y> | pvalue -h -H -df | total -if3 -m | sed -r 's/[\t]+/1/g'")  # disabled
pdecon = Deconstruct(Point=pt)  # -> XComponent, YComponent, ZComponent; disabled
subtraction = Subtraction(A=y_2, B=pdecon.YComponent)  # disabled
overrides_38 = ApplyOverrides(Input=panel_82, Hdr=graft(executessh_27.Stdout), X=graft(pdecon.XComponent), Y=graft(subtraction))  # -> Output, DynamicOutput; disabled
item_2 = ListItem(List=flatten(overrides_38.Output), Index=0, Wrap=True)  # disabled
executessh_40 = ExecuteSSH(
    _SSHCommands_=overrides_38.DynamicOutput,
    Run=executessh_27.Ran,
    addPrefix=True,
    description="""pcomb -o images/2023_03_31_2208_54_Perspective2_render_illum.hdr.hdr | pcompos -x 2 -y 2 - -811 --255 | pvalue -h -H -df | total -if3 -m | sed -r 's/[\t]+/1/g'


- - -

pcomb -o images/2023_03_31_2208_54_Perspective2_render_illum.hdr.hdr | pcompos -x 2 -y 2 - -812 --293 | pvalue -h -H -df | total -if3 -m | sed -r 's/[\t]+/1/g'


- - -

pcomb -o images/2023_03_31_2208_54_Perspective2_render_illum.hdr.hdr | pcompos -x 2 -y 2 - -814 --340 | pvalue -h -H -df | total -if3 -m | sed -r 's/[\t]+/1/g'


- - -

pcomb -o images/2023_03_31_2208_54_Perspective2_render_illum.hdr.hdr | pcompos -x 2 -y 2 - -816 --378 | pvalue -h -H -df | total -if3 -m | sed -r 's/[\t]+/1/g'


- - -

pcomb -o images/2023_03_31_2208_54_Perspective2_render_illum.hdr.hdr | pcompos -x 2 -y 2 - -816 --423 | pvalue -h -H -df | total -if3 -m | sed -r 's/[\t]+/1/g'


- - -

pcomb -o images/2023_03_31_2208_54_Perspective2_render_illum.hdr.hdr | pcompos -x 2 -y 2 - -1312 --93 | pvalue -h -H -df | total -if3 -m | sed -r 's/[\t]+/1/g'


- - -

pcomb -o images/2023_03_31_2208_54_Perspective2_render_illum.hdr.hdr | pcompos -x 2 -y 2 - -1308 --131 | pvalue -h -H -df | total -if3 -m | sed -r 's/[\t]+/1/g'


- - -

pcomb -o images/2023_03_31_2208_54_Perspective2_render_illum.hdr.hdr | pcompos -x 2 -y 2 - -1305 --172 | pvalue -h -H -df | total -if3 -m | sed -r 's/[\t]+/1/g'


- - -

pcomb -o images/2023_03_31_2208_54_Perspective2_render_illum.hdr.hdr | pcompos -x 2 -y 2 - -1305 --199 | pvalue -h -H -df | total -if3 -m | sed -r 's/[\t]+/1/g'


- - -

pcomb -o images/2023_03_31_2208_54_Perspective2_render_illum.hdr.hdr | pcompos -x 2 -y 2 - -1299 --231 | pvalue -h -H -df | total -if3 -m | sed -r 's/[\t]+/1/g'


- - -

pcomb -o images/2023_03_31_2208_54_Perspective2_render_illum.hdr.hdr | pcompos -x 2 -y 2 - -1627 --35 | pvalue -h -H -df | total -if3 -m | sed -r 's/[\t]+/1/g'


- - -

pcomb -o images/2023_03_31_2208_54_Perspective2_render_illum.hdr.hdr | pcompos -x 2 -y 2 - -1619 --65 | pvalue -h -H -df | total -if3 -m | sed -r 's/[\t]+/1/g'


- - -

pcomb -o images/2023_03_31_2208_54_Perspective2_render_illum.hdr.hdr | pcompos -x 2 -y 2 - -1614 --93 | pvalue -h -H -df | total -if3 -m | sed -r 's/[\t]+/1/g'


- - -

pcomb -o images/2023_03_31_2208_54_Perspective2_render_illum.hdr.hdr | pcompos -x 2 -y 2 - -1608 --125 | pvalue -h -H -df | total -if3 -m | sed -r 's/[\t]+/1/g'


- - -

pcomb -o images/2023_03_31_2208_54_Perspective2_render_illum.hdr.hdr | pcompos -x 2 -y 2 - -132 -354 | pvalue -h -H -df | total -if3 -m | sed -r 's/[\t]+/1/g'""",
    fireLogs=False,
    lastRunTime=804.9729,
    suppressWarnings=False,
    results=["01010", "01010", "01010", "01010", "01010", "01010", "01010", "01010", "01010", "01010", "01010", "01010", "01010", "01010", "01010"],
    commands=["pcomb -o images/2023_03_31_2208_54_Perspective2_render_illum.hdr.hdr | pcompos -x 2 -y 2 - -811 --255 | pvalue -h -H -df | total -if3 -m | sed -r 's/[\t]+/1/g'", "pcomb -o images/2023_03_31_2208_54_Perspective2_render_illum.hdr.hdr | pcompos -x 2 -y 2 - -814 --340 | pvalue -h -H -df | total -if3 -m | sed -r 's/[\t]+/1/g'", "pcomb -o images/2023_03_31_2208_54_Perspective2_render_illum.hdr.hdr | pcompos -x 2 -y 2 - -812 --293 | pvalue -h -H -df | total -if3 -m | sed -r 's/[\t]+/1/g'", "pcomb -o images/2023_03_31_2208_54_Perspective2_render_illum.hdr.hdr | pcompos -x 2 -y 2 - -816 --378 | pvalue -h -H -df | total -if3 -m | sed -r 's/[\t]+/1/g'", "pcomb -o images/2023_03_31_2208_54_Perspective2_render_illum.hdr.hdr | pcompos -x 2 -y 2 - -816 --423 | pvalue -h -H -df | total -if3 -m | sed -r 's/[\t]+/1/g'", "pcomb -o images/2023_03_31_2208_54_Perspective2_render_illum.hdr.hdr | pcompos -x 2 -y 2 - -1312 --93 | pvalue -h -H -df | total -if3 -m | sed -r 's/[\t]+/1/g'", "pcomb -o images/2023_03_31_2208_54_Perspective2_render_illum.hdr.hdr | pcompos -x 2 -y 2 - -1308 --131 | pvalue -h -H -df | total -if3 -m | sed -r 's/[\t]+/1/g'", "pcomb -o images/2023_03_31_2208_54_Perspective2_render_illum.hdr.hdr | pcompos -x 2 -y 2 - -1305 --172 | pvalue -h -H -df | total -if3 -m | sed -r 's/[\t]+/1/g'", "pcomb -o images/2023_03_31_2208_54_Perspective2_render_illum.hdr.hdr | pcompos -x 2 -y 2 - -1305 --199 | pvalue -h -H -df | total -if3 -m | sed -r 's/[\t]+/1/g'", "pcomb -o images/2023_03_31_2208_54_Perspective2_render_illum.hdr.hdr | pcompos -x 2 -y 2 - -1299 --231 | pvalue -h -H -df | total -if3 -m | sed -r 's/[\t]+/1/g'", "pcomb -o images/2023_03_31_2208_54_Perspective2_render_illum.hdr.hdr | pcompos -x 2 -y 2 - -1627 --35 | pvalue -h -H -df | total -if3 -m | sed -r 's/[\t]+/1/g'", "pcomb -o images/2023_03_31_2208_54_Perspective2_render_illum.hdr.hdr | pcompos -x 2 -y 2 - -1619 --65 | pvalue -h -H -df | total -if3 -m | sed -r 's/[\t]+/1/g'", "pcomb -o images/2023_03_31_2208_54_Perspective2_render_illum.hdr.hdr | pcompos -x 2 -y 2 - -1614 --93 | pvalue -h -H -df | total -if3 -m | sed -r 's/[\t]+/1/g'", "pcomb -o images/2023_03_31_2208_54_Perspective2_render_illum.hdr.hdr | pcompos -x 2 -y 2 - -1608 --125 | pvalue -h -H -df | total -if3 -m | sed -r 's/[\t]+/1/g'", "pcomb -o images/2023_03_31_2208_54_Perspective2_render_illum.hdr.hdr | pcompos -x 2 -y 2 - -132 -354 | pvalue -h -H -df | total -if3 -m | sed -r 's/[\t]+/1/g'"])  # -> Stdout, Stderr_, Ran; disabled
panel_83 = Panel(item_2)  # disabled
python_14 = GhPythonScript(val=executessh_40.Stdout)  # -> x, y, z, ln; disabled
# ---------- python_14: Python ----------
__author__ = "mm1013"
__version__ = "2022.09.28"

import rhinoscriptsyntax as rs

length = int(len(val)/3.0)
x = val[0:length]
y = val[length:2*length]
z = val[2*length:3*length]
ln = length
# ---------- end python_14 ----------
panel_84 = Panel(executessh_40.Stdout)  # disabled

# ----
# Overview of all running tasks in linux
panel_85 = Panel("ps -aux | grep '<AllRadProgs>'")
logviewer_3 = LogViewer(Number=10)  # -> CurrentTasks, Logs
default_2 = DefaultMSS(data=flatten(panel_85), default_value_flattened=flatten(logviewer_3.CurrentTasks))
panel_86 = Panel(logviewer_3.Logs)

executessh_41 = ExecuteSSH(
    _SSHCommands_=default_2,
    Run=Toggle(True),
    addPrefix=True,
    fireLogs=False,
    lastRunTime=74.5112,
    suppressWarnings=False,
    results="""root           6  0.0  0.0      0     0 ?        I<   09:21   0:00 [kworker/0:0H-events_highpri]
root          32  0.0  0.0      0     0 ?        I<   09:21   0:00 [kworker/3:0H-events_highpri]
root          44  0.0  0.0      0     0 ?        I<   09:21   0:00 [kworker/5:0H-events_highpri]
root          55  0.0  0.0      0     0 ?        I    09:21   0:00 [kworker/7:0-events]
root          62  0.0  0.0      0     0 ?        I<   09:21   0:00 [kworker/8:0H-events_highpri]
root          97  0.0  0.0      0     0 ?        I    09:21   0:00 [kworker/14:0-events]
root          98  0.0  0.0      0     0 ?        I<   09:21   0:00 [kworker/14:0H-events_highpri]
root         104  0.0  0.0      0     0 ?        I<   09:21   0:00 [kworker/15:0H-events_highpri]
root         110  0.0  0.0      0     0 ?        I<   09:21   0:00 [kworker/16:0H-events_highpri]
root         116  0.0  0.0      0     0 ?        I<   09:21   0:00 [kworker/17:0H-events_highpri]
root         122  0.0  0.0      0     0 ?        I<   09:21   0:00 [kworker/18:0H-events_highpri]
root         140  0.0  0.0      0     0 ?        I<   09:21   0:00 [kworker/21:0H-events_highpri]
root         146  0.0  0.0      0     0 ?        I<   09:21   0:00 [kworker/22:0H-events_highpri]
root         152  0.0  0.0      0     0 ?        I<   09:21   0:00 [kworker/23:0H-events_highpri]
root         158  0.0  0.0      0     0 ?        I<   09:21   0:00 [kworker/24:0H-events_highpri]
root         164  0.0  0.0      0     0 ?        I<   09:21   0:00 [kworker/25:0H-events_highpri]
root         170  0.0  0.0      0     0 ?        I<   09:21   0:00 [kworker/26:0H-events_highpri]
root         176  0.0  0.0      0     0 ?        I<   09:21   0:00 [kworker/27:0H-events_highpri]
root         182  0.0  0.0      0     0 ?        I<   09:21   0:00 [kworker/28:0H-events_highpri]
root         188  0.0  0.0      0     0 ?        I<   09:21   0:00 [kworker/29:0H-events_highpri]
root         194  0.0  0.0      0     0 ?        I<   09:21   0:00 [kworker/30:0H-events_highpri]
root         200  0.0  0.0      0     0 ?        I<   09:21   0:00 [kworker/31:0H-events_highpri]
root         217  0.0  0.0      0     0 ?        I    09:21   0:00 [kworker/34:0-events]
root         230  0.0  0.0      0     0 ?        I<   09:21   0:00 [kworker/36:0H-events_highpri]
root         242  0.0  0.0      0     0 ?        I<   09:21   0:00 [kworker/38:0H-events_highpri]
root         248  0.0  0.0      0     0 ?        I<   09:21   0:00 [kworker/39:0H-events_highpri]
root         254  0.0  0.0      0     0 ?        I<   09:21   0:00 [kworker/40:0H-events_highpri]
root         259  0.0  0.0      0     0 ?        I    09:21   0:00 [kworker/41:0-events]
root         260  0.0  0.0      0     0 ?        I<   09:21   0:00 [kworker/41:0H-events_highpri]
root         266  0.0  0.0      0     0 ?        I<   09:21   0:00 [kworker/42:0H-events_highpri]
root         271  0.0  0.0      0     0 ?        I    09:21   0:00 [kworker/43:0-events]
root         272  0.0  0.0      0     0 ?        I<   09:21   0:00 [kworker/43:0H-events_highpri]
root         283  0.0  0.0      0     0 ?        I    09:21   0:00 [kworker/45:0-events]
root         332  0.0  0.0      0     0 ?        I<   09:21   0:00 [kworker/53:0H-events_highpri]
root         338  0.0  0.0      0     0 ?        I<   09:21   0:00 [kworker/54:0H-events_highpri]
root         344  0.0  0.0      0     0 ?        I<   09:21   0:00 [kworker/55:0H-events_highpri]
root         356  0.0  0.0      0     0 ?        I<   09:21   0:00 [kworker/57:0H-events_highpri]
root         362  0.0  0.0      0     0 ?        I<   09:21   0:00 [kworker/58:0H-events_highpri]
root         368  0.0  0.0      0     0 ?        I<   09:21   0:00 [kworker/59:0H-events_highpri]
root         373  0.0  0.0      0     0 ?        I    09:21   0:00 [kworker/60:0-events]
root         380  0.0  0.0      0     0 ?        I<   09:21   0:00 [kworker/61:0H-events_highpri]
root         392  0.0  0.0      0     0 ?        I<   09:21   0:00 [kworker/63:0H-events_highpri]
root         393  0.0  0.0      0     0 ?        S    09:21   0:00 [kdevtmpfs]
root         397  0.0  0.0      0     0 ?        I    09:21   0:19 [kworker/0:2-events]
root         457  0.0  0.0      0     0 ?        I<   09:21   0:00 [tpm_dev_wq]
root         461  0.0  0.0      0     0 ?        I<   09:21   0:00 [devfreq_wq]
root         465  0.0  0.0      0     0 ?        I    09:21   0:00 [kworker/7:1-events]
root         477  0.0  0.0      0     0 ?        I    09:21   0:00 [kworker/12:1-events]
root         481  0.0  0.0      0     0 ?        I    09:21   0:00 [kworker/16:1-events]
root         511  0.0  0.0      0     0 ?        I    09:21   0:00 [kworker/47:1-events]
root         516  0.0  0.0      0     0 ?        I    09:21   0:00 [kworker/39:1-events]
root         520  0.0  0.0      0     0 ?        I    09:21   0:00 [kworker/22:2-events]
root         521  0.0  0.0      0     0 ?        I    09:21   0:00 [kworker/24:1-events]
root         529  0.0  0.0      0     0 ?        I    09:21   0:00 [kworker/41:1-events]
root         534  0.0  0.0      0     0 ?        I    09:21   0:00 [kworker/43:1-events]
root         541  0.0  0.0      0     0 ?        I    09:21   0:00 [kworker/23:1-events]
root         564  0.0  0.0      0     0 ?        I    09:21   0:00 [kworker/53:1-events]
root         612  0.0  0.0      0     0 ?        I    09:21   0:00 [kworker/59:1-events]
root         622  0.0  0.0      0     0 ?        I    09:21   0:00 [kworker/25:1-events]
root         624  0.0  0.0      0     0 ?        I    09:21   0:00 [kworker/27:1-events]
root         625  0.0  0.0      0     0 ?        I    09:21   0:00 [kworker/28:1-events]
root         626  0.0  0.0      0     0 ?        I    09:21   0:00 [kworker/29:1-events]
root         630  0.0  0.0      0     0 ?        I    09:21   0:00 [kworker/33:1-events]
root         633  0.0  0.0      0     0 ?        I    09:21   0:00 [kworker/37:1-events]
root         635  0.0  0.0      0     0 ?        I    09:21   0:01 [kworker/42:1-events]
root         642  0.0  0.0      0     0 ?        I    09:21   0:00 [kworker/55:1-events]
root         643  0.0  0.0      0     0 ?        I    09:21   0:00 [kworker/56:1-events]
root         644  0.0  0.0      0     0 ?        I    09:21   0:00 [kworker/57:1-events]
root         778  0.0  0.0      0     0 ?        I    09:21   0:00 [kworker/23:2-events]
root         836  0.0  0.0      0     0 ?        I    09:21   0:00 [kworker/37:2-events]
root         860  0.0  0.0  24476  7404 ?        Ss   09:21   0:05 /lib/systemd/systemd-udevd
root         909  0.0  0.0      0     0 ?        I    09:21   0:00 [kworker/40:2-events]
root        1091  0.0  0.0      0     0 ?        I    09:21   0:00 [kworker/21:2-events]
root        1189  0.0  0.0      0     0 ?        I    09:21   0:00 [kworker/44:2-events]
root        1333  0.0  0.0 107924 19492 ?        Ssl  09:21   0:00 /usr/bin/python3 /usr/share/unattended-upgrades/unattended-upgrade-shutdown --wait-for-signal
root        1508  0.0  0.0      0     0 ?        I    09:21   0:00 [kworker/25:2-events]
root        1546  0.0  0.0      0     0 ?        I    09:26   0:00 [kworker/22:0-events]
root        2065  0.0  0.0      0     0 ?        I    15:23   0:00 [kworker/61:2-events]
root        2067  0.0  0.0      0     0 ?        I    15:23   0:00 [kworker/50:0-events]
root        2115  0.0  0.0      0     0 ?        I    15:28   0:00 [kworker/53:2-events]
root        2219  0.0  0.0      0     0 ?        I    17:23   0:00 [kworker/6:0-events]
root        2222  0.0  0.0      0     0 ?        I    17:23   0:00 [kworker/54:1-events]
root        2232  0.0  0.0      0     0 ?        I    17:23   0:00 [kworker/54:2-events]
root        3078  0.0  0.0      0     0 ?        I    18:07   0:01 [kworker/u128:0-events_power_efficient]
root       10030  0.0  0.0      0     0 ?        I    18:45   0:00 [kworker/46:1-events]
root       20325  0.0  0.0      0     0 ?        I    19:20   0:00 [kworker/u128:2-events_power_efficient]
lio        23242  0.0  0.0   7024  3388 ?        Ss   19:31   0:00 bash -c . /etc/profile;. ~/.profile;cd ~/MantaRay/TestFolder;ps -aux | grep 'arch2rad\|bgraph\|bsdf2klems\|bsdf2rad\|bsdf2ttree\|bsdfview\|cnt\|compamb\|cv\|dayfact\|dcglare\|dctimestep\|dgraph\|epw2wea\|ev\|fieldcomb\|findglare\|gcomp\|genBSDF\|genblinds\|genbox\|genclock\|gendaymtx\|genklemsamp\|genprism\|genrev\|gensky\|genskyvec\|gensurf\|genworm\|getbbox\|getinfo\|glare\|glarendx\|glrad\|histo\|icalc\|igraph\|lampcolor\|libmeta.a\|lookamb\|macbethcal\|meta\|meta2bmp\|meta2tga\|metafile\|mgf2meta\|mgf2rad\|mkillum\|mkpmap\|mksource\|neaten\|normpat\|normtiff\|obj2mesh\|obj2rad\|objline\|objview\|oconv\|pabopto2bsdf\|pabopto2xyz\|pcomb\|pcompos\|pcond\|pdfblur\|pexpand\|pextrem\|pfilt\|pflip\|phisto\|pinterp\|pkgBSDF\|plotin\|pmapdump\|pmblur\|pmblur2\|pmdblur\|protate\|psign\|psketch\|psmeta\|psort\|pvalue\|ra_bmp\|ra_gif\|ra_pict\|ra_ppm\|ra_ps\|ra_rgbe\|ra_t16\|ra_t8\|ra_tiff\|ra_xyze\|rad\|rad2mgf\|raddepend\|ran2tiff\|ranimate\|ranimove\|rcalc\|rcode2bmp\|rcode_depth\|rcode_ident\|rcode_norm\|rcollate\|rcontrib\|rcrop\|replmarks\|rfluxmtx\|rhcopy\|rhinfo\|rholo\|rhoptimize\|rhpict\|rlam\|rmtxop\|robjutil\|rpict\|rpiece\|rsensor\|rsplit\|rtpict\|rtrace\|rvu\|tabfunc\|tmesh2rad\|total\|trad\|ttyimage\|vwrays\|vwright\|wrapBSDF\|x11meta\|xform\|xglaresrc\|ximage\|xshowtrace\|falsecolor'
lio        23247  0.0  0.0   7388  3436 ?        S    19:31   0:00 grep arch2rad\|bgraph\|bsdf2klems\|bsdf2rad\|bsdf2ttree\|bsdfview\|cnt\|compamb\|cv\|dayfact\|dcglare\|dctimestep\|dgraph\|epw2wea\|ev\|fieldcomb\|findglare\|gcomp\|genBSDF\|genblinds\|genbox\|genclock\|gendaymtx\|genklemsamp\|genprism\|genrev\|gensky\|genskyvec\|gensurf\|genworm\|getbbox\|getinfo\|glare\|glarendx\|glrad\|histo\|icalc\|igraph\|lampcolor\|libmeta.a\|lookamb\|macbethcal\|meta\|meta2bmp\|meta2tga\|metafile\|mgf2meta\|mgf2rad\|mkillum\|mkpmap\|mksource\|neaten\|normpat\|normtiff\|obj2mesh\|obj2rad\|objline\|objview\|oconv\|pabopto2bsdf\|pabopto2xyz\|pcomb\|pcompos\|pcond\|pdfblur\|pexpand\|pextrem\|pfilt\|pflip\|phisto\|pinterp\|pkgBSDF\|plotin\|pmapdump\|pmblur\|pmblur2\|pmdblur\|protate\|psign\|psketch\|psmeta\|psort\|pvalue\|ra_bmp\|ra_gif\|ra_pict\|ra_ppm\|ra_ps\|ra_rgbe\|ra_t16\|ra_t8\|ra_tiff\|ra_xyze\|rad\|rad2mgf\|raddepend\|ran2tiff\|ranimate\|ranimove\|rcalc\|rcode2bmp\|rcode_depth\|rcode_ident\|rcode_norm\|rcollate\|rcontrib\|rcrop\|replmarks\|rfluxmtx\|rhcopy\|rhinfo\|rholo\|rhoptimize\|rhpict\|rlam\|rmtxop\|robjutil\|rpict\|rpiece\|rsensor\|rsplit\|rtpict\|rtrace\|rvu\|tabfunc\|tmesh2rad\|total\|trad\|ttyimage\|vwrays\|vwright\|wrapBSDF\|x11meta\|xform\|xglaresrc\|ximage\|xshowtrace\|falsecolor""",
    commands="ps -aux | grep 'arch2rad\|bgraph\|bsdf2klems\|bsdf2rad\|bsdf2ttree\|bsdfview\|cnt\|compamb\|cv\|dayfact\|dcglare\|dctimestep\|dgraph\|epw2wea\|ev\|fieldcomb\|findglare\|gcomp\|genBSDF\|genblinds\|genbox\|genclock\|gendaymtx\|genklemsamp\|genprism\|genrev\|gensky\|genskyvec\|gensurf\|genworm\|getbbox\|getinfo\|glare\|glarendx\|glrad\|histo\|icalc\|igraph\|lampcolor\|libmeta.a\|lookamb\|macbethcal\|meta\|meta2bmp\|meta2tga\|metafile\|mgf2meta\|mgf2rad\|mkillum\|mkpmap\|mksource\|neaten\|normpat\|normtiff\|obj2mesh\|obj2rad\|objline\|objview\|oconv\|pabopto2bsdf\|pabopto2xyz\|pcomb\|pcompos\|pcond\|pdfblur\|pexpand\|pextrem\|pfilt\|pflip\|phisto\|pinterp\|pkgBSDF\|plotin\|pmapdump\|pmblur\|pmblur2\|pmdblur\|protate\|psign\|psketch\|psmeta\|psort\|pvalue\|ra_bmp\|ra_gif\|ra_pict\|ra_ppm\|ra_ps\|ra_rgbe\|ra_t16\|ra_t8\|ra_tiff\|ra_xyze\|rad\|rad2mgf\|raddepend\|ran2tiff\|ranimate\|ranimove\|rcalc\|rcode2bmp\|rcode_depth\|rcode_ident\|rcode_norm\|rcollate\|rcontrib\|rcrop\|replmarks\|rfluxmtx\|rhcopy\|rhinfo\|rholo\|rhoptimize\|rhpict\|rlam\|rmtxop\|robjutil\|rpict\|rpiece\|rsensor\|rsplit\|rtpict\|rtrace\|rvu\|tabfunc\|tmesh2rad\|total\|trad\|ttyimage\|vwrays\|vwright\|wrapBSDF\|x11meta\|xform\|xglaresrc\|ximage\|xshowtrace\|falsecolor'")  # -> Stdout, Stderr_, Ran

python_15 = GhPythonScript(x=executessh_41.Stdout)  # -> a
# ---------- python_15: Python ----------
__author__ = "mm1013"
__version__ = "2022.08.30"

import rhinoscriptsyntax as rs

a = [l for l in x.split("\n") if "grep" not in l]
# ---------- end python_15 ----------
panel_87 = Panel(python_15)

panel_88 = Panel("""mkdir -p <proj>/views/
echo "<vf>" > <proj>/views/<target>.vf
echo <proj>/views/<target>.vf""")
concat_5 = Concatenate(FragmentA="Perspective", FragmentB="1")

# ----
# Doubleclick Me To update view
view_3 = CreateView(Viewport="Perspective")  # -> ViewfileContent, ImageRatio

panel_89 = Panel(view_3.ViewfileContent)
vf_3 = Text(view_3.ViewfileContent)
overrides_39 = ApplyOverrides(Input=panel_88, Vf=graft(vf_3), Target=graft(concat_5))  # -> Output, DynamicOutput
executessh_42 = ExecuteSSH(
    _SSHCommands_=overrides_39.DynamicOutput,
    Run=Toggle(True),
    addPrefix=True,
    description="""mkdir -p ~/MantaRay/TestFolder/views/
echo "rvu -vtv -vp 76.210958985352 16.4300937305602 1.83584927923156 -vd -0.349680913647465 0.927360836447747 0.133135786524922 -vu 0.0469732080515546 -0.124573895254805 0.991097806649975 -vh 103.484 -vv 50.000" > ~/MantaRay/TestFolder/views/Perspective1.vf
echo ~/MantaRay/TestFolder/views/Perspective1.vf""",
    fireLogs=False,
    lastRunTime=82.6232,
    suppressWarnings=False,
    results="/home/lio/MantaRay/TestFolder/views/Perspective1.vf",
    commands="""mkdir -p ~/MantaRay/TestFolder/views/
echo "rvu -vtv -vp 76.210958985352 16.4300937305602 1.83584927923156 -vd -0.349680913647465 0.927360836447747 0.133135786524922 -vu 0.0469732080515546 -0.124573895254805 0.991097806649975 -vh 103.484 -vv 50.000" > ~/MantaRay/TestFolder/views/Perspective1.vf
echo ~/MantaRay/TestFolder/views/Perspective1.vf""")  # -> Stdout, Stderr_, Ran

# ----
# VIEW
file_exists = Panel("[ -f <out> ] && echo \"1\" || echo \"0\"")
item_3 = ListItem(List=flatten(executessh_42.Stdout), Index=0, Wrap=True)
panel_90 = Panel(executessh_42.Stdout)
overrides_40 = ApplyOverrides(Input=file_exists, Out=graft(item_3))  # -> Output, DynamicOutput
executessh_43 = ExecuteSSH(
    _SSHCommands_=overrides_40.DynamicOutput,
    Run=executessh_21.Ran,
    addPrefix=True,
    description="[ -f /home/lio/MantaRay/TestFolder/views/Perspective1.vf ] && echo \"1\" || echo \"0\"",
    fireLogs=False,
    lastRunTime=71.3168,
    suppressWarnings=False,
    results="1",
    commands="[ -f /home/lio/MantaRay/TestFolder/views/Perspective1.vf ] && echo \"1\" || echo \"0\"")  # -> Stdout, Stderr_, Ran

# ----
# RENDER WITH RAD (rif files)
# Careful that this sets -av which will brighten your overall picture
octree_3 = Data(octree_overcast)
panel_91 = Panel("""rtpict -w -n <cpus> @<options> -x 500 -y 400 -vf <vf> -af <target-.>.amb <oct> > <LinuxHome>/<target-.>_overture.hdr
rtpict -w -n <cpus> @<options> -vf <vf> -af <target-.>.amb <oct> > <LinuxHome>/<target>
echo <LinuxHome>/<target>""")
panel_92 = Panel("""pcond -h <hdr> <hdr-.>_exposed.hdr
ra_tiff <hdr-.>_exposed.hdr <hdr-.>_exposed.tif
convert <hdr-.>_exposed.tif <hdr-.>_exposed.png
echo <hdr-.>_exposed.png""")

# ----
# https://discourse.radiance-online.org/t/rad-program-for-generating-parameters/6026
panel_93 = Panel("""rpict= rtpict -af <af>.af -n <cpus>
RESOLUTION=1700
QUALITY=M
DETAIL=H
EXPOSURE=+0.0
UP= Z
INDIRECT=2
VARIABILITY=H
REPORT= 1
<zone>
OCTREE=<oct>
view=<vn> -vf <v>""")
panel_94 = Panel("""echo "<RIF>" > <target>
rad -n -s <target> OPTFILE=render.opt
echo render.opt""")
panel_95 = Panel("AMBFILE= xxx")
python_16 = GhPythonScript(update=Button())  # -> time; inputs update: tree; same code as python_9
overrides_41 = ApplyOverrides(
    Input=panel_94,
    RIF=graft(panel_93),
    Target=graft("scene.rif"),
    Oct=graft(octree_3),
    Zone=graft(zone_2.zone),
    Vn=graft(viewname_2),
    V=graft(executessh_25.Stdout),
    Text=graft(python_16))  # -> Output, DynamicOutput
falsestart_20 = LBFalseStartToggle(False)
executessh_44 = ExecuteSSH(
    _SSHCommands_=overrides_41.Output,
    Run=falsestart_20,
    addPrefix=True,
    fireLogs=False,
    lastRunTime=86.4068,
    suppressWarnings=False,
    results="render.opt",
    commands="""echo "rpict= rtpict -af 2023_03_31_2155_49.af -n 63
RESOLUTION=1700
QUALITY=M
DETAIL=H
EXPOSURE=+0.0
UP= Z
INDIRECT=2
VARIABILITY=H
REPORT= 1
ZONE=E 0.00 14.49 0.00 18.21 0.00 13.53

OCTREE=octrees/Scene_Overcast10klux.oct
view=Perspective2 -vf views/Perspective2.vf" > scene.rif
rad -n -s scene.rif OPTFILE=render.opt
echo render.opt""")  # -> Stdout, Stderr_, Ran
overrides_42 = ApplyOverrides(Input="cat <target>", Target=graft(executessh_44.Stdout))  # -> Output, DynamicOutput
executessh_45 = ExecuteSSH(
    _SSHCommands_=overrides_42.Output,
    Run=executessh_44.Ran,
    addPrefix=True,
    fireLogs=False,
    lastRunTime=115.0018,
    suppressWarnings=False,
    results="""-dp 1024
-ar 200
-ms 0.19
-ds .3
-dt .1
-dc .5
-dr 1
-ss 1
-st .1
-ab 2
-aa .1
-ad 1536
-as 392
-av 0.18 0.18 0.18
-lr 8
-lw 1e-4""",
    commands="cat render.opt")  # -> Stdout, Stderr_, Ran
panel_96 = Panel(executessh_45.Stdout)

overrides_43 = ApplyOverrides(
    Input=panel_91,
    Oct=graft(octree_3),
    Target=graft("myRender.hdr"),
    Options=graft(executessh_44.Stdout),
    Vf=graft(executessh_25.Stdout))  # -> Output, DynamicOutput
executessh_46 = ExecuteSSH(
    _SSHCommands=overrides_43.Output,
    Run=executessh_44.Ran,
    addPrefix=True,
    fireLogs=False,
    lastRunTime=5155.4612,
    suppressWarnings=False,
    results="/home/lio/MantaRay/TestFolder/myRender.hdr",
    commands="""rtpict -w -n 63 @render.opt -x 500 -y 400 -vf views/Perspective2.vf -af myRender.amb octrees/Scene_Overcast10klux.oct > ~/MantaRay/TestFolder/myRender_overture.hdr
rtpict -w -n 63 @render.opt -vf views/Perspective2.vf -af myRender.amb octrees/Scene_Overcast10klux.oct > ~/MantaRay/TestFolder/myRender.hdr
echo ~/MantaRay/TestFolder/myRender.hdr""")  # -> Stdout, Stderr_, Ran
overrides_44 = ApplyOverrides(Input=[panel_69, panel_92], Hdr=graft(executessh_46.Stdout))  # -> Output, graft(DynamicOutput)
executessh_47 = ExecuteSSH(
    _SSHCommands_=overrides_44.DynamicOutput,
    Run=executessh_46.Ran,
    addPrefix=True,
    description="""pfilt -e -1 /home/lio/MantaRay/TestFolder/myRender.hdr > /home/lio/MantaRay/TestFolder/myRender_exposed2.hdr
ra_tiff /home/lio/MantaRay/TestFolder/myRender_exposed2.hdr /home/lio/MantaRay/TestFolder/myRender_exposed2.tif
convert /home/lio/MantaRay/TestFolder/myRender_exposed2.tif /home/lio/MantaRay/TestFolder/myRender_exposed2.png
echo /home/lio/MantaRay/TestFolder/myRender_exposed2.png


- - -

pcond -h /home/lio/MantaRay/TestFolder/myRender.hdr /home/lio/MantaRay/TestFolder/myRender_exposed.hdr
ra_tiff /home/lio/MantaRay/TestFolder/myRender_exposed.hdr /home/lio/MantaRay/TestFolder/myRender_exposed.tif
convert /home/lio/MantaRay/TestFolder/myRender_exposed.tif /home/lio/MantaRay/TestFolder/myRender_exposed.png
echo /home/lio/MantaRay/TestFolder/myRender_exposed.png""",
    fireLogs=False,
    lastRunTime=153.1629,
    suppressWarnings=False,
    results=["/home/lio/MantaRay/TestFolder/myRender_exposed2.png", "/home/lio/MantaRay/TestFolder/myRender_exposed.png"],
    commands=["""pfilt -e -1 /home/lio/MantaRay/TestFolder/myRender.hdr > /home/lio/MantaRay/TestFolder/myRender_exposed2.hdr
ra_tiff /home/lio/MantaRay/TestFolder/myRender_exposed2.hdr /home/lio/MantaRay/TestFolder/myRender_exposed2.tif
convert /home/lio/MantaRay/TestFolder/myRender_exposed2.tif /home/lio/MantaRay/TestFolder/myRender_exposed2.png
echo /home/lio/MantaRay/TestFolder/myRender_exposed2.png""", """pcond -h /home/lio/MantaRay/TestFolder/myRender.hdr /home/lio/MantaRay/TestFolder/myRender_exposed.hdr
ra_tiff /home/lio/MantaRay/TestFolder/myRender_exposed.hdr /home/lio/MantaRay/TestFolder/myRender_exposed.tif
convert /home/lio/MantaRay/TestFolder/myRender_exposed.tif /home/lio/MantaRay/TestFolder/myRender_exposed.png
echo /home/lio/MantaRay/TestFolder/myRender_exposed.png"""])  # -> Stdout, Stderr_, Ran
download_10 = Download(
    LinuxFilePaths=flatten(executessh_47.Stdout),
    Run=executessh_47.Ran,
    stdouts="C:\Users\mm1013\MantaRay\TestFolder\myRender_exposed2.png>JOIN<C:\Users\mm1013\MantaRay\TestFolder\myRender_exposed.png")  # -> flatten(FilePaths), Status, Ran
imageviewer_5 = LBImageViewer(ImagePath_=download_10.FilePaths, _scale_="1", DisableClickable=False, SaveImgWithCoords=False, scale=1)  # -> ImagePath, Values, GIF

panel_97 = Panel(overrides_43.Output)

# ----
# Parallel RTPICT render (luminance)
# without ambient cache - high res, low ad
# always cheeck if theres a viewfile!
supersampling_2 = Panel("4")
octree_4 = Text(octree_overcast)
viewfile_3 = Text(executessh_24.Stdout)
x_7 = RemoteReceiver(x)
y_5 = RemoteReceiver(y)
panel_98 = Panel("""mkdir -p images/
rm -r images/<target>
rtpict -n <cpus> -w -ov images/<target> -vf <vf> -x <x> -y <y> <radOptions> <oct>;echo images/<target>""")
panel_99 = Panel("<time>_rtpict_rendering_aa0_<x>_sunny_ad32_<h>")
multiplication_3 = Multiplication(A=x_7, B=supersampling_2)
multiplication_4 = Multiplication(A=y_5, B=supersampling_2)
run_4 = LBFalseStartToggle(True)
python_17 = GhPythonScript(update=run_4)  # -> time; inputs update: tree
# ---------- python_17: Python ----------
__author__ = "mm1013"
__version__ = "2022.08.30"

import rhinoscriptsyntax as rs

from datetime import datetime
dt = datetime.now()

time = "%02d_%02d_%02d_%02d%02d" % (dt.year, dt.month, dt.day, dt.hour, dt.minute)
# ---------- end python_17 ----------
hours_4 = Number("0")

# ----
# raw render of material colors
panel_100 = Panel("""rpict -vf <vf> -x <x> -y <y> <radOptions> <oct> |
pfilt -x /<ss> -y /<ss> -1 -r 0.7 > <proj>/images/<target>_colors_filt.hdr
echo <proj>/images/<target>_colors_filt.hdr""")
viewfile_4 = Text(executessh_24.Stdout)
octree_5 = Text(octree_overcast)
supersampling_3 = Panel("4")
y_6 = RemoteReceiver(y)
x_8 = RemoteReceiver(x)
multiplication_5 = Multiplication(A=x_8, B=supersampling_3)
multiplication_6 = Multiplication(A=y_6, B=supersampling_3)
overrides_45 = ApplyOverrides(
    Input=panel_100,
    Vf=graft(viewfile_4),
    X=graft(multiplication_5),
    Y=graft(multiplication_6),
    Target=graft(panel_99),
    RadOptions=graft("-ab 0 -ad 1 -aa 1 -w -av 1 1 1"),
    Oct=graft(octree_5),
    Time=graft(python_17),
    H=graft(hours_4),
    Ss=graft(supersampling_3))  # -> Output, DynamicOutput
run_5 = LBFalseStartToggle(False)
panel_101 = Panel(overrides_45.DynamicOutput)
executessh_48 = ExecuteSSH(
    _SSHCommands=overrides_45.DynamicOutput,
    Run=run_5,
    addPrefix=True,
    description="""rpict -vf /home/lio/MantaRay/TestFolder/views/Perspective3.vf -x 3000 -y 1500 -ab 0 -ad 1 -aa 1 -w -av 1 1 1 octrees/Scene_Overcast10klux.oct |
pfilt -x /4 -y /4 -1 -r 0.7 > ~/MantaRay/TestFolder/images/2023_03_31_2105_rtpict_rendering_aa0_3000_sunny_ad32_0_colors_filt.hdr
echo ~/MantaRay/TestFolder/images/2023_03_31_2105_rtpict_rendering_aa0_3000_sunny_ad32_0_colors_filt.hdr""",
    fireLogs=True,
    lastRunTime=80956,
    name="rpict for colors (denoisr test)",
    suppressWarnings=True,
    results="/home/lio/simulation/Boston_Skylights/images/2023_01_09_1607_rtpict_rendering_aa0_20000_sunny_ad32_0_colors_filt.hdr",
    commands="""rpict -vf /home/lio/MantaRay/TestingRemote/views/Perspective1.vf -x 20000 -y 10000 -ab 0 -ad 1 -aa 1 -w -av 1 1 1 /home/lio/simulation/Boston_Skylights/octrees/my_test_scene.oct |
pfilt -x /4 -y /4 -1 -r 0.7 > ~/simulation/Boston_Skylights/images/2023_01_09_1607_rtpict_rendering_aa0_20000_sunny_ad32_0_colors_filt.hdr
echo ~/simulation/Boston_Skylights/images/2023_01_09_1607_rtpict_rendering_aa0_20000_sunny_ad32_0_colors_filt.hdr""")  # -> Stdout, Stderr, Ran
download_11 = Download(SftpPaths=flatten(executessh_48.Stdout), Run=executessh_48.Ran)  # -> FilePaths, Status, Ran
imageviewer_6 = LBImageViewer(ImagePath_=download_11.FilePaths, _scale_=1, DisableClickable=False, SaveImgWithCoords=False, scale=1)  # -> ImagePath, Values, GIF

overrides_46 = ApplyOverrides(Input=panel_99, X=graft(x_7), Time=graft("<time>"), H=graft("<h>"))  # -> Output, DynamicOutput

overrides_47 = ApplyOverrides(
    Input=panel_98,
    Vf=graft(viewfile_3),
    X=graft(multiplication_3),
    Y=graft(multiplication_4),
    Target=graft(overrides_46.Output),
    RadOptions=graft("-ab 3 -ad 8 -aa 0"),
    Oct=graft(octree_4),
    Time=graft(python_17),
    H=graft(hours_4))  # -> Output, DynamicOutput
executessh_49 = ExecuteSSH(
    _SSHCommands=overrides_47.DynamicOutput,
    Run=run_4,
    addPrefix=True,
    description="""mkdir -p images/
rm -r images/2023_03_31_2105_rtpict_rendering_aa0_750_sunny_ad32_0
rtpict -n 63 -w -ov images/2023_03_31_2105_rtpict_rendering_aa0_750_sunny_ad32_0 -vf /home/lio/MantaRay/TestFolder/views/Perspective3.vf -x 3000 -y 1500 -ab 3 -ad 8 -aa 0 octrees/Scene_Overcast10klux.oct;echo images/2023_03_31_2105_rtpict_rendering_aa0_750_sunny_ad32_0""",
    fireLogs=True,
    lastRunTime=2595.3805,
    name="rtpict luminance (denoisr test)",
    suppressWarnings=True,
    commands="""mkdir -p images/
rm -r images/2023_03_31_2105_rtpict_rendering_aa0_750_sunny_ad32_0
rtpict -n 63 -w -ov images/2023_03_31_2105_rtpict_rendering_aa0_750_sunny_ad32_0 -vf /home/lio/MantaRay/TestFolder/views/Perspective3.vf -x 3000 -y 1500 -ab 3 -ad 8 -aa 0 octrees/Scene_Overcast10klux.oct;echo images/2023_03_31_2105_rtpict_rendering_aa0_750_sunny_ad32_0""")  # -> Stdout, Stderr, Ran
panel_102 = Panel(executessh_49.Stderr)

# ----
# Get path to radiance.hdr
# (rtpict generates a whole folder of other stuff..)
panel_103 = Panel("<proj>/images/<target>")
overrides_48 = ApplyOverrides(Input=panel_103, X=graft(x_7), Target=graft(panel_99), Time=graft(python_17), H=graft(hours_4))  # -> Output, DynamicOutput
overrides_49 = ApplyOverrides(Input="ls <target>", Target=graft(overrides_48.Output))  # -> Output, DynamicOutput
executessh_50 = ExecuteSSH(
    _SSHCommands_=overrides_49.DynamicOutput,
    Run=executessh_49.Ran,
    addPrefix=True,
    description="ls ~/MantaRay/TestFolder/images/2023_03_31_2105_rtpict_rendering_aa0_750_sunny_ad32_0",
    fireLogs=False,
    lastRunTime=112.0294,
    suppressWarnings=False,
    stderr="ls: cannot access '/home/lio/MantaRay/TestFolder/images/2023_03_31_2105_rtpict_rendering_aa0_750_sunny_ad32_0': No such file or directory",
    commands="ls ~/MantaRay/TestFolder/images/2023_03_31_2105_rtpict_rendering_aa0_750_sunny_ad32_0")  # -> Stdout, Stderr_, Ran
concat_6 = Concatenate(FragmentA=overrides_48.Output, FragmentB="radiance.hdr", JoinSeparator="/")
split = TextSplit(Text=executessh_50.Stdout)
concat_7 = Concatenate(FragmentA=overrides_48.Output, FragmentB=split, JoinSeparator="/")

# ----
# Using pfilt to downscale image
# radius per Mark Stock:
# http://markjstock.org/radmisc/aa0_test/final.html
panel_104 = Panel("pfilt -x /<ss> -y /<ss> -1 -r 0.7 <file> > <file-.>_filtered.hdr;echo <file-.>_filtered.hdr")
overrides_50 = ApplyOverrides(Input=panel_104, Ss=graft(supersampling_2), File=graft(concat_7))  # -> Output, DynamicOutput
executessh_51 = ExecuteSSH(
    _SSHCommands_=overrides_50.DynamicOutput,
    Run=executessh_49.Ran,
    addPrefix=True,
    description="pfilt -x /4 -y /4 -1 -r 0.7 ~/MantaRay/TestFolder/images/2023_03_31_2105_rtpict_rendering_aa0_750_sunny_ad32_0/ > _filtered.hdr;echo _filtered.hdr",
    fireLogs=False,
    lastRunTime=70.2528,
    suppressWarnings=False,
    results="_filtered.hdr",
    stderr="pfilt: can't open file \"/home/lio/MantaRay/TestFolder/images/2023_03_31_2105_rtpict_rendering_aa0_750_sunny_ad32_0/\"",
    commands="pfilt -x /4 -y /4 -1 -r 0.7 ~/MantaRay/TestFolder/images/2023_03_31_2105_rtpict_rendering_aa0_750_sunny_ad32_0/ > _filtered.hdr;echo _filtered.hdr")  # -> Stdout, Stderr_, Ran

# ----
# -la for titel: pcompos -la -a 3 -s 10 -b 1 1 1 <hdrFiles> > <proj>/images/<target>
# echo <proj>/images/<target>
# pcompos -a 15 -b 1 1 1 -s 5 <proj>/mtxs/skyRenders/skyTregenza*.hdr > <proj>/mtxs/skyRenders/all.hdr
panel_105 = Panel("""ra_tiff <hdrFiles> <proj>/images/<target-.>.tif
convert <proj>/images/<target-.>.tif <proj>/images/<target-.>.png
echo <proj>/images/<target-.>.png""")
panel_106 = Panel("pcond -h <hdr> <hdr-.>_exposed.hdr;echo <hdr-.>_exposed.hdr")
overrides_51 = ApplyOverrides(Input=panel_105, HdrFiles=graft(concat_6), Target=graft("render_original.png"))  # -> Output, DynamicOutput
overrides_52 = ApplyOverrides(Input=panel_106, Hdr=graft(executessh_51.Stdout))  # -> Output, DynamicOutput
panel_107 = Panel("psign -h 15 <h> | pcompos <target> 0 0 - 570 20 > <target-.>_s.hdr;echo <target-.>_s.hdr")
executessh_52 = ExecuteSSH(
    _SSHCommands_=overrides_51.DynamicOutput,
    Run=executessh_51.Ran,
    addPrefix=True,
    description="""ra_tiff ~/MantaRay/TestFolder/images/2023_03_31_2105_rtpict_rendering_aa0_750_sunny_ad32_0/radiance.hdr ~/MantaRay/TestFolder/images/render_original.tif
convert ~/MantaRay/TestFolder/images/render_original.tif ~/MantaRay/TestFolder/images/render_original.png
echo ~/MantaRay/TestFolder/images/render_original.png""",
    fireLogs=False,
    lastRunTime=641.9191,
    suppressWarnings=False,
    commands="""ra_tiff ~/MantaRay/TestFolder/images/2023_03_31_2105_rtpict_rendering_aa0_750_sunny_ad32_0/radiance.hdr ~/MantaRay/TestFolder/images/render_original.tif
convert ~/MantaRay/TestFolder/images/render_original.tif ~/MantaRay/TestFolder/images/render_original.png
echo ~/MantaRay/TestFolder/images/render_original.png""")  # -> Stdout, Stderr_, Ran
panel_108 = Panel(overrides_51.Output)
executessh_53 = ExecuteSSH(
    _SSHCommands_=overrides_52.DynamicOutput,
    Run=executessh_51.Ran,
    addPrefix=True,
    description="pcond -h _filtered.hdr _filtered_exposed.hdr;echo _filtered_exposed.hdr",
    fireLogs=False,
    lastRunTime=114.8043,
    suppressWarnings=False,
    results="/home/lio/MantaRay/TestFolder/images/2023_03_31_2105_rtpict_rendering_aa0_750_sunny_ad32_0/radiance_filtered_exposed.hdr",
    commands="pcond -h /home/lio/MantaRay/TestFolder/images/2023_03_31_2105_rtpict_rendering_aa0_750_sunny_ad32_0/radiance_filtered.hdr /home/lio/MantaRay/TestFolder/images/2023_03_31_2105_rtpict_rendering_aa0_750_sunny_ad32_0/radiance_filtered_exposed.hdr;echo /home/lio/MantaRay/TestFolder/images/2023_03_31_2105_rtpict_rendering_aa0_750_sunny_ad32_0/radiance_filtered_exposed.hdr")  # -> Stdout, Stderr_, Ran
download_12 = Download(SftpPaths=flatten(executessh_52.Stdout), Run=executessh_51.Ran)  # -> FilePaths, Status, Ran
hours_5 = Number(hours)
item_4 = ListItem(List=download_12.FilePaths, Index=0, Wrap=True)
overrides_53 = ApplyOverrides(Input=panel_107, H=graft(hours_5), Target=graft(executessh_53.Stdout))  # -> Output, DynamicOutput
imageviewer_7 = LBImageViewer(ImagePath_=item_4, _scale_="1", DisableClickable=False, SaveImgWithCoords=False, scale=1)  # -> ImagePath, Values, GIF
lng = ListLength(List=flatten(executessh_53.Stdout))
python_18 = GhPythonScript(cnt=lng, run=executessh_53.Ran)  # -> out, ran; inputs cnt: Int32, run: Boolean
# ---------- python_18: Python ----------
__author__ = "mm1013"
__version__ = "2022.08.30"

import rhinoscriptsyntax as rs

ran = cnt > 1 and run
# ---------- end python_18 ----------
# Pcompos for tiles
panel_109 = Panel("""pcompos -a 3 -s 10 -b 0.2 0.2 0.2 <hdrFiles> > <proj>/images/<target>
ra_tiff <proj>/images/<target> <proj>/images/<target-.>.tif
convert <proj>/images/<target-.>.tif <proj>/images/<target-.>.png
echo <proj>/images/<target-.>.png""")
executessh_54 = ExecuteSSH(
    _SSHCommands_=overrides_53.DynamicOutput,
    Run=python_18.ran,
    addPrefix=True,
    description="""psign -h 15 800 | pcompos /home/lio/MantaRay/TestFolder/images/2023_03_31_2105_rtpict_rendering_aa0_750_sunny_ad32_0/radiance_filtered_exposed.hdr 0 0 - 570 20 > /home/lio/MantaRay/TestFolder/images/2023_03_31_2105_rtpict_rendering_aa0_750_sunny_ad32_0/radiance_filtered_exposed_s.hdr;echo /home/lio/MantaRay/TestFolder/images/2023_03_31_2105_rtpict_rendering_aa0_750_sunny_ad32_0/radiance_filtered_exposed_s.hdr


- - -

psign -h 15 900 | pcompos /home/lio/MantaRay/TestFolder/images/2023_03_31_2105_rtpict_rendering_aa0_750_sunny_ad32_0/radiance_filtered_exposed.hdr 0 0 - 570 20 > /home/lio/MantaRay/TestFolder/images/2023_03_31_2105_rtpict_rendering_aa0_750_sunny_ad32_0/radiance_filtered_exposed_s.hdr;echo /home/lio/MantaRay/TestFolder/images/2023_03_31_2105_rtpict_rendering_aa0_750_sunny_ad32_0/radiance_filtered_exposed_s.hdr


- - -

psign -h 15 1000 | pcompos /home/lio/MantaRay/TestFolder/images/2023_03_31_2105_rtpict_rendering_aa0_750_sunny_ad32_0/radiance_filtered_exposed.hdr 0 0 - 570 20 > /home/lio/MantaRay/TestFolder/images/2023_03_31_2105_rtpict_rendering_aa0_750_sunny_ad32_0/radiance_filtered_exposed_s.hdr;echo /home/lio/MantaRay/TestFolder/images/2023_03_31_2105_rtpict_rendering_aa0_750_sunny_ad32_0/radiance_filtered_exposed_s.hdr


- - -

psign -h 15 1100 | pcompos /home/lio/MantaRay/TestFolder/images/2023_03_31_2105_rtpict_rendering_aa0_750_sunny_ad32_0/radiance_filtered_exposed.hdr 0 0 - 570 20 > /home/lio/MantaRay/TestFolder/images/2023_03_31_2105_rtpict_rendering_aa0_750_sunny_ad32_0/radiance_filtered_exposed_s.hdr;echo /home/lio/MantaRay/TestFolder/images/2023_03_31_2105_rtpict_rendering_aa0_750_sunny_ad32_0/radiance_filtered_exposed_s.hdr


- - -

psign -h 15 1200 | pcompos /home/lio/MantaRay/TestFolder/images/2023_03_31_2105_rtpict_rendering_aa0_750_sunny_ad32_0/radiance_filtered_exposed.hdr 0 0 - 570 20 > /home/lio/MantaRay/TestFolder/images/2023_03_31_2105_rtpict_rendering_aa0_750_sunny_ad32_0/radiance_filtered_exposed_s.hdr;echo /home/lio/MantaRay/TestFolder/images/2023_03_31_2105_rtpict_rendering_aa0_750_sunny_ad32_0/radiance_filtered_exposed_s.hdr


- - -

psign -h 15 1300 | pcompos /home/lio/MantaRay/TestFolder/images/2023_03_31_2105_rtpict_rendering_aa0_750_sunny_ad32_0/radiance_filtered_exposed.hdr 0 0 - 570 20 > /home/lio/MantaRay/TestFolder/images/2023_03_31_2105_rtpict_rendering_aa0_750_sunny_ad32_0/radiance_filtered_exposed_s.hdr;echo /home/lio/MantaRay/TestFolder/images/2023_03_31_2105_rtpict_rendering_aa0_750_sunny_ad32_0/radiance_filtered_exposed_s.hdr


- - -

psign -h 15 1400 | pcompos /home/lio/MantaRay/TestFolder/images/2023_03_31_2105_rtpict_rendering_aa0_750_sunny_ad32_0/radiance_filtered_exposed.hdr 0 0 - 570 20 > /home/lio/MantaRay/TestFolder/images/2023_03_31_2105_rtpict_rendering_aa0_750_sunny_ad32_0/radiance_filtered_exposed_s.hdr;echo /home/lio/MantaRay/TestFolder/images/2023_03_31_2105_rtpict_rendering_aa0_750_sunny_ad32_0/radiance_filtered_exposed_s.hdr


- - -

psign -h 15 1500 | pcompos /home/lio/MantaRay/TestFolder/images/2023_03_31_2105_rtpict_rendering_aa0_750_sunny_ad32_0/radiance_filtered_exposed.hdr 0 0 - 570 20 > /home/lio/MantaRay/TestFolder/images/2023_03_31_2105_rtpict_rendering_aa0_750_sunny_ad32_0/radiance_filtered_exposed_s.hdr;echo /home/lio/MantaRay/TestFolder/images/2023_03_31_2105_rtpict_rendering_aa0_750_sunny_ad32_0/radiance_filtered_exposed_s.hdr


- - -

psign -h 15 1600 | pcompos /home/lio/MantaRay/TestFolder/images/2023_03_31_2105_rtpict_rendering_aa0_750_sunny_ad32_0/radiance_filtered_exposed.hdr 0 0 - 570 20 > /home/lio/MantaRay/TestFolder/images/2023_03_31_2105_rtpict_rendering_aa0_750_sunny_ad32_0/radiance_filtered_exposed_s.hdr;echo /home/lio/MantaRay/TestFolder/images/2023_03_31_2105_rtpict_rendering_aa0_750_sunny_ad32_0/radiance_filtered_exposed_s.hdr


- - -

psign -h 15 1700 | pcompos /home/lio/MantaRay/TestFolder/images/2023_03_31_2105_rtpict_rendering_aa0_750_sunny_ad32_0/radiance_filtered_exposed.hdr 0 0 - 570 20 > /home/lio/MantaRay/TestFolder/images/2023_03_31_2105_rtpict_rendering_aa0_750_sunny_ad32_0/radiance_filtered_exposed_s.hdr;echo /home/lio/MantaRay/TestFolder/images/2023_03_31_2105_rtpict_rendering_aa0_750_sunny_ad32_0/radiance_filtered_exposed_s.hdr""",
    fireLogs=False,
    lastRunTime=446.7239,
    suppressWarnings=False,
    results=["/home/lio/MantaRay/TestFolder/images/2023_03_31_2105_rtpict_rendering_aa0_750_sunny_ad32_0/radiance_filtered_exposed_s.hdr", "/home/lio/MantaRay/TestFolder/images/2023_03_31_2105_rtpict_rendering_aa0_750_sunny_ad32_0/radiance_filtered_exposed_s.hdr", "/home/lio/MantaRay/TestFolder/images/2023_03_31_2105_rtpict_rendering_aa0_750_sunny_ad32_0/radiance_filtered_exposed_s.hdr", "/home/lio/MantaRay/TestFolder/images/2023_03_31_2105_rtpict_rendering_aa0_750_sunny_ad32_0/radiance_filtered_exposed_s.hdr", "/home/lio/MantaRay/TestFolder/images/2023_03_31_2105_rtpict_rendering_aa0_750_sunny_ad32_0/radiance_filtered_exposed_s.hdr", "/home/lio/MantaRay/TestFolder/images/2023_03_31_2105_rtpict_rendering_aa0_750_sunny_ad32_0/radiance_filtered_exposed_s.hdr", "/home/lio/MantaRay/TestFolder/images/2023_03_31_2105_rtpict_rendering_aa0_750_sunny_ad32_0/radiance_filtered_exposed_s.hdr", "/home/lio/MantaRay/TestFolder/images/2023_03_31_2105_rtpict_rendering_aa0_750_sunny_ad32_0/radiance_filtered_exposed_s.hdr", "/home/lio/MantaRay/TestFolder/images/2023_03_31_2105_rtpict_rendering_aa0_750_sunny_ad32_0/radiance_filtered_exposed_s.hdr", "/home/lio/MantaRay/TestFolder/images/2023_03_31_2105_rtpict_rendering_aa0_750_sunny_ad32_0/radiance_filtered_exposed_s.hdr"],
    commands=["psign -h 15 800 | pcompos /home/lio/MantaRay/TestFolder/images/2023_03_31_2105_rtpict_rendering_aa0_750_sunny_ad32_0/radiance_filtered_exposed.hdr 0 0 - 570 20 > /home/lio/MantaRay/TestFolder/images/2023_03_31_2105_rtpict_rendering_aa0_750_sunny_ad32_0/radiance_filtered_exposed_s.hdr;echo /home/lio/MantaRay/TestFolder/images/2023_03_31_2105_rtpict_rendering_aa0_750_sunny_ad32_0/radiance_filtered_exposed_s.hdr", "psign -h 15 900 | pcompos /home/lio/MantaRay/TestFolder/images/2023_03_31_2105_rtpict_rendering_aa0_750_sunny_ad32_0/radiance_filtered_exposed.hdr 0 0 - 570 20 > /home/lio/MantaRay/TestFolder/images/2023_03_31_2105_rtpict_rendering_aa0_750_sunny_ad32_0/radiance_filtered_exposed_s.hdr;echo /home/lio/MantaRay/TestFolder/images/2023_03_31_2105_rtpict_rendering_aa0_750_sunny_ad32_0/radiance_filtered_exposed_s.hdr", "psign -h 15 1000 | pcompos /home/lio/MantaRay/TestFolder/images/2023_03_31_2105_rtpict_rendering_aa0_750_sunny_ad32_0/radiance_filtered_exposed.hdr 0 0 - 570 20 > /home/lio/MantaRay/TestFolder/images/2023_03_31_2105_rtpict_rendering_aa0_750_sunny_ad32_0/radiance_filtered_exposed_s.hdr;echo /home/lio/MantaRay/TestFolder/images/2023_03_31_2105_rtpict_rendering_aa0_750_sunny_ad32_0/radiance_filtered_exposed_s.hdr", "psign -h 15 1100 | pcompos /home/lio/MantaRay/TestFolder/images/2023_03_31_2105_rtpict_rendering_aa0_750_sunny_ad32_0/radiance_filtered_exposed.hdr 0 0 - 570 20 > /home/lio/MantaRay/TestFolder/images/2023_03_31_2105_rtpict_rendering_aa0_750_sunny_ad32_0/radiance_filtered_exposed_s.hdr;echo /home/lio/MantaRay/TestFolder/images/2023_03_31_2105_rtpict_rendering_aa0_750_sunny_ad32_0/radiance_filtered_exposed_s.hdr", "psign -h 15 1200 | pcompos /home/lio/MantaRay/TestFolder/images/2023_03_31_2105_rtpict_rendering_aa0_750_sunny_ad32_0/radiance_filtered_exposed.hdr 0 0 - 570 20 > /home/lio/MantaRay/TestFolder/images/2023_03_31_2105_rtpict_rendering_aa0_750_sunny_ad32_0/radiance_filtered_exposed_s.hdr;echo /home/lio/MantaRay/TestFolder/images/2023_03_31_2105_rtpict_rendering_aa0_750_sunny_ad32_0/radiance_filtered_exposed_s.hdr", "psign -h 15 1300 | pcompos /home/lio/MantaRay/TestFolder/images/2023_03_31_2105_rtpict_rendering_aa0_750_sunny_ad32_0/radiance_filtered_exposed.hdr 0 0 - 570 20 > /home/lio/MantaRay/TestFolder/images/2023_03_31_2105_rtpict_rendering_aa0_750_sunny_ad32_0/radiance_filtered_exposed_s.hdr;echo /home/lio/MantaRay/TestFolder/images/2023_03_31_2105_rtpict_rendering_aa0_750_sunny_ad32_0/radiance_filtered_exposed_s.hdr"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])  # -> Stdout, Stderr_, Ran
join_7 = TextJoin(Text=flatten(executessh_54.Stdout), Join=" ")
overrides_54 = ApplyOverrides(Input=panel_109, HdrFiles=graft(join_7), Target=graft("combined.hdr"))  # -> Output, DynamicOutput
executessh_55 = ExecuteSSH(
    _SSHCommands_=overrides_54.Output,
    Run=executessh_54.Ran,
    addPrefix=True,
    fireLogs=False,
    lastRunTime=573.0303,
    suppressWarnings=False,
    results="/home/lio/MantaRay/TestFolder/images/combined.png",
    commands="""pcompos -a 3 -s 10 -b 0.2 0.2 0.2 /home/lio/MantaRay/TestFolder/images/2023_03_31_2105_rtpict_rendering_aa0_750_sunny_ad32_0/radiance_filtered_exposed_s.hdr /home/lio/MantaRay/TestFolder/images/2023_03_31_2105_rtpict_rendering_aa0_750_sunny_ad32_0/radiance_filtered_exposed_s.hdr /home/lio/MantaRay/TestFolder/images/2023_03_31_2105_rtpict_rendering_aa0_750_sunny_ad32_0/radiance_filtered_exposed_s.hdr /home/lio/MantaRay/TestFolder/images/2023_03_31_2105_rtpict_rendering_aa0_750_sunny_ad32_0/radiance_filtered_exposed_s.hdr /home/lio/MantaRay/TestFolder/images/2023_03_31_2105_rtpict_rendering_aa0_750_sunny_ad32_0/radiance_filtered_exposed_s.hdr /home/lio/MantaRay/TestFolder/images/2023_03_31_2105_rtpict_rendering_aa0_750_sunny_ad32_0/radiance_filtered_exposed_s.hdr /home/lio/MantaRay/TestFolder/images/2023_03_31_2105_rtpict_rendering_aa0_750_sunny_ad32_0/radiance_filtered_exposed_s.hdr /home/lio/MantaRay/TestFolder/images/2023_03_31_2105_rtpict_rendering_aa0_750_sunny_ad32_0/radiance_filtered_exposed_s.hdr /home/lio/MantaRay/TestFolder/images/2023_03_31_2105_rtpict_rendering_aa0_750_sunny_ad32_0/radiance_filtered_exposed_s.hdr /home/lio/MantaRay/TestFolder/images/2023_03_31_2105_rtpict_rendering_aa0_750_sunny_ad32_0/radiance_filtered_exposed_s.hdr > ~/MantaRay/TestFolder/images/combined.hdr
ra_tiff ~/MantaRay/TestFolder/images/combined.hdr ~/MantaRay/TestFolder/images/combined.tif
convert ~/MantaRay/TestFolder/images/combined.tif ~/MantaRay/TestFolder/images/combined.png
echo ~/MantaRay/TestFolder/images/combined.png""")  # -> Stdout, Stderr_, Ran

download_13 = Download(SftpPaths=executessh_55.Stdout, Run=executessh_55.Ran, stdouts="C:\Users\mm1013\MantaRay\TestFolder\combined.png")  # -> FilePaths, Status, Ran
imageviewer_8 = LBImageViewer(ImagePath_=download_13.FilePaths, _scale_="1", DisableClickable=False, SaveImgWithCoords=False, scale=1)  # -> ImagePath, Values, GIF

# ----
# Parallel RTPICT render with ambient cache
# Illuminance  including PFILT and overture
# overture should now automatically be included in rtpict
# Delete this one but copy the pfilt and overture
# to the section above
viewfile_5 = Text(executessh_42.Stdout)
octree_6 = Text(executessh_23.Stdout)
modifierlist = Text(flatten(cluster_2.name_mod))
octree_overcast_2 = Text(octree_overcast)
entwine_11 = Entwine(Branch00=octree_overcast_2, Branch01=octree_6, FlattenInputs=True)  # -> flatten(Result)
division_2 = Division(A=resolution, B=1.5)
octree_7 = Text(graft(entwine_11))
list_2 = ItemSelector(
    octree_7,
    {"octrees/Scene_Overcast10klux.oct", "octrees/my_test_scene_0800.oct", "octrees/my_test_scene_0900.oct", "octrees/my_test_scene_1000.oct", "octrees/my_test_scene_1100.oct", "octrees/my_test_scene_1200.oct", "octrees/my_test_scene_1300.oct", "octrees/my_test_scene_1400.oct", "octrees/my_test_scene_1500.oct", "octrees/my_test_scene_1600.oct", "octrees/my_test_scene_1700.oct"}, selected="octrees/Scene_Overcast10klux.oct")
y_7 = Number(division_2)
eval = Evaluate(F="x=y", x=octree_7, y=list_2)
panel_110 = Panel("-ab 1 -ad 4096 -lw 0.002 -aa 0.1 -ar 1024 -as 1024")
panel_111 = Panel("""cd <proj>
mkdir -p images/
mkdir -p ambFiles/
rtpict -n <cpus-1> -w -vf <vf> -x 400 -y 300 <radOptions> -af ambFiles/<ambFile> <oct> > /dev/null
rtpict -n <cpus-1> -w -vf <vf> -x <x> -y <y> <radOptions> -af ambFiles/<ambFile> <oct> | pfilt -x /2 -y /2 > images/<target>;echo images/<target>""")
x_9 = Number(x_2)
y_8 = Number(y_7)
run_6 = LBFalseStartToggle(True)
python_19 = GhPythonScript(update=run_6)  # -> time; inputs update: tree; same code as python_9

# ----
# exclude frames
panel_112 = Panel("frames")
python_20 = GhPythonScript(opaqueModifiers=modifierlist, search=panel_112)  # -> a; inputs opaqueModifiers: list, search: list
# ---------- python_20: Python ----------
__author__ = "mm1013"
__version__ = "2022.09.05"

import rhinoscriptsyntax as rs
#import Grasshopper.DataTree as dt
import ghpythonlib.treehelpers as th


o = []
for l in search:
    o.append([s for s in opaqueModifiers if l.lower() in s.lower()])
    

a = th.list_to_tree(o)
# ---------- end python_20 ----------
overrides_55 = ApplyOverrides(Input="-ae <modifier>", Modifier=graft(python_20))  # -> Output, DynamicOutput
join_8 = TextJoin(Text=flatten(overrides_55.Output), Join=" ")

hours_6 = Text(hours_2)
entwine_12 = Entwine(Branch00="ovc", Branch01=hours_6, FlattenInputs=True)  # -> flatten(Result)
cull_7 = CullPattern(List=graft(entwine_12), CullPattern=eval)  # -> flatten(List)
hours_7 = Text(cull_7)

merge = Merge(Data1=panel_110, Data2=list_2, Data3=join_8, Data4=Button())  # -> flatten(Result)
python_21 = GhPythonScript(update=merge)  # -> time; inputs update: tree; same code as python_9
overrides_56 = ApplyOverrides(Input="ambfileX_<time>.af", Time=graft(python_21))  # -> Output, DynamicOutput
overrides_57 = ApplyOverrides(
    Input=panel_111,
    Vf=graft(viewfile_5),
    RadOptions=graft(panel_110),
    AmbFile=graft(overrides_56.Output),
    Oct=graft(list_2),
    X=graft(x_9),
    Y=graft(y_8),
    Target=graft("<time>_rtpict_rendering_aa0.1_<x>_sunny_ad4096_<h>.hdr"),
    Time=graft("<time>"),
    H=graft(hours_7))  # -> Output, DynamicOutput
overrides_58 = ApplyOverrides(Input=overrides_57.Output, Time=graft(python_19))  # -> Output, DynamicOutput
executessh_56 = ExecuteSSH(
    _SSHCommands_=overrides_58.DynamicOutput,
    Run=run_6,
    addPrefix=True,
    description="""cd ~/MantaRay/TestFolder
mkdir -p images/
mkdir -p ambFiles/
rtpict -n 62 -w -vf /home/lio/MantaRay/TestFolder/views/Perspective1.vf -x 400 -y 300 -ab 1 -ad 4096 -lw 0.002 -aa 0.1 -ar 1024 -as 1024 -af ambFiles/ambfileX_2023_03_31_2131_21.af octrees/Scene_Overcast10klux.oct > /dev/null
rtpict -n 62 -w -vf /home/lio/MantaRay/TestFolder/views/Perspective1.vf -x 750 -y 500 -ab 1 -ad 4096 -lw 0.002 -aa 0.1 -ar 1024 -as 1024 -af ambFiles/ambfileX_2023_03_31_2131_21.af octrees/Scene_Overcast10klux.oct | pfilt -x /2 -y /2 > images/2023_03_31_2218_25_rtpict_rendering_aa0.1_750_sunny_ad4096_ovc.hdr;echo images/2023_03_31_2218_25_rtpict_rendering_aa0.1_750_sunny_ad4096_ovc.hdr""",
    fireLogs=False,
    lastRunTime=11117.5614,
    suppressWarnings=False,
    results="images/2023_03_31_2218_25_rtpict_rendering_aa0.1_750_sunny_ad4096_ovc.hdr",
    commands="""cd ~/MantaRay/TestFolder
mkdir -p images/
mkdir -p ambFiles/
rtpict -n 62 -w -vf /home/lio/MantaRay/TestFolder/views/Perspective1.vf -x 400 -y 300 -ab 1 -ad 4096 -lw 0.002 -aa 0.1 -ar 1024 -as 1024 -af ambFiles/ambfileX_2023_03_31_2131_21.af octrees/Scene_Overcast10klux.oct > /dev/null
rtpict -n 62 -w -vf /home/lio/MantaRay/TestFolder/views/Perspective1.vf -x 750 -y 500 -ab 1 -ad 4096 -lw 0.002 -aa 0.1 -ar 1024 -as 1024 -af ambFiles/ambfileX_2023_03_31_2131_21.af octrees/Scene_Overcast10klux.oct | pfilt -x /2 -y /2 > images/2023_03_31_2218_25_rtpict_rendering_aa0.1_750_sunny_ad4096_ovc.hdr;echo images/2023_03_31_2218_25_rtpict_rendering_aa0.1_750_sunny_ad4096_ovc.hdr""")  # -> Stdout, Stderr_, Ran
download_14 = Download(
    LinuxFilePaths=executessh_56.Stdout,
    Run=executessh_56.Ran,
    stdouts="C:\Users\mm1013\MantaRay\TestFolder\2023_03_31_2218_25_rtpict_rendering_aa0.1_750_sunny_ad4096_ovc.hdr")  # -> FilePaths, Status, Ran

panel_113 = Panel(overrides_58.Output)

# ----
# save pngs exposed and raw
panel_114 = Panel("""ra_tiff <hdr-.>.hdr <hdr-.>.tif
convert <hdr-.>.tif <hdr-.>.png
rm <hdr-.>.tif
echo <hdr-.>.png""")  # disabled
set_exposure_manually_e_3 = Panel("""pfilt -1 -e -3 <hdr> > <hdr-.>_filt.hdr
ra_tiff <hdr-.>_filt.hdr <hdr-.>_filt.tif
convert <hdr-.>_filt.tif <hdr-.>_filt.png
rm <hdr-.>_filt.tif
rm <hdr-.>_filt.hdr
echo <hdr-.>_filt.png""")  # disabled
panel_115 = Panel("""pcond -h <hdr> <hdr-.>_exposed.hdr
ra_tiff <hdr-.>_exposed.hdr <hdr-.>_exposed.tif
convert <hdr-.>_exposed.tif <hdr-.>_exposed.png
rm <hdr-.>_exposed.tif
rm <hdr-.>_exposed.hdr
echo <hdr-.>_exposed.png""")  # disabled
entwine_13 = Entwine(Branch00=panel_115, Branch01=panel_114, Branch02=set_exposure_manually_e_3, FlattenInputs=True)  # disabled
overrides_59 = ApplyOverrides(Input=entwine_13, Hdr=graft(executessh_56.Stdout))  # -> Output, DynamicOutput; disabled
executessh_57 = ExecuteSSH(
    _SSHCommands_=overrides_59.DynamicOutput,
    Run=download_14.Ran,
    addPrefix=True,
    description="""pcond -h images/2023_03_31_2218_25_rtpict_rendering_aa0.1_750_sunny_ad4096_ovc.hdr images/2023_03_31_2218_25_rtpict_rendering_aa0.1_750_sunny_ad4096_ovc_exposed.hdr
ra_tiff images/2023_03_31_2218_25_rtpict_rendering_aa0.1_750_sunny_ad4096_ovc_exposed.hdr images/2023_03_31_2218_25_rtpict_rendering_aa0.1_750_sunny_ad4096_ovc_exposed.tif
convert images/2023_03_31_2218_25_rtpict_rendering_aa0.1_750_sunny_ad4096_ovc_exposed.tif images/2023_03_31_2218_25_rtpict_rendering_aa0.1_750_sunny_ad4096_ovc_exposed.png
rm images/2023_03_31_2218_25_rtpict_rendering_aa0.1_750_sunny_ad4096_ovc_exposed.tif
rm images/2023_03_31_2218_25_rtpict_rendering_aa0.1_750_sunny_ad4096_ovc_exposed.hdr
echo images/2023_03_31_2218_25_rtpict_rendering_aa0.1_750_sunny_ad4096_ovc_exposed.png


- - -

ra_tiff images/2023_03_31_2218_25_rtpict_rendering_aa0.1_750_sunny_ad4096_ovc.hdr images/2023_03_31_2218_25_rtpict_rendering_aa0.1_750_sunny_ad4096_ovc.tif
convert images/2023_03_31_2218_25_rtpict_rendering_aa0.1_750_sunny_ad4096_ovc.tif images/2023_03_31_2218_25_rtpict_rendering_aa0.1_750_sunny_ad4096_ovc.png
rm images/2023_03_31_2218_25_rtpict_rendering_aa0.1_750_sunny_ad4096_ovc.tif
echo images/2023_03_31_2218_25_rtpict_rendering_aa0.1_750_sunny_ad4096_ovc.png


- - -

pfilt -1 -e -3 images/2023_03_31_2218_25_rtpict_rendering_aa0.1_750_sunny_ad4096_ovc.hdr > images/2023_03_31_2218_25_rtpict_rendering_aa0.1_750_sunny_ad4096_ovc_filt.hdr
ra_tiff images/2023_03_31_2218_25_rtpict_rendering_aa0.1_750_sunny_ad4096_ovc_filt.hdr images/2023_03_31_2218_25_rtpict_rendering_aa0.1_750_sunny_ad4096_ovc_filt.tif
convert images/2023_03_31_2218_25_rtpict_rendering_aa0.1_750_sunny_ad4096_ovc_filt.tif images/2023_03_31_2218_25_rtpict_rendering_aa0.1_750_sunny_ad4096_ovc_filt.png
rm images/2023_03_31_2218_25_rtpict_rendering_aa0.1_750_sunny_ad4096_ovc_filt.tif
rm images/2023_03_31_2218_25_rtpict_rendering_aa0.1_750_sunny_ad4096_ovc_filt.hdr
echo images/2023_03_31_2218_25_rtpict_rendering_aa0.1_750_sunny_ad4096_ovc_filt.png""",
    fireLogs=False,
    lastRunTime=159.7077,
    suppressWarnings=False,
    results=["images/2023_03_31_2218_25_rtpict_rendering_aa0.1_750_sunny_ad4096_ovc_exposed.png", "images/2023_03_31_2218_25_rtpict_rendering_aa0.1_750_sunny_ad4096_ovc.png", "images/2023_03_31_2218_25_rtpict_rendering_aa0.1_750_sunny_ad4096_ovc_filt.png"],
    commands=["""ra_tiff images/2023_03_31_2218_25_rtpict_rendering_aa0.1_750_sunny_ad4096_ovc.hdr images/2023_03_31_2218_25_rtpict_rendering_aa0.1_750_sunny_ad4096_ovc.tif
convert images/2023_03_31_2218_25_rtpict_rendering_aa0.1_750_sunny_ad4096_ovc.tif images/2023_03_31_2218_25_rtpict_rendering_aa0.1_750_sunny_ad4096_ovc.png
rm images/2023_03_31_2218_25_rtpict_rendering_aa0.1_750_sunny_ad4096_ovc.tif
echo images/2023_03_31_2218_25_rtpict_rendering_aa0.1_750_sunny_ad4096_ovc.png""", """pcond -h images/2023_03_31_2218_25_rtpict_rendering_aa0.1_750_sunny_ad4096_ovc.hdr images/2023_03_31_2218_25_rtpict_rendering_aa0.1_750_sunny_ad4096_ovc_exposed.hdr
ra_tiff images/2023_03_31_2218_25_rtpict_rendering_aa0.1_750_sunny_ad4096_ovc_exposed.hdr images/2023_03_31_2218_25_rtpict_rendering_aa0.1_750_sunny_ad4096_ovc_exposed.tif
convert images/2023_03_31_2218_25_rtpict_rendering_aa0.1_750_sunny_ad4096_ovc_exposed.tif images/2023_03_31_2218_25_rtpict_rendering_aa0.1_750_sunny_ad4096_ovc_exposed.png
rm images/2023_03_31_2218_25_rtpict_rendering_aa0.1_750_sunny_ad4096_ovc_exposed.tif
rm images/2023_03_31_2218_25_rtpict_rendering_aa0.1_750_sunny_ad4096_ovc_exposed.hdr
echo images/2023_03_31_2218_25_rtpict_rendering_aa0.1_750_sunny_ad4096_ovc_exposed.png"""])  # -> Stdout, Stderr_, Ran; disabled
download_15 = Download(
    LinuxFilePaths=executessh_57.Stdout,
    Run=executessh_57.Ran,
    stdouts="C:\Users\mm1013\MantaRay\TestFolder\2023_03_31_2218_25_rtpict_rendering_aa0.1_750_sunny_ad4096_ovc_filt.png")  # -> flatten(FilePaths), Status, Ran; disabled
imageviewer_9 = LBImageViewer(ImagePath_=download_15.FilePaths, _scale_=2, DisableClickable=False, SaveImgWithCoords=False, scale=2)  # -> ImagePath, Values, GIF; disabled

# ----
# Create a render of facade normals
panel_116 = Panel("xform -m normalshadermaterial <rad> > <rad-.>_black.rad;echo \"<rad-.>_black.rad\"")
scene_rads_3 = Text(entwine_4)
falsestart_21 = LBFalseStartToggle(False)
view_4 = Text(executessh_24.Stdout)
target = Text(panel_99)
overrides_60 = ApplyOverrides(Input=panel_116, Rad=graft(scene_rads_3))  # -> Output, DynamicOutput
python_22 = GhPythonScript(x=flatten(scene_rads_3))  # -> a; inputs x: list; same code as python_7
and_3 = GateAnd(A=python_22, B=falsestart_21)
executessh_58 = ExecuteSSH(
    _SSHCommands=overrides_60.Output,
    Run=and_3,
    addPrefix=True,
    description="""- - -



- - -



- - -



- - -



- - -



- - -



- - -



- - -



- - -



- - -



- - -



- - -



- - -



- - -



- - -



- - -""",
    fireLogs=False,
    lastRunTime=2494,
    suppressWarnings=False,
    results=["~/MantaRay/TestingRemote/radFiles/RevitJintInnerCW_Glass_80_mat_black.rad", "~/MantaRay/TestingRemote/radFiles/RevitJintInnerDoors_80_mat_black.rad", "~/MantaRay/TestingRemote/radFiles/Skylights_65_mat_black.rad", "~/MantaRay/TestingRemote/radFiles/GlassInt_74_mat_black.rad", "~/MantaRay/TestingRemote/radFiles/RevitJfacadeFacadesCWglass_74_mat_black.rad", "~/MantaRay/TestingRemote/radFiles/RevitJfacadeWindowGlass_74_mat_black.rad", "~/MantaRay/TestingRemote/radFiles/Skylights_55_mat_black.rad", "~/MantaRay/TestingRemote/radFiles/RevitJfacadeDoorPanel_70_mat_black.rad", "/home/lio/MantaRay/TestingRemote/radFiles/RevitJintInnerCW_Glass_80_black.rad", "/home/lio/MantaRay/TestingRemote/radFiles/RevitJintInnerDoors_80_black.rad", "/home/lio/MantaRay/TestingRemote/radFiles/Skylights_65_black.rad", "/home/lio/MantaRay/TestingRemote/radFiles/GlassInt_74_black.rad", "/home/lio/MantaRay/TestingRemote/radFiles/RevitJfacadeFacadesCWglass_74_black.rad", "/home/lio/MantaRay/TestingRemote/radFiles/RevitJfacadeWindowGlass_74_black.rad", "/home/lio/MantaRay/TestingRemote/radFiles/Skylights_55_black.rad", "/home/lio/MantaRay/TestingRemote/radFiles/RevitJfacadeDoorPanel_70_black.rad", "~/MantaRay/TestingRemote/radFiles/opaque_materials_black.rad", "/home/lio/MantaRay/TestingRemote/radFiles/RevitJintInnerCWs_50_black.rad", "/home/lio/MantaRay/TestingRemote/radFiles/RANSLUCENT_black.rad", "/home/lio/MantaRay/TestingRemote/radFiles/Ceilings_70_black.rad", "/home/lio/MantaRay/TestingRemote/radFiles/RevitJintInnerDoors_50_black.rad", "/home/lio/MantaRay/TestingRemote/radFiles/RevitJintInnerWalls_50_black.rad", "/home/lio/MantaRay/TestingRemote/radFiles/Roofs_20_black.rad", "/home/lio/MantaRay/TestingRemote/radFiles/RevitJfacadeFacadesCladding_50_black.rad", "/home/lio/MantaRay/TestingRemote/radFiles/RoofMullions_70_black.rad", "/home/lio/MantaRay/TestingRemote/radFiles/Frames_50_black.rad", "/home/lio/MantaRay/TestingRemote/radFiles/SlabWall_50_black.rad", "/home/lio/MantaRay/TestingRemote/radFiles/SlabFloor_30_black.rad", "/home/lio/MantaRay/TestingRemote/radFiles/WallInterior_70_black.rad", "/home/lio/MantaRay/TestingRemote/radFiles/Doors_50_black.rad", "/home/lio/MantaRay/TestingRemote/radFiles/RevitJfacadeFacadesWall_50_black.rad", "/home/lio/MantaRay/TestingRemote/radFiles/Floors_20_black.rad", "/home/lio/MantaRay/TestingRemote/radFiles/ByggD_30_black.rad", "/home/lio/MantaRay/TestingRemote/radFiles/Furniture_black.rad", "/home/lio/MantaRay/TestingRemote/radFiles/Curves_black.rad", "/home/lio/MantaRay/TestingRemote/radFiles/ByggE_30_black.rad", "/home/lio/MantaRay/TestingRemote/radFiles/ContextBright_70_black.rad", "/home/lio/MantaRay/TestingRemote/radFiles/RevitJfacadeDoors_55_black.rad", "/home/lio/MantaRay/TestingRemote/radFiles/RevitJfacadeWindowsFrames_70_black.rad", "/home/lio/MantaRay/TestingRemote/radFiles/RevitJfacadeFacadesFrames_70_black.rad"],
    commands=["xform -m normalshadermaterial ~/MantaRay/TestingRemote/radFiles/RevitJintInnerCW_Glass_80_mat.mat > ~/MantaRay/TestingRemote/radFiles/RevitJintInnerCW_Glass_80_mat_black.rad;echo \"~/MantaRay/TestingRemote/radFiles/RevitJintInnerCW_Glass_80_mat_black.rad\"", "xform -m normalshadermaterial ~/MantaRay/TestingRemote/radFiles/Skylights_65_mat.mat > ~/MantaRay/TestingRemote/radFiles/Skylights_65_mat_black.rad;echo \"~/MantaRay/TestingRemote/radFiles/Skylights_65_mat_black.rad\"", "xform -m normalshadermaterial ~/MantaRay/TestingRemote/radFiles/GlassInt_74_mat.mat > ~/MantaRay/TestingRemote/radFiles/GlassInt_74_mat_black.rad;echo \"~/MantaRay/TestingRemote/radFiles/GlassInt_74_mat_black.rad\"", "xform -m normalshadermaterial ~/MantaRay/TestingRemote/radFiles/RevitJfacadeWindowGlass_74_mat.mat > ~/MantaRay/TestingRemote/radFiles/RevitJfacadeWindowGlass_74_mat_black.rad;echo \"~/MantaRay/TestingRemote/radFiles/RevitJfacadeWindowGlass_74_mat_black.rad\"", "xform -m normalshadermaterial ~/MantaRay/TestingRemote/radFiles/RevitJintInnerDoors_80_mat.mat > ~/MantaRay/TestingRemote/radFiles/RevitJintInnerDoors_80_mat_black.rad;echo \"~/MantaRay/TestingRemote/radFiles/RevitJintInnerDoors_80_mat_black.rad\"", "xform -m normalshadermaterial ~/MantaRay/TestingRemote/radFiles/RevitJfacadeFacadesCWglass_74_mat.mat > ~/MantaRay/TestingRemote/radFiles/RevitJfacadeFacadesCWglass_74_mat_black.rad;echo \"~/MantaRay/TestingRemote/radFiles/RevitJfacadeFacadesCWglass_74_mat_black.rad\""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])  # -> flatten(Stdout), Stderr_, Ran
panel_117 = Panel(executessh_58.Stdout)
panel_118 = Panel("""mkdir -p <proj>/octrees/
oconv -r 2048 -w -f <rads> > <proj>/octrees/<target>
echo <proj>/octrees/<target>""")
python_23 = GhPythonScript(x=flatten(executessh_58.Stdout))  # -> a; inputs x: list; same code as python_7
and_4 = GateAnd(A=python_23, B=executessh_58.Ran)

# ----
# normalshader
panel_119 = Panel("""# Materials
void glow normalglow
0
0
4 1.0 1.0 1.0 -1

normalglow colorfunc normalshadermaterial
4 red green blue normalshader.cal
0
0""")
panel_120 = Panel("echo \"<mat>\" > <LinuxHome>/radFiles/mat_normalglow.mat;echo <LinuxHome>/radFiles/mat_normalglow.mat")
overrides_61 = ApplyOverrides(Input=panel_120, Mat=graft(panel_119))  # -> Output, DynamicOutput
executessh_59 = ExecuteSSH(
    _SSHCommands_=overrides_61.DynamicOutput,
    Run=falsestart_21,
    addPrefix=True,
    description="""echo "# Materials
void glow normalglow
0
0
4 1.0 1.0 1.0 -1

normalglow colorfunc normalshadermaterial
4 red green blue normalshader.cal
0
0" > ~/MantaRay/TestFolder/radFiles/mat_normalglow.mat;echo ~/MantaRay/TestFolder/radFiles/mat_normalglow.mat""",
    fireLogs=False,
    lastRunTime=12,
    suppressWarnings=False,
    results="/home/lio/MantaRay/TestingRemote/radFiles/mat_normalglow.mat",
    commands="""echo "# Materials
void glow normalglow
0
0
4 1.0 1.0 1.0 -1

normalglow colorfunc normalshadermaterial
4 red green blue normalshader.cal
0
0" > ~/MantaRay/TestingRemote/radFiles/mat_normalglow.mat;echo ~/MantaRay/TestingRemote/radFiles/mat_normalglow.mat""")  # -> Stdout, Stderr_, Ran
panel_121 = Panel(overrides_61.Output)
normalshadermat = Text(executessh_59.Stdout)

entwine_14 = Entwine(Branch00=normalshadermat, Branch01=executessh_58.Stdout, FlattenInputs=True)
join_9 = TextJoin(Text=flatten(entwine_14), Join=" ")
overrides_62 = ApplyOverrides(Input=panel_118, Rads=graft(join_9), Target=graft("myNormalsScene.oct"))  # -> Output, DynamicOutput
executessh_60 = ExecuteSSH(
    _SSHCommands=overrides_62.DynamicOutput,
    Run=and_4,
    addPrefix=True,
    description="""mkdir -p ~/MantaRay/TestFolder/octrees/
oconv -r 2048 -w -f /home/lio/MantaRay/TestingRemote/radFiles/mat_normalglow.mat ~/MantaRay/TestingRemote/radFiles/RevitJintInnerCW_Glass_80_mat_black.rad ~/MantaRay/TestingRemote/radFiles/RevitJintInnerDoors_80_mat_black.rad ~/MantaRay/TestingRemote/radFiles/Skylights_65_mat_black.rad ~/MantaRay/TestingRemote/radFiles/GlassInt_74_mat_black.rad ~/MantaRay/TestingRemote/radFiles/RevitJfacadeFacadesCWglass_74_mat_black.rad ~/MantaRay/TestingRemote/radFiles/RevitJfacadeWindowGlass_74_mat_black.rad ~/MantaRay/TestingRemote/radFiles/Skylights_55_mat_black.rad ~/MantaRay/TestingRemote/radFiles/RevitJfacadeDoorPanel_70_mat_black.rad /home/lio/MantaRay/TestingRemote/radFiles/RevitJintInnerCW_Glass_80_black.rad /home/lio/MantaRay/TestingRemote/radFiles/RevitJintInnerDoors_80_black.rad /home/lio/MantaRay/TestingRemote/radFiles/Skylights_65_black.rad /home/lio/MantaRay/TestingRemote/radFiles/GlassInt_74_black.rad /home/lio/MantaRay/TestingRemote/radFiles/RevitJfacadeFacadesCWglass_74_black.rad /home/lio/MantaRay/TestingRemote/radFiles/RevitJfacadeWindowGlass_74_black.rad /home/lio/MantaRay/TestingRemote/radFiles/Skylights_55_black.rad /home/lio/MantaRay/TestingRemote/radFiles/RevitJfacadeDoorPanel_70_black.rad ~/MantaRay/TestingRemote/radFiles/opaque_materials_black.rad > ~/MantaRay/TestFolder/octrees/myNormalsScene.oct
echo ~/MantaRay/TestFolder/octrees/myNormalsScene.oct""",
    fireLogs=False,
    lastRunTime=65176,
    suppressWarnings=False,
    results="/home/lio/simulation/Boston_Skylights/octrees/myNormalsScene.oct",
    commands="""mkdir -p ~/simulation/Boston_Skylights/octrees/
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""")  # -> Stdout, Stderr_, Ran

panel_122 = Panel("""rpict -vf <vf> -x <x> -y <y> <radOptions> <oct> |
pfilt -x /<ss> -y /<ss> -1 -r 0.7 > <proj>/images/<target>_normals_filt.hdr
echo <proj>/images/<target>_normals_filt.hdr""")
supersampling_4 = Panel("4")
y_9 = RemoteReceiver(y)
x_10 = RemoteReceiver(x)
multiplication_7 = Multiplication(A=x_10, B=supersampling_4)
multiplication_8 = Multiplication(A=y_9, B=supersampling_4)
overrides_63 = ApplyOverrides(
    Input=panel_122,
    Vf=graft(view_4),
    X=graft(multiplication_7),
    Y=graft(multiplication_8),
    Target=graft(target),
    RadOptions=graft("-ab 0 -ad 1 -aa 1 -w -av 1 1 1"),
    Oct=graft(executessh_60.Stdout),
    Time=graft("0"),
    H=graft("0"),
    Ss=graft(supersampling_4))  # -> Output, DynamicOutput
panel_123 = Panel(overrides_63.Output)
executessh_61 = ExecuteSSH(
    _SSHCommands=overrides_63.DynamicOutput,
    Run=executessh_60.Ran,
    addPrefix=True,
    description="""rpict -vf /home/lio/MantaRay/TestFolder/views/Perspective3.vf -x 3000 -y 1500 -ab 0 -ad 1 -aa 1 -w -av 1 1 1 /home/lio/simulation/Boston_Skylights/octrees/myNormalsScene.oct |
pfilt -x /4 -y /4 -1 -r 0.7 > ~/MantaRay/TestFolder/images/0_rtpict_rendering_aa0_3000_sunny_ad32_0_normals_filt.hdr
echo ~/MantaRay/TestFolder/images/0_rtpict_rendering_aa0_3000_sunny_ad32_0_normals_filt.hdr""",
    fireLogs=False,
    lastRunTime=32065,
    suppressWarnings=True,
    results="/home/lio/simulation/Boston_Skylights/images/2023_01_09_1607_rtpict_rendering_aa0_20000_sunny_ad32_0_normals_filt.hdr",
    commands="""rpict -vf /home/lio/MantaRay/TestingRemote/views/Perspective1.vf -x 20000 -y 10000 -ab 0 -ad 1 -aa 1 -w -av 1 1 1 /home/lio/simulation/Boston_Skylights/octrees/myNormalsScene.oct |
pfilt -x /4 -y /4 -1 -r 0.7 > ~/simulation/Boston_Skylights/images/2023_01_09_1607_rtpict_rendering_aa0_20000_sunny_ad32_0_normals_filt.hdr
echo ~/simulation/Boston_Skylights/images/2023_01_09_1607_rtpict_rendering_aa0_20000_sunny_ad32_0_normals_filt.hdr""")  # -> Stdout, Stderr, Ran
download_16 = Download(SftpPaths=flatten(executessh_61.Stdout), Run=executessh_61.Ran)  # -> FilePaths, Status, Ran
imageviewer_10 = LBImageViewer(ImagePath_=download_16.FilePaths, _scale_=1, DisableClickable=False, SaveImgWithCoords=False, scale=1)  # -> ImagePath, Values, GIF

# ----
# normalshader
# Save the shader. Remember to set your password.
# 
# source = https://discourse.radiance-online.org/t/rendering-of-normal-map/2471/3
panel_124 = Panel("echo <pw> | sudo -S echo \"<shader>\" > /usr/local/radiance/lib/normalshader.cal")
falsestart_22 = LBFalseStartToggle(False)
panel_125 = Panel("""{
  normalshader.cal

  Look in RADIANCE/lib/rayinit.cal for more info on builtin funcs and vars
}

red = (Nx + 1)/2;
green = (Ny + 1)/2;
blue = (Nz + 1)/2;""")

nickname_2 = GH_PromptInput(Prompt="ssh password?", Ask=falsestart_22, Hide=True)

overrides_64 = ApplyOverrides(Input=panel_124, Pw=graft(nickname_2), Shader=graft(panel_125))  # -> Output, DynamicOutput
executessh_62 = ExecuteSSH(
    _SSHCommands_=overrides_64.DynamicOutput,
    Run=falsestart_22,
    addPrefix=True,
    description="""echo  | sudo -S echo "{
  normalshader.cal

  Look in RADIANCE/lib/rayinit.cal for more info on builtin funcs and vars
}

red = (Nx + 1)/2;
green = (Ny + 1)/2;
blue = (Nz + 1)/2;" > /usr/local/radiance/lib/normalshader.cal""",
    fireLogs=False,
    lastRunTime=57,
    suppressWarnings=False,
    stderr="bash: /usr/local/radiance/lib/normalshader.cal: Permission denied",
    commands="""echo YYOURPASSWORD | sudo -S echo "{
  normalshader.cal

  Look in RADIANCE/lib/rayinit.cal for more info on builtin funcs and vars
}

red = (Nx + 1)/2;
green = (Ny + 1)/2;
blue = (Nz + 1)/2;" > /usr/local/radiance/lib/normalshader.cal""")  # -> Stdout, Stderr_, Ran
panel_126 = Panel(overrides_64.Output)
panel_127 = Panel(executessh_62.Stderr_)

# ----
# Parallel RTPICT render (luminance) no cache
viewfile_6 = Text(executessh_24.Stdout)
# Delete this one but copy the multi  sky
# to the section above
octree_8 = Text(executessh_23.Stdout)
octree_overcast_3 = Text(octree_overcast)
entwine_15 = Entwine(Branch00=octree_overcast_3, Branch01=octree_8, FlattenInputs=True)  # -> flatten(Result)
panel_128 = Panel("""mkdir -p images/
rtpict -n <cpus-1> -w -vf <vf> -x <x> -y <y> <radOptions> <oct> | pfilt -x /<ss> -y /<ss> -r 0.7 > images/<target>;echo images/<target>""")
octree_9 = Text(graft(entwine_15))
list_3 = ItemSelector(
    octree_9,
    {"octrees/Scene_Overcast10klux.oct", "octrees/my_test_scene_0800.oct", "octrees/my_test_scene_0900.oct", "octrees/my_test_scene_1000.oct", "octrees/my_test_scene_1100.oct", "octrees/my_test_scene_1200.oct", "octrees/my_test_scene_1300.oct", "octrees/my_test_scene_1400.oct", "octrees/my_test_scene_1500.oct", "octrees/my_test_scene_1600.oct", "octrees/my_test_scene_1700.oct"}, selected="octrees/Scene_Overcast10klux.oct")
eval_2 = Evaluate(F="x=y", x=octree_9, y=list_3)
run_7 = LBFalseStartToggle(False)

hours_8 = Text(hours_2)
entwine_16 = Entwine(Branch00="ovc", Branch01=hours_8, FlattenInputs=True)  # -> flatten(Result)
cull_8 = CullPattern(List=graft(entwine_16), CullPattern=eval_2)  # -> flatten(List)
hours_9 = Text(cull_8)

overrides_65 = ApplyOverrides(
    Input=panel_128,
    Vf=graft(viewfile_6),
    X=graft(multiplication),
    Y=graft(multiplication_2),
    RadOptions=graft("-ab 3 -ad 16 -aa 0"),
    Oct=graft(list_3),
    Target=graft("<time>_rtpict_rendering_aa0_<x>_sunny_ad16_<h>.hdr"),
    Time=graft("<time>"),
    H=graft(hours_9),
    Ss=graft(supersampling))  # -> Output, DynamicOutput
python_24 = GhPythonScript(update=flatten(overrides_65.Output))  # -> time; inputs update: tree; same code as python_9

# ----
# Parallel RTPICT render (Illuminance)
# (takes 2.5X longer than above...)
# mkdir -p <proj>/images/
# rtpict -i -w -n 30 -vf <vf> -x <x> -y <y> <radOptions> <oct> | pfilt -x /4 -y /4 -r 0.7 > <proj>/images/<target>;echo <proj>/images/<target>
viewfile_7 = Text(executessh_24.Stdout)
panel_129 = Panel("""mkdir -p <proj>/images/
rtpict -i -w -n <cpus-2> -vf <vf> -x <x> -y <y> <radOptions> <oct> | pfilt -x /<ss> -y /<ss> -r 0.7 > <proj>/images/<target>;echo <proj>/images/<target>""")
run_8 = LBFalseStartToggle(False)
x_11 = RemoteReceiver(x)
y_10 = RemoteReceiver(y)
overrides_66 = ApplyOverrides(
    Input=panel_129,
    Vf=graft(viewfile_7),
    X=graft(x_11),
    Y=graft(y_10),
    RadOptions=graft("-ab 3 -ad 16 -aa 0"),
    Oct=graft(list_3),
    Target=graft("<time>_rtpict_rendering_aa0_<x>_sunny_ad8_<h>_illum.hdr"),
    Time=graft(python_24),
    H=graft(hours_9),
    Ss=graft(supersampling))  # -> Output, DynamicOutput
executessh_63 = ExecuteSSH(
    _SSHCommands_=flatten(overrides_66.DynamicOutput),
    Run=run_8,
    addPrefix=True,
    description="""mkdir -p ~/MantaRay/TestFolder/images/
rtpict -i -w -n 61 -vf /home/lio/MantaRay/TestFolder/views/Perspective3.vf -x 750 -y 375 -ab 3 -ad 16 -aa 0 octrees/Scene_Overcast10klux.oct | pfilt -x /4 -y /4 -r 0.7 > ~/MantaRay/TestFolder/images/2023_03_31_2131_51_rtpict_rendering_aa0_750_sunny_ad8_ovc_illum.hdr;echo ~/MantaRay/TestFolder/images/2023_03_31_2131_51_rtpict_rendering_aa0_750_sunny_ad8_ovc_illum.hdr""",
    fireLogs=False,
    lastRunTime=0,
    suppressWarnings=False)  # -> Stdout, Stderr_, Ran

overrides_67 = ApplyOverrides(Input=overrides_65.DynamicOutput, Time=graft(python_24))  # -> Output, DynamicOutput
executessh_64 = ExecuteSSH(
    _SSHCommands_=flatten(overrides_67.DynamicOutput),
    Run=run_7,
    addPrefix=True,
    description="""mkdir -p images/
rtpict -n 62 -w -vf /home/lio/MantaRay/TestFolder/views/Perspective3.vf -x 3000 -y 1500 -ab 3 -ad 16 -aa 0 octrees/Scene_Overcast10klux.oct | pfilt -x /4 -y /4 -r 0.7 > images/2023_03_31_2131_51_rtpict_rendering_aa0_3000_sunny_ad16_ovc.hdr;echo images/2023_03_31_2131_51_rtpict_rendering_aa0_3000_sunny_ad16_ovc.hdr""",
    fireLogs=False,
    lastRunTime=0,
    suppressWarnings=False)  # -> Stdout, Stderr_, Ran

# ----
# orig dimensions
panel_130 = Panel("getinfo <f>")
overrides_68 = ApplyOverrides(Input=panel_130, F=graft(executessh_63.Stdout))  # -> Output, DynamicOutput
executessh_65 = ExecuteSSH(
    _SSHCommands_=overrides_68.DynamicOutput,
    Run=executessh_63.Ran,
    addPrefix=True,
    description="getinfo <f>",
    fireLogs=False,
    lastRunTime=0,
    suppressWarnings=False)  # -> Stdout, Stderr_, Ran
python_25 = GhPythonScript(x=executessh_65.Stdout)  # -> out, org_y
# ---------- python_25: Python ----------
__author__ = "mm1013"
__version__ = "2022.08.31"

import rhinoscriptsyntax as rs

lines = x.replace("\r","").split("\n")

for l in lines:
    line = l.strip()
    if line.startswith("rtrace"):
        print "RTRACE"
        li = line.split("-y")
        
        print li[1].strip().split(" ")[0]
        org_y = int(li[1].strip().split(" ")[0])
    elif line.startswith("pfilt"):
        print "PFIlT"
        li = line.split("-y")
        
        print li[1].strip().split(" ")[0]
        org_y = org_y / float(li[1].strip().split(" ")[0].replace("/",""))
# ---------- end python_25 ----------

panel_131 = Panel("""pcond -h <hdr> <hdr-.>_exposed.hdr
ra_tiff <hdr-.>_exposed.hdr <hdr-.>_exposed.tif
convert <hdr-.>_exposed.tif <hdr-.>_exposed.png
echo <hdr-.>_exposed.png""")
panel_132 = Panel("""ra_tiff <hdr-.>.hdr <hdr-.>.tif
convert <hdr-.>.tif <hdr-.>.png
echo <hdr-.>.png""")
entwine_17 = Entwine(Branch00=panel_131, Branch01=panel_132, FlattenInputs=True)
overrides_69 = ApplyOverrides(Input=entwine_17, Hdr=graft(executessh_64.Stdout))  # -> Output, DynamicOutput
executessh_66 = ExecuteSSH(
    _SSHCommands_=overrides_69.DynamicOutput,
    Run=executessh_64.Ran,
    addPrefix=True,
    description="""pcond -h <hdr> <hdr>_exposed.hdr
ra_tiff <hdr>_exposed.hdr <hdr>_exposed.tif
convert <hdr>_exposed.tif <hdr>_exposed.png
echo <hdr>_exposed.png


- - -

ra_tiff <hdr>.hdr <hdr>.tif
convert <hdr>.tif <hdr>.png
echo <hdr>.png""",
    fireLogs=False,
    lastRunTime=0,
    suppressWarnings=False)  # -> Stdout, Stderr_, Ran
download_17 = Download(LinuxFilePaths=executessh_66.Stdout, Run=executessh_66.Ran)  # -> flatten(FilePaths), Status, Ran
item_5 = ListItem(List=download_17.FilePaths, Index=0, Wrap=True)  # -> Item, Item1
imageviewer_11 = LBImageViewer(ImagePath_=item_5.Item, _scale_=3, DisableClickable=False, SaveImgWithCoords=False, scale=3)  # -> ImagePath, Values, GIF

# ----
# blurring the irrad
panel_133 = Panel("pfilt -x /3 -y /3 -r 1 <file> | pfilt -1 -x <x> -y <y> > <file-.>_filteredBlur.hdr;ra_tiff <file-.>_filteredBlur.hdr <file-.>_filteredBlur.tif;echo <file-.>_filteredBlur.hdr")
overrides_70 = ApplyOverrides(Input=panel_133, File=graft(executessh_63.Stdout), X=graft(x_6), Y=graft(python_25.org_y))  # -> Output, DynamicOutput
executessh_67 = ExecuteSSH(
    _SSHCommands_=overrides_70.DynamicOutput,
    Run=executessh_63.Ran,
    addPrefix=True,
    description="pfilt -x /3 -y /3 -r 1 <file> | pfilt -1 -x 750 -y <y> > <file>_filteredBlur.hdr;ra_tiff <file>_filteredBlur.hdr <file>_filteredBlur.tif;echo <file>_filteredBlur.hdr",
    fireLogs=False,
    lastRunTime=0,
    suppressWarnings=False)  # -> Stdout, Stderr_, Ran

# ----
# overlay illuminance falsecolor on luminance picture
panel_134 = Panel("""pcond -h <rad> | pfilt -x /2 -y /2 -r 0.7 > <rad-.>exposed_sd.hdr
pfilt -x /2 -y /2 -r 0.7 <irrad> > <irrad-.>_sd.hdr
falsecolor -s 2000 -l lux -lw 200 -lh 300 -p <rad-.>exposed_sd.hdr -i <irrad-.>_sd.hdr -cl > <rad-.>_fc.hdr
ra_tiff <rad-.>_fc.hdr <rad-.>_fc.tif
convert <rad-.>_fc.tif <rad-.>_fc.png
echo <rad-.>_fc.hdr""")
panel_135 = Panel("-log 2")
overrides_71 = ApplyOverrides(Input=panel_134, Rad=graft(executessh_64.Stdout), Irrad=graft(executessh_67.Stdout))  # -> Output, DynamicOutput
executessh_68 = ExecuteSSH(
    _SSHCommands_=overrides_71.DynamicOutput,
    Run=[executessh_63.Ran, executessh_64.Ran],
    addPrefix=True,
    description="""pcond -h <rad> | pfilt -x /2 -y /2 -r 0.7 > <rad>exposed_sd.hdr
pfilt -x /2 -y /2 -r 0.7 <irrad> > <irrad>_sd.hdr
falsecolor -s 2000 -l lux -lw 200 -lh 300 -p <rad>exposed_sd.hdr -i <irrad>_sd.hdr -cl > <rad>_fc.hdr
ra_tiff <rad>_fc.hdr <rad>_fc.tif
convert <rad>_fc.tif <rad>_fc.png
echo <rad>_fc.hdr""",
    fireLogs=False,
    lastRunTime=0,
    suppressWarnings=False)  # -> Stdout, Stderr_, Ran
download_18 = Download(LinuxFilePaths=executessh_68.Stdout, Run=executessh_68.Ran)  # -> FilePaths, Status, Ran
imageviewer_12 = LBImageViewer(ImagePath_=download_18.FilePaths, _scale_=2, DisableClickable=False, SaveImgWithCoords=False, scale=2)  # -> ImagePath, Values, GIF

# ----
# FalseColor
panel_136 = Panel("""pfilt -x /2 -y /2 -r 0.7 <irrad> | falsecolor -s 2000 -l lux -lw 200 -lh 300 > <irrad-.>_fc2.hdr
ra_tiff <irrad-.>_fc2.hdr <irrad-.>_fc2.tif
convert <irrad-.>_fc2.tif <irrad-.>_fc2.png
rm <irrad-.>_fc2.hdr
rm <irrad-.>_fc2.tif
echo <irrad-.>_fc2.png""")
overrides_72 = ApplyOverrides(Input=panel_136, Irrad=graft(executessh_63.Stdout))  # -> Output, DynamicOutput
executessh_69 = ExecuteSSH(
    _SSHCommands_=overrides_72.DynamicOutput,
    Run=executessh_63.Ran,
    addPrefix=True,
    description="""pfilt -x /2 -y /2 -r 0.7 <irrad> | falsecolor -s 2000 -l lux -lw 200 -lh 300 > <irrad>_fc2.hdr
ra_tiff <irrad>_fc2.hdr <irrad>_fc2.tif
convert <irrad>_fc2.tif <irrad>_fc2.png
rm <irrad>_fc2.hdr
rm <irrad>_fc2.tif
echo <irrad>_fc2.png""",
    fireLogs=False,
    lastRunTime=0,
    suppressWarnings=False)  # -> Stdout, Stderr_, Ran
download_19 = Download(LinuxFilePaths=executessh_69.Stdout, Run=executessh_69.Ran)  # -> FilePaths, Status, Ran
imageviewer_13 = LBImageViewer(ImagePath_=download_19.FilePaths, _scale_=2, DisableClickable=False, SaveImgWithCoords=False, scale=2)  # -> ImagePath, Values, GIF

# ----
# save pngs exposed and raw
panel_137 = Panel("""ra_tiff <hdr-.>.hdr <hdr-.>.tif
convert <hdr-.>.tif <hdr-.>.png
rm <hdr-.>.tif
echo <hdr-.>.png""")
panel_138 = Panel("""pcond -h <hdr> <hdr-.>_exposed.hdr
ra_tiff <hdr-.>_exposed.hdr <hdr-.>_exposed.tif
convert <hdr-.>_exposed.tif <hdr-.>_exposed.png
rm <hdr-.>_exposed.tif
rm <hdr-.>_exposed.hdr
echo <hdr-.>_exposed.png""")
entwine_18 = Entwine(Branch00=panel_138, Branch01=panel_137, FlattenInputs=True)
overrides_73 = ApplyOverrides(Input=entwine_18, Hdr=graft(executessh_63.Stdout))  # -> Output, DynamicOutput
executessh_70 = ExecuteSSH(
    _SSHCommands_=overrides_73.DynamicOutput,
    Run=executessh_63.Ran,
    addPrefix=True,
    description="""pcond -h <hdr> <hdr>_exposed.hdr
ra_tiff <hdr>_exposed.hdr <hdr>_exposed.tif
convert <hdr>_exposed.tif <hdr>_exposed.png
rm <hdr>_exposed.tif
rm <hdr>_exposed.hdr
echo <hdr>_exposed.png


- - -

ra_tiff <hdr>.hdr <hdr>.tif
convert <hdr>.tif <hdr>.png
rm <hdr>.tif
echo <hdr>.png""",
    fireLogs=False,
    lastRunTime=0,
    suppressWarnings=False)  # -> Stdout, Stderr_, Ran
download_20 = Download(LinuxFilePaths=executessh_70.Stdout, Run=executessh_70.Ran)  # -> flatten(FilePaths), Status, Ran
item_6 = ListItem(List=download_20.FilePaths, Index=0, Wrap=True)  # -> Item, Item1
imageviewer_14 = LBImageViewer(ImagePath_=item_6.Item, _scale_=2, DisableClickable=False, SaveImgWithCoords=False, scale=2)  # -> ImagePath, Values, GIF
imageviewer_15 = LBImageViewer(ImagePath_=item_6.Item1, _scale_=2, DisableClickable=False, SaveImgWithCoords=False, scale=2)  # -> ImagePath, Values, GIF

panel_139 = Panel("Perspective")  # disabled
panel_140 = Panel("""mkdir -p <proj>/views/
echo "<vf>" > <proj>/views/<target>.vf
echo <proj>/views/<target>.vf""")  # disabled
panel_141 = Panel("1")  # disabled
concat_8 = Concatenate(FragmentA=panel_139, FragmentB=panel_141)  # disabled
toggle_4 = BooleanToggle(True)  # disabled

# ----
# Doubleclick Me To update view
view_5 = CreateView(Viewport=panel_139)  # -> ViewfileContent, ImageRatio; disabled

panel_142 = Panel(view_5.ViewfileContent)  # disabled
vf_4 = Text(view_5.ViewfileContent)  # disabled
overrides_74 = ApplyOverrides(Input=panel_140, Vf=graft(vf_4), Target=graft(concat_8))  # -> Output, DynamicOutput; disabled
executessh_71 = ExecuteSSH(
    _SSHCommands_=overrides_74.DynamicOutput,
    Run=toggle_4,
    addPrefix=True,
    description="""mkdir -p ~/MantaRay/TestFolder/views/
echo "rvu -vtv -vp 76.210958985352 16.4300937305602 1.83584927923156 -vd -0.349680913647465 0.927360836447747 0.133135786524922 -vu 0.0469732080515546 -0.124573895254805 0.991097806649975 -vh 103.484 -vv 50.000" > ~/MantaRay/TestFolder/views/Perspective1.vf
echo ~/MantaRay/TestFolder/views/Perspective1.vf""",
    fireLogs=False,
    lastRunTime=0,
    suppressWarnings=False,
    commands="""mkdir -p ~/MantaRay/TestFolder/views/
echo "rvu -vtv -vp 76.210958985352 16.4300937305602 1.83584927923156 -vd -0.349680913647465 0.927360836447747 0.133135786524922 -vu 0.0469732080515546 -0.124573895254805 0.991097806649975 -vh 103.484 -vv 50.000" > ~/MantaRay/TestFolder/views/Perspective1.vf
echo ~/MantaRay/TestFolder/views/Perspective1.vf""")  # -> Stdout, Stderr_, Ran; disabled

# ----
# VIEW
file_exists_2 = Panel("[ -f <out> ] && echo \"1\" || echo \"0\"")  # disabled
item_7 = ListItem(List=flatten(executessh_71.Stdout), Index=0, Wrap=True)  # disabled
panel_143 = Panel(executessh_71.Stdout)  # disabled
overrides_75 = ApplyOverrides(Input=file_exists_2, Out=graft(item_7))  # -> Output, DynamicOutput; disabled
executessh_72 = ExecuteSSH(
    _SSHCommands_=overrides_75.DynamicOutput,
    Run=executessh_21.Ran,
    addPrefix=True,
    description="[ -f  ] && echo \"1\" || echo \"0\"",
    fireLogs=False,
    lastRunTime=88.03,
    suppressWarnings=False,
    results="1",
    commands="[ -f  ] && echo \"1\" || echo \"0\"")  # -> Stdout, Stderr_, Ran; disabled

# ----
# Parallel ACCELERAD RTRACE render
# echo "rvu -vtv -vp 0.5 4.5 1.6 -vd 0.830824 -1.13002 -0.181063 -vu 0 0 1 -vh 98.2132 -vv 79.2785 -vo 0 -va 0 -vs 0 -vl 0" > <proj>/views/myview.vf;echo <proj>/views/myview.vf
run_9 = LBFalseStartToggle(False)  # disabled
octree_10 = Text(executessh_21.Stdout)  # disabled
viewfile_8 = Text(executessh_71.Stdout)  # disabled
panel_144 = Panel("""mkdir -p <proj>/images/
vwrays -ff -x <x> -y <y> -vf <vf> -pa 1 | accelerad_rtrace <radOptions> -w `vwrays -d -ff -x <x> -y <y> -vf <vf> -pa 1` -ffc <oct> > <proj>/images/<target-.>.hdr
echo <proj>/images/<target-.>.hdr""")  # disabled
panel_145 = Panel("-as 0 -ab 3 -aa 0.2 -ad 128")  # disabled
panel_146 = Panel("-ab 3 -ad 2048")  # disabled
panel_147 = Panel("accelerad_rtrace_rendering.png")  # disabled
panel_148 = Panel("300")  # disabled
panel_149 = Panel("600")  # disabled
overrides_76 = ApplyOverrides(
    Input=panel_144,
    X=graft(panel_149),
    Y=graft(panel_148),
    Vf=graft(viewfile_8),
    RadOptions=graft(panel_145),
    Oct=graft(octree_10),
    Target=graft(panel_147))  # -> Output, DynamicOutput; disabled
executessh_73 = ExecuteSSH(
    _SSHCommands_=overrides_76.DynamicOutput,
    Run=run_9,
    addPrefix=True,
    description="""mkdir -p ~/MantaRay/TestFolder/images/
vwrays -ff -x 600 -y 300 -vf  -pa 1 | accelerad_rtrace -as 0 -ab 3 -aa 0.2 -ad 128 -w `vwrays -d -ff -x 600 -y 300 -vf  -pa 1` -ffc octrees/Scene_Overcast10klux.oct > ~/MantaRay/TestFolder/images/accelerad_rtrace_rendering.hdr
echo ~/MantaRay/TestFolder/images/accelerad_rtrace_rendering.hdr""",
    fireLogs=False,
    lastRunTime=535,
    suppressWarnings=False,
    results="/home/mss/simulation/Boston_Skylights/images/accelerad_rtrace_rendering.hdr",
    stderr="""accelerad_rtrace: internal - A supported NVIDIA GPU could not be found
(/media/nathaniel/DATA/Accelerad/src/rt/optix_radiance.c:255)""",
    commands="""mkdir -p ~/simulation/Boston_Skylights/images/
vwrays -ff -x 600 -y 300 -vf /home/mss/MantaRay/UnnamedProject/views/Perspective1.vf -pa 1 | accelerad_rtrace -as 0 -ab 3 -aa 0.2 -ad 128 -w `vwrays -d -ff -x 600 -y 300 -vf /home/mss/MantaRay/UnnamedProject/views/Perspective1.vf -pa 1` -ffc /home/mss/MantaRay/UnnamedProject/octrees/my_test_scene.oct > ~/simulation/Boston_Skylights/images/accelerad_rtrace_rendering.hdr
echo ~/simulation/Boston_Skylights/images/accelerad_rtrace_rendering.hdr""")  # -> Stdout, Stderr_, Ran; disabled
panel_150 = Panel(executessh_73.Stderr_)  # disabled

# ----
# Using PCOND to set automatic exposure
# and convert to PNG
panel_151 = Panel("""pcond -h <hdr> <hdr-.>_exposed.hdr
ra_tiff <hdr-.>_exposed.hdr <hdr-.>_exposed.tif
convert <hdr-.>_exposed.tif <hdr-.>_exposed.png
echo <hdr-.>_exposed.png""")  # disabled
overrides_77 = ApplyOverrides(Input=panel_151, Hdr=graft(executessh_73.Stdout))  # -> Output, DynamicOutput; disabled
executessh_74 = ExecuteSSH(
    _SSHCommands_=overrides_77.DynamicOutput,
    Run=executessh_73.Ran,
    addPrefix=True,
    description="""pcond -h /home/mss/simulation/Boston_Skylights/images/accelerad_rtrace_rendering.hdr /home/mss/simulation/Boston_Skylights/images/accelerad_rtrace_rendering_exposed.hdr
ra_tiff /home/mss/simulation/Boston_Skylights/images/accelerad_rtrace_rendering_exposed.hdr /home/mss/simulation/Boston_Skylights/images/accelerad_rtrace_rendering_exposed.tif
convert /home/mss/simulation/Boston_Skylights/images/accelerad_rtrace_rendering_exposed.tif /home/mss/simulation/Boston_Skylights/images/accelerad_rtrace_rendering_exposed.png
echo /home/mss/simulation/Boston_Skylights/images/accelerad_rtrace_rendering_exposed.png""",
    fireLogs=False,
    lastRunTime=546,
    suppressWarnings=False,
    results="/home/mss/MantaRay/UnnamedProject/images/rtrace_rendering_exposed.png",
    commands="""pcond -h /home/mss/MantaRay/UnnamedProject/images/rtrace_rendering.hdr /home/mss/MantaRay/UnnamedProject/images/rtrace_rendering_exposed.hdr
ra_tiff /home/mss/MantaRay/UnnamedProject/images/rtrace_rendering_exposed.hdr /home/mss/MantaRay/UnnamedProject/images/rtrace_rendering_exposed.tif
convert /home/mss/MantaRay/UnnamedProject/images/rtrace_rendering_exposed.tif /home/mss/MantaRay/UnnamedProject/images/rtrace_rendering_exposed.png
echo /home/mss/MantaRay/UnnamedProject/images/rtrace_rendering_exposed.png""")  # -> Stdout, Stderr_, Ran; disabled
download_21 = Download(LinuxFilePaths=executessh_74.Stdout, Run=executessh_74.Ran)  # -> FilePaths, Status, Ran; disabled
panel_152 = Panel("1.5")  # disabled
imageviewer_16 = LBImageViewer(ImagePath_=download_21.FilePaths, _scale_=panel_152, DisableClickable=False, SaveImgWithCoords=False, scale=1.5)  # -> ImagePath, Values, GIF; disabled

# ==== cluster DefaultMSS
default_value_flattened = ClusterInput()
data = ClusterInput()
data_2 = Data(data)
merge = Merge(Data1=flatten(data_2), Data2="0")  # -> flatten(Result)
default_value_flattened_2 = Data(flatten(default_value_flattened))
lng = ListLength(List=merge)
equals = Equality(FirstNumber=lng, SecondNumber="1")  # -> Equality, Inequality
cull = CullPattern(List=data_2, CullPattern=invert(equals.Equality))
panel = Panel(equals.Equality)
cull_2 = CullPattern(List=default_value_flattened_2, CullPattern=equals.Equality)
data_3 = Data([cull, cull_2])
data_4 = ClusterOutput(data_3)

# ==== cluster LargestBREP
window_breps = ClusterInput()
window_breps_2 = Brep(window_breps)
debrep = DeconstructBrep(Brep=window_breps_2)  # -> Faces, Edges, Vertices
area = Area(Geometry=debrep.Faces)  # -> Area, Centroid
sort = SortList(Keys=area.Area, ValuesA=debrep.Faces)  # -> Keys, ValuesA
item = ListItem(List=sort.ValuesA, Index=-1, Wrap=True)
group = Group(Objects=flatten(item))
grouped = ClusterOutput(group)

# ==== cluster Cluster
mod = ClusterInput()
panel = Panel(mod)
python = GhPythonScript(mod=mod)  # -> name_geo, name_mod, omod; inputs mod: list
# ---------- python: Python ----------
__author__ = "mm1013"
__version__ = "2023.03.11"

import re

regex = re.compile('[^a-zA-Z0-9_.]')

import rhinoscriptsyntax as rs



name_geo = [regex.sub('_',m.split("\n")[0].split(" ")[2]) + "_geo" for m in mod]
name_mod = [regex.sub('_',m.split("\n")[0].split(" ")[2]) for m in mod]
# ---------- end python ----------
name_mod = ClusterOutput(python.name_mod)
name_geo = ClusterOutput(python.name_geo)
panel_2 = Panel(python.name_geo)
panel_3 = Panel(python.name_mod)

# ==== cluster Cluster_2
L = ClusterInput()
lng = ListLength(List=L)
default = DefaultMSS(data=flatten(lng), default_value_flattened=flatten("0"))
bool = Boolean(default)
bool_2 = ClusterOutput(bool)

# ==== cluster N
mod = ClusterInput()
python = GhPythonScript(mod=mod)  # -> name_geo, name_mod; inputs mod: list
# ---------- python: Python ----------
__author__ = "mm1013"
__version__ = "2023.03.11"

import re

regex = re.compile('[^a-zA-Z0-9_.]')

import rhinoscriptsyntax as rs



name_geo = [regex.sub('_',m.split("\n")[0]) + "_geo" for m in mod]
name_mod = [regex.sub('_',m.split("\n")[0]) for m in mod]
# ---------- end python ----------
name_mod = ClusterOutput(python.name_mod)
name_geo = ClusterOutput(python.name_geo)

# ==== cluster Cluster_3
L = ClusterInput()
lng = ListLength(List=L)
default = DefaultMSS(data=flatten(lng), default_value_flattened=flatten(Toggle(False)))
bool = Boolean(default)
bool_2 = ClusterOutput(bool)
